# Grasshopper definition Biomopher_Karamba.gh (Grasshopper 1.0.7)
# plug-ins: karambaGH, Biomorpher

# ----
# Floor and Ceiling Geometry
# Column Locations
number_slider = Slider(15, range=0..100)
number_slider_2 = Slider(30, range=0..100)
gene_pool = GenePool(Decimals=2, Maximum=30, Minimum=0, Value=[24.32435692, 16.07325841, 10.07765099, 26.44835574, 1.34847507, 19.69386028])
unit_z = UnitZ(Factor=number_slider)
plane_surface = PlaneSurface(Plane=PlaneXY(0, 0, 0), XSize=number_slider_2, YSize=number_slider_2)
dispatch = Dispatch(List=gene_pool, DispatchPattern=[True, False])  # -> ListA, ListB
settings_custom = SettingsCustom(
    StitchSeams=True,
    SimplePlanes=False,
    Refine=True,
    MinCount=Slider(5, range=0..100),
    MaxCount=400,
    AspectRatio=20,
    MaxDistance=0,
    MaxAngle=20,
    MinEdge=0,
    MaxEdge=0)
move = Move(Geometry=plane_surface, Motion=unit_z)  # -> Geometry, Transform
construct_point = ConstructPoint(XCoordinate=dispatch.ListA, YCoordinate=dispatch.ListB, ZCoordinate=0)
mesh_brep = MeshBrep(Brep=move.Geometry, Settings=settings_custom)
deconstruct_mesh = DeconstructMesh(Mesh=mesh_brep)  # -> Vertices, Faces, Colours, Normals
point = Point(deconstruct_mesh.Vertices)
closest_point = ClosestPoint(Point=construct_point, Cloud=point)  # -> ClosestPoint, CPIndex, Distance
line = Line(StartPoint=construct_point, EndPoint=closest_point.ClosestPoint)

# ----
# Karamba Beam Elements
number_slider_3 = Slider(25.55, range=0..100)
mesh_edges = MeshEdges(Mesh=mesh_brep)  # -> NakedEdges, InteriorEdges, NonManifoldEdges
cross_section_karamba3d = CrossSectionKaramba3D(
    FamilyNameOfCrossSection="DefaultCroSec",
    Material=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,
    Diameter_cm=number_slider_3,
    WallThickness_cm=0.4,
    mode="Circular Hollow")
line_to_beam_karamba3d = LineToBeamKaramba3D(
    Line=[mesh_edges.NakedEdges, mesh_edges.InteriorEdges, line],
    CrossSection=cross_section_karamba3d,
    New=True,
    Remove=True,
    LimitDistance_m=0.005)  # -> Element, Points, Info

# ----
# Karamba Mesh to Shell
number_slider_4 = Slider(0.222, range=0..10)
mesh_to_shell_karamba3d = MeshToShellKaramba3D(Mesh=mesh_brep, LimitDistance_m=0.005)  # -> Element, Points, Info
negative = Negative(Value=number_slider_4)
support_karamba3d = SupportKaramba3D(PosInd=closest_point.ClosestPoint, menu=[buttons(on, on, on, on, on, on)])
unit_z_2 = UnitZ(Factor=negative)
loads_karamba3d = LoadsKaramba3D(ForceVector=unit_z_2, Local=False, PosInd=point, LCase=0, mode="Point")
assemble_model_karamba3d = AssembleModelKaramba3D(Elem=line_to_beam_karamba3d.Element, Support=support_karamba3d, Load=loads_karamba3d, LimitDistance_m=0.005)  # -> Model, Info, Mass_kg, CenterOfGravity
analyze_karamba3d = AnalyzeKaramba3D(Model=assemble_model_karamba3d.Model)  # -> CalculatedModel, MaximumDisplacement_cm, ResultingForceOfGravity_kN, ElasticEnergy_kNm
model_view_karamba3d = ModelViewKaramba3D(Model=analyze_karamba3d.CalculatedModel, ResultFactors=1, ResultCase=-1)  # -> Model, DeformedMesh, DeformedAxes, DeformedModel
shell_view_karamba3d = ShellViewKaramba3D(Model=model_view_karamba3d.Model, IndexOfLayer=0)  # -> Model, MeshesOfRenderedShells, LegendColors, LegendTags

beam_view_karamba3d = BeamViewKaramba3D(Model=model_view_karamba3d.Model)  # -> Model, MeshesOfRenderedBeams, DeformedBeamAxes, LegendColors, LegendTags

biomorpher = Biomorpher(Genome=gene_pool, Geometry=beam_view_karamba3d.MeshesOfRenderedBeams, Performs=analyze_karamba3d.MaximumDisplacement_cm)
biomorpherreader = BiomorpherReader(Solution=biomorpher, Branch=0, Generation=0, Design=0)
