# Grasshopper definition FRAME_wind loads_DEMO_biomopher.gh (Grasshopper 1.0.7)
# plug-ins: karambaGH, Biomorpher

# ----
# Lines and Nodes
point = Point(Point(0, 0, 0))
deconstruct = Deconstruct(Point=point)  # -> XComponent, YComponent, ZComponent
number_slider = Slider(7, range=0..20)
number_slider_2 = Slider(5, range=0..20)
number_slider_3 = Slider(10, range=0..30)
number_slider_4 = Slider(7, range=0..30)
addition = Addition(A=deconstruct.ZComponent, B=Slider(5, range=0..20))
addition_2 = Addition(A=deconstruct.XComponent, B=number_slider)
construct_point = ConstructPoint(XCoordinate=deconstruct.XComponent, YCoordinate=deconstruct.YComponent, ZCoordinate=addition)
deconstruct_2 = Deconstruct(Point=construct_point)  # -> XComponent, YComponent, ZComponent
addition_3 = Addition(A=deconstruct_2.YComponent, B=number_slider_3)
construct_point_2 = ConstructPoint(XCoordinate=Slider(0, range=0..30), YCoordinate=Slider(10, range=0..30), ZCoordinate=Slider(0, range=0..30))
construct_point_3 = ConstructPoint(XCoordinate=addition_2, YCoordinate=deconstruct.YComponent, ZCoordinate=deconstruct.ZComponent)
deconstruct_3 = Deconstruct(Point=construct_point_3)  # -> XComponent, YComponent, ZComponent
addition_4 = Addition(A=deconstruct_3.ZComponent, B=number_slider_2)
construct_point_4 = ConstructPoint(XCoordinate=deconstruct_3.XComponent, YCoordinate=deconstruct_3.YComponent, ZCoordinate=addition_4)
deconstruct_4 = Deconstruct(Point=construct_point_4)  # -> XComponent, YComponent, ZComponent
addition_5 = Addition(A=deconstruct_4.YComponent, B=Slider(10, range=0..30))
construct_point_5 = ConstructPoint(XCoordinate=deconstruct_2.XComponent, YCoordinate=addition_3, ZCoordinate=deconstruct_2.ZComponent)
construct_point_6 = ConstructPoint(XCoordinate=number_slider_4, YCoordinate=Slider(10, range=0..30), ZCoordinate=Slider(0, range=0..30))
construct_point_7 = ConstructPoint(XCoordinate=deconstruct_4.XComponent, YCoordinate=addition_5, ZCoordinate=deconstruct_4.ZComponent)
line = Line(StartPoint=construct_point, EndPoint=construct_point_5)
# Karamba Mesh to Shell
line_2 = Line(StartPoint=construct_point, EndPoint=construct_point_4)
line_3 = Line(StartPoint=construct_point_5, EndPoint=construct_point_7)
line_4 = Line(StartPoint=construct_point_4, EndPoint=construct_point_7)
line_5 = Line(StartPoint=point, EndPoint=construct_point)
line_6 = Line(StartPoint=construct_point_3, EndPoint=construct_point_4)
line_7 = Line(StartPoint=construct_point_7, EndPoint=construct_point_6)
line_8 = Line(StartPoint=construct_point_5, EndPoint=construct_point_2)

# ----
# Support  Nodes
point_2 = Point([point, construct_point_2, construct_point_6, construct_point_3])

# ----
# Truss Diagonal Braces
line_9 = Line(StartPoint=construct_point, EndPoint=construct_point_3)
line_10 = Line(StartPoint=construct_point_5, EndPoint=construct_point_6)
line_11 = Line(StartPoint=construct_point, EndPoint=construct_point_2)
line_12 = Line(StartPoint=construct_point_4, EndPoint=construct_point_6)
number_slider_5 = Slider(102, range=0..270)

# ----
# 7m Bearing Beams (non load bearing)
line_13 = Line([line_3, line_2])
cross_section_range_selector_karamba3d = CrossSectionRangeSelectorKaramba3D(MaximumHeight_cm=-1, MaximumWidth_cm=-1, menu=[dropdown(7), dropdown(1), dropdown(4)])
cross_section_selector_karamba3d = CrossSectionSelectorKaramba3D(CrossSections=cross_section_range_selector_karamba3d, NameOrListIndexOfCrossSection=number_slider_5)  # -> CrossSection, Info
disassemble_cross_section_karamba3d = DisassembleCrossSectionKaramba3D(CroSec=cross_section_selector_karamba3d.CrossSection)  # -> CrossSection, FamilyNameOfCrossSection, TypeNameOfCrossSection, ElemIdentifiers, Color, Material, LocalEccentricity_cm, Heights_cm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
panel = Panel(disassemble_cross_section_karamba3d.Area_cm2)
panel_2 = Panel(disassemble_cross_section_karamba3d.CrossSection)
panel_3 = Panel(disassemble_cross_section_karamba3d.Wely_cm3)
line_to_beam_karamba3d = LineToBeamKaramba3D(
    Line=line_13,
    Identifier="Non-Load Bearing Beams",
    CrossSection=cross_section_selector_karamba3d.CrossSection,
    New=True,
    Remove=True,
    LimitDistance_m=0.005)  # -> Element, Points, Info

number_slider_6 = Slider(138, range=0..270)

# ----
# 10m Beams (Load Bearing)
line_14 = Line([line, line_4])
cross_section_range_selector_karamba3d_2 = CrossSectionRangeSelectorKaramba3D(MaximumHeight_cm=-1, MaximumWidth_cm=-1, menu=[dropdown(7), dropdown(1), dropdown(4)])
cross_section_selector_karamba3d_2 = CrossSectionSelectorKaramba3D(CrossSections=cross_section_range_selector_karamba3d_2, NameOrListIndexOfCrossSection=number_slider_6)  # -> CrossSection, Info
disassemble_cross_section_karamba3d_2 = DisassembleCrossSectionKaramba3D(CroSec=cross_section_selector_karamba3d_2.CrossSection)  # -> CrossSection, FamilyNameOfCrossSection, TypeNameOfCrossSection, ElemIdentifiers, Color, Material, LocalEccentricity_cm, Heights_cm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
panel_4 = Panel(disassemble_cross_section_karamba3d_2.CrossSection)
panel_5 = Panel(disassemble_cross_section_karamba3d_2.Area_cm2)
panel_6 = Panel(disassemble_cross_section_karamba3d_2.Wely_cm3)
line_to_beam_karamba3d_2 = LineToBeamKaramba3D(
    Line=line_14,
    Identifier="Load Bearing Beams",
    CrossSection=cross_section_selector_karamba3d_2.CrossSection,
    New=True,
    Remove=True,
    LimitDistance_m=0.005)  # -> Element, Points, Info

number_slider_7 = Slider(137, range=0..270)
number_slider_8 = Slider(58, range=0..187)

# ----
# Truss Diagonal Braces
line_15 = Line([line_9, line_10, line_11, line_12])
cross_section_range_selector_karamba3d_3 = CrossSectionRangeSelectorKaramba3D(MaximumHeight_cm=-1, MaximumWidth_cm=-1, menu=[dropdown(7), dropdown(4), dropdown(1)])
cross_section_selector_karamba3d_3 = CrossSectionSelectorKaramba3D(CrossSections=cross_section_range_selector_karamba3d_3, NameOrListIndexOfCrossSection=number_slider_8)  # -> CrossSection, Info
disassemble_cross_section_karamba3d_3 = DisassembleCrossSectionKaramba3D(CroSec=cross_section_selector_karamba3d_3.CrossSection)  # -> CrossSection, FamilyNameOfCrossSection, TypeNameOfCrossSection, ElemIdentifiers, Color, Material, LocalEccentricity_cm, Heights_cm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
# Non-Load Bearing Beams
# Load Bearing Beams
# Columns
panel_7 = Panel(disassemble_cross_section_karamba3d_3.Area_cm2)
line_to_beam_karamba3d_3 = LineToBeamKaramba3D(
    Line=line_15,
    Identifier="Diagonal Braces",
    CrossSection=cross_section_selector_karamba3d_3.CrossSection,
    New=True,
    Remove=True,
    LimitDistance_m=0.005,
    Bending=Toggle(False))  # -> Element, Points, Info

# ----
# Columns
line_16 = Line([line_5, line_6, line_7, line_8])
cross_section_range_selector_karamba3d_4 = CrossSectionRangeSelectorKaramba3D(MaximumHeight_cm=-1, MaximumWidth_cm=-1, menu=[dropdown(7), dropdown(1), dropdown(4)])
cross_section_selector_karamba3d_4 = CrossSectionSelectorKaramba3D(CrossSections=cross_section_range_selector_karamba3d_4, NameOrListIndexOfCrossSection=number_slider_7)  # -> CrossSection, Info
disassemble_cross_section_karamba3d_4 = DisassembleCrossSectionKaramba3D(CroSec=cross_section_selector_karamba3d_4.CrossSection)  # -> CrossSection, FamilyNameOfCrossSection, TypeNameOfCrossSection, ElemIdentifiers, Color, Material, LocalEccentricity_cm, Heights_cm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
panel_8 = Panel(disassemble_cross_section_karamba3d_4.Area_cm2)
line_to_beam_karamba3d_4 = LineToBeamKaramba3D(
    Line=line_16,
    Identifier="Columns",
    CrossSection=cross_section_selector_karamba3d_4.CrossSection,
    New=True,
    Remove=True,
    LimitDistance_m=0.005)  # -> Element, Points, Info

point_3 = Point([construct_point, construct_point_3, construct_point_4, construct_point_5, construct_point_7, construct_point_6, construct_point_2, point])

# ----
# Pinned Joint Connections
beam_joints_karamba3d = BeamJointsKaramba3D(
    ElementIdentifiers="Non-Load Bearing Beams",
    CtKNMAtStartingNode=Vector(0, 0, 0),
    CrKNmRadAtStartingNode=Vector(0, 0, 0),
    CtKNMAtEndNode=Vector(0, 0, 0),
    CrKNmRadAtEndNode=Vector(0, 0, 0),
    menu=[buttons(off, off, off, off, on, on), buttons(off, off, off, off, on, on)])
panel_9 = Panel(beam_joints_karamba3d)

# ----
# Ridged Joint Connections
beam_joints_karamba3d_2 = BeamJointsKaramba3D(
    ElementIdentifiers=line_to_beam_karamba3d_2.Element,
    CtKNMAtStartingNode=Vector(0, 0, 0),
    CrKNmRadAtStartingNode=Vector(0, 0, 0),
    CtKNMAtEndNode=Vector(0, 0, 0),
    CrKNmRadAtEndNode=Vector(0, 0, 0),
    menu=[buttons(off, off, off, off, off, off), buttons(off, off, off, off, off, off)])
panel_10 = Panel(beam_joints_karamba3d_2)

# ----
# Column Joint Connections
beam_joints_karamba3d_3 = BeamJointsKaramba3D(
    ElementIdentifiers=line_to_beam_karamba3d_4.Element,
    CtKNMAtStartingNode=Vector(0, 0, 0),
    CrKNmRadAtStartingNode=Vector(0, 0, 0),
    CtKNMAtEndNode=Vector(0, 0, 0),
    CrKNmRadAtEndNode=Vector(0, 0, 0),
    menu=[buttons(off, off, off, off, off, off), buttons(off, off, off, off, off, off)])
panel_11 = Panel(beam_joints_karamba3d_3)

name_or_list_of_index_of_materials = Slider(0, range=0..116)
read_material_table_from_file_karamba3d = ReadMaterialTableFromFileKaramba3D()
material_selection_karamba3d = MaterialSelectionKaramba3D(
    Materials=read_material_table_from_file_karamba3d,
    NameOrListIndexOfMaterial=name_or_list_of_index_of_materials,
    menu=[dropdown(1), dropdown(1)])
panel_12 = Panel(material_selection_karamba3d)
disassemble_material_karamba3d = DisassembleMaterialKaramba3D(Material=material_selection_karamba3d)  # -> Material, TypeOfMaterial, FamilyNameOfMaterial, NameOfMaterial, ElemIdentifiers, Color, YoungsModulusKNCm2Dir12, InPlaneShearModulus_kN_cm2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
panel_13 = Panel(disassemble_material_karamba3d.SpecificWeight_kN_m3)

trib_width = Slider(2, range=0..10)
division = Division(A=number_slider_3, B=trib_width)
division_2 = Division(A=number_slider_4, B=trib_width)

# ----
# Wind Loads UDL
wind_load_p_kpa = Slider(3, range=-5..5)
wind_load_p_kpa_2 = Slider(3, range=-5..5)
multiplication = Multiplication(A=wind_load_p_kpa, B=division_2)
multiplication_2 = Multiplication(A=wind_load_p_kpa_2, B=division)
panel_14 = Panel("""4
5""")
unit_y = UnitY(Factor=multiplication)
# selfweights UDL
panel_15 = Panel("""4
7""")
unit_x = UnitX(Factor=multiplication_2)
loads_karamba3d = LoadsKaramba3D(Vector=unit_y, BeamIdentifiers=panel_14, LCase="1", mode="Uniform Line", menu=[buttons(off, on, off)])
loads_karamba3d_2 = LoadsKaramba3D(Vector=unit_x, BeamIdentifiers=panel_15, LCase="1", mode="Uniform Line", menu=[buttons(off, on, off)])

# ----
# Live Loads UDL
live_load_load_bearing = Slider(-10, range=-50..0)
live_load_non_load_bearing = Slider(-10, range=-50..0)
panel_16 = Panel("""2
3""")
panel_17 = Panel("""0
1""")
unit_z = UnitZ(Factor=live_load_load_bearing)
unit_z_2 = UnitZ(Factor=live_load_non_load_bearing)
loads_karamba3d_3 = LoadsKaramba3D(Vector=unit_z, BeamIdentifiers=panel_16, LCase=" 0", mode="Uniform Line", menu=[buttons(off, on, off)])
loads_karamba3d_4 = LoadsKaramba3D(Vector=unit_z_2, BeamIdentifiers=panel_17, LCase=" 0", mode="Uniform Line", menu=[buttons(off, on, off)])
panel_18 = Panel(loads_karamba3d_3)
panel_19 = Panel(loads_karamba3d_4)

# ----
# Fixed Supports
# Relase Rx and Rz to make Pinned Supports
support_karamba3d = SupportKaramba3D(PosInd=point_2, menu=[buttons(on, on, on, on, on, on)])

assemble_model_karamba3d = AssembleModelKaramba3D(
    Point=point_3,
    Elem=[line_to_beam_karamba3d.Element, line_to_beam_karamba3d_2.Element, line_to_beam_karamba3d_4.Element, line_to_beam_karamba3d_3.Element],
    Support=support_karamba3d,
    Load=[loads_karamba3d_3, loads_karamba3d_4, loads_karamba3d, loads_karamba3d_2],
    Material=material_selection_karamba3d,
    Joint=beam_joints_karamba3d,
    LimitDistance_m=0.005)  # -> Model, Info, Mass_kg, CenterOfGravity
panel_20 = Panel(assemble_model_karamba3d.Mass_kg)
analyze_karamba3d = AnalyzeKaramba3D(Model=assemble_model_karamba3d.Model)  # -> CalculatedModel, MaximumDisplacement_cm, ResultingForceOfGravity_kN, ElasticEnergy_kNm
panel_21 = Panel(analyze_karamba3d.MaximumDisplacement_cm)

beam_forces_karamba3d = BeamForcesKaramba3D(
    AnalyzedModel=analyze_karamba3d.CalculatedModel,
    LCase=-1,
    MaximumDistanceBetweenResults_m=-1,
    NumberOfResultsPerBeamElement=2)  # -> AnalyzedModel, NormalForce_kN, ShearForceVz_kN, ShearForceVy_kN, BendingMomentMt_kNm, BendingMomentMy_kNm, BendingMomentMz_kNm
panel_22 = Panel("""0
2
4
11""")
utilization_of_elements_karamba3d = UtilizationOfElementsKaramba3D(
    AnalyzedModel=beam_forces_karamba3d.AnalyzedModel,
    ElemIdentifiers=panel_22,
    ResultCase=-1,
    NumberOfSamplePoints=3,
    ElasticDesign=True,
    GammaM0=1,
    GammaM1=1,
    WithDetails=Toggle(True),
    mode="Beams")  # -> AnalyzedModel, Utilization, SigMax_kN_cm2, SigMin_kN_cm2, TauMax_kN_cm2, UtilN, UtilVy, UtilVz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
panel_23 = Panel(utilization_of_elements_karamba3d.Details)
# non load beaing
# non load bearing
# load bearing
# load bearing
# column
# column
# column
# column
# brace
# brace
# brace
# brace
# the utilization-component returns the utilization of the cross section as a whole according to EC3 which includes the interaction of normal forces, shear, bending, lateral torsional buckling  and stability under compressive normal forces
panel_24 = Panel(utilization_of_elements_karamba3d.Utilization)

# ----
# Viewing
model_view_karamba3d = ModelViewKaramba3D(Model=analyze_karamba3d.CalculatedModel, ResultFactors=1, ResultCase=-1)  # -> Model, DeformedMesh, DeformedAxes, DeformedModel
beam_view_karamba3d = BeamViewKaramba3D(Model=model_view_karamba3d.Model)  # -> Model, MeshesOfRenderedBeams, DeformedBeamAxes, LegendColors, LegendTags

# ----
# biomorpher only takes 8 values max for "performance" (fitness), so if inputing all ults, it will take the first values to fill the 8 splots.
# 
# I manually selected the 4 critcal members to represent the 4 member types, so therefore should deisgn each 4 member type for worst case loading situation
biomorpher = Biomorpher(
    Genome=[number_slider_8, number_slider_7, number_slider_6, number_slider_5],
    Geometry=beam_view_karamba3d.MeshesOfRenderedBeams,
    Performs=[assemble_model_karamba3d.Mass_kg, utilization_of_elements_karamba3d.Utilization])
biomorpherreader = BiomorpherReader(Solution=biomorpher, Branch=0, Generation=0, Design=0)

# ----
# Column Displacements
number_slider_9 = Slider(3, range=0..12)
lateral_1 = Slider(1, range=0..1)
panel_25 = Panel("""4
5
6
7""")
beam_displacements_karamba3d = BeamDisplacementsKaramba3D(
    AnalyzedModel=analyze_karamba3d.CalculatedModel,
    BeamIdentifiers=panel_25,
    LoadCase=lateral_1,
    MaximumDistanceBetweenResults_m=-1,
    NumberOfResultsPerElement=number_slider_9)  # -> AnalyzedModel, simplify(flatten(Translations_m)), Rotations_rad
_0_2_is_4_3_5_is_5_6_8_is_6_9_11_is_7_x = Panel(beam_displacements_karamba3d.Translations_m)  # "0-2 is 4, 3-5 is 5, 6-8 is 6, 9-11 is 7 (X,Y,Z)"

# ----
# Genes
column_displacement_x_y_z = Panel(beam_displacements_karamba3d.Translations_m)
panel_26 = Panel(cross_section_selector_karamba3d_4.CrossSection)

# ----
# Genes
panel_27 = Panel(beam_displacements_karamba3d.Translations_m)
panel_28 = Panel(cross_section_selector_karamba3d_3.CrossSection)

vertical_0 = Slider(0, range=0..1)

# ----
# Non- Load Bearing Beam Displacement
panel_29 = Panel("""0
1""")
beam_displacements_karamba3d_2 = BeamDisplacementsKaramba3D(
    AnalyzedModel=analyze_karamba3d.CalculatedModel,
    BeamIdentifiers=panel_29,
    LoadCase=vertical_0,
    MaximumDistanceBetweenResults_m=-1,
    NumberOfResultsPerElement=Slider(3, range=0..10))  # -> AnalyzedModel, simplify(flatten(Translations_m)), Rotations_rad
_0_3_are_beam_0_3_5_are_beam_1_identical = Panel(beam_displacements_karamba3d_2.Translations_m)

panel_30 = Panel("""2
3""")
vertical_0_2 = Slider(0, range=0..1)

# ----
# Load Bearing Beam Displacement
number_slider_10 = Slider(3, range=0..10)
beam_displacements_karamba3d_3 = BeamDisplacementsKaramba3D(
    AnalyzedModel=analyze_karamba3d.CalculatedModel,
    BeamIdentifiers=panel_30,
    LoadCase=vertical_0_2,
    MaximumDistanceBetweenResults_m=-1,
    NumberOfResultsPerElement=number_slider_10)  # -> AnalyzedModel, simplify(flatten(Translations_m)), Rotations_rad
_0_3_are_beam_0_2_3_5_are_beam_1_2_ident = Panel(beam_displacements_karamba3d_3.Translations_m)  # "0-3 are beam 0/2, 3-5 are beam 1/2 (identical)"

# ----
# Load Bearing Beam Moments
number_slider_11 = Slider(2, range=1..10)
# Optimizing Cross Section Using Karamba
# Load Bearing Beams
# Non-Load Bearing Beams
panel_31 = Panel("""2
3""")
beam_forces_karamba3d_2 = BeamForcesKaramba3D(
    AnalyzedModel=analyze_karamba3d.CalculatedModel,
    BeamIdentifiers=panel_31,
    LCase=-1,
    MaximumDistanceBetweenResults_m=-1,
    NumberOfResultsPerBeamElement=number_slider_11)  # -> AnalyzedModel, NormalForce_kN, ShearForceVz_kN, ShearForceVy_kN, BendingMomentMt_kNm, simplify(BendingMomentMy_kNm), BendingMomentMz_kNm
utilization_of_elements_karamba3d_2 = UtilizationOfElementsKaramba3D(
    AnalyzedModel=beam_forces_karamba3d_2.AnalyzedModel,
    ElemIdentifiers=panel_31,
    ResultCase=-1,
    NumberOfSamplePoints=3,
    ElasticDesign=True,
    GammaM0=1,
    GammaM1=1,
    WithDetails=False,
    mode="Beams")  # -> AnalyzedModel, Utilization, SigMax_kN_cm2, SigMin_kN_cm2, TauMax_kN_cm2, UtilN, UtilVy, UtilVz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
list_item = ListItem(List=utilization_of_elements_karamba3d_2.UtilMy, Index=Slider(0, range=0..1), Wrap=True)
panel_32 = Panel(utilization_of_elements_karamba3d_2.UtilMy)
panel_33 = Panel(beam_forces_karamba3d_2.BendingMomentMy_kNm)
panel_34 = Panel(utilization_of_elements_karamba3d_2.Utilization)
panel_35 = Panel(list_item)

# ----
# Genes
panel_36 = Panel(cross_section_selector_karamba3d_2.CrossSection)

# ----
# Column Axial Loads
panel_37 = Panel("""4
5
6
7""")
beam_forces_karamba3d_3 = BeamForcesKaramba3D(
    AnalyzedModel=analyze_karamba3d.CalculatedModel,
    BeamIdentifiers=panel_37,
    LCase=-1,
    MaximumDistanceBetweenResults_m=-1,
    NumberOfResultsPerBeamElement=Slider(3, range=0..10))  # -> AnalyzedModel, simplify(NormalForce_kN), ShearForceVz_kN, ShearForceVy_kN, BendingMomentMt_kNm, BendingMomentMy_kNm, BendingMomentMz_kNm
utilization_of_elements_karamba3d_3 = UtilizationOfElementsKaramba3D(
    AnalyzedModel=beam_forces_karamba3d_3.AnalyzedModel,
    ElemIdentifiers=panel_37,
    ResultCase=-1,
    NumberOfSamplePoints=3,
    ElasticDesign=True,
    GammaM0=1,
    GammaM1=1,
    WithDetails=False,
    mode="Beams")  # -> AnalyzedModel, Utilization, SigMax_kN_cm2, SigMin_kN_cm2, TauMax_kN_cm2, UtilN, UtilVy, UtilVz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
panel_38 = Panel(beam_forces_karamba3d_3.NormalForce_kN)
panel_39 = Panel(utilization_of_elements_karamba3d_3.UtilN)

# ----
# Non-Load Bearing Beam Moments
number_slider_12 = Slider(3, range=0..10)
panel_40 = Panel("""0
1""")
beam_forces_karamba3d_4 = BeamForcesKaramba3D(
    AnalyzedModel=analyze_karamba3d.CalculatedModel,
    BeamIdentifiers=panel_40,
    LCase=-1,
    MaximumDistanceBetweenResults_m=-1,
    NumberOfResultsPerBeamElement=number_slider_12)  # -> AnalyzedModel, NormalForce_kN, ShearForceVz_kN, ShearForceVy_kN, BendingMomentMt_kNm, simplify(BendingMomentMy_kNm), simplify(BendingMomentMz_kNm)
utilization_of_elements_karamba3d_4 = UtilizationOfElementsKaramba3D(
    AnalyzedModel=beam_forces_karamba3d_4.AnalyzedModel,
    ElemIdentifiers=panel_40,
    ResultCase=-1,
    NumberOfSamplePoints=3,
    ElasticDesign=True,
    GammaM0=1,
    GammaM1=1,
    WithDetails=False,
    mode="Beams")  # -> AnalyzedModel, Utilization, SigMax_kN_cm2, SigMin_kN_cm2, TauMax_kN_cm2, UtilN, UtilVy, UtilVz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
list_item_2 = ListItem(List=utilization_of_elements_karamba3d_4.UtilMy, Index=Slider(2, range=2..3), Wrap=True)
panel_41 = Panel(utilization_of_elements_karamba3d_4.UtilMy)
panel_42 = Panel(utilization_of_elements_karamba3d_4.Utilization)
panel_43 = Panel(beam_forces_karamba3d_4.BendingMomentMy_kNm)
panel_44 = Panel(list_item_2)

# ----
# Genes
panel_45 = Panel(cross_section_selector_karamba3d.CrossSection)

# ----
# Bracing Axial Loads
number_slider_13 = Slider(3, range=0..10)
panel_48 = Panel("""8
9
10
11""")
beam_forces_karamba3d_5 = BeamForcesKaramba3D(
    AnalyzedModel=analyze_karamba3d.CalculatedModel,
    BeamIdentifiers=panel_48,
    LCase=-1,
    MaximumDistanceBetweenResults_m=-1,
    NumberOfResultsPerBeamElement=number_slider_13)  # -> AnalyzedModel, NormalForce_kN, ShearForceVz_kN, ShearForceVy_kN, BendingMomentMt_kNm, BendingMomentMy_kNm, BendingMomentMz_kNm
utilization_of_elements_karamba3d_5 = UtilizationOfElementsKaramba3D(
    AnalyzedModel=beam_forces_karamba3d_5.AnalyzedModel,
    ElemIdentifiers=panel_48,
    ResultCase=-1,
    NumberOfSamplePoints=3,
    ElasticDesign=True,
    GammaM0=1,
    GammaM1=1,
    WithDetails=False,
    mode="Beams")  # -> AnalyzedModel, Utilization, SigMax_kN_cm2, SigMin_kN_cm2, TauMax_kN_cm2, UtilN, UtilVy, UtilVz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
panel_49 = Panel(utilization_of_elements_karamba3d_5.UtilN)
panel_50 = Panel(beam_forces_karamba3d_5.NormalForce_kN)

# ----
# Columns, Lateral Deflection X
panel_51 = Panel("1000")
multiplication_3 = Multiplication(A=number_slider_2, B=panel_51)
division_3 = Division(A=multiplication_3, B=Slider(400, range=0..1000))
panel_52 = Panel(multiplication_3)
panel_53 = Panel(division_3)
list_item_3 = ListItem(List=beam_displacements_karamba3d.Translations_m, Index=Slider(1, range=0..11), Wrap=True)
list_item_4 = ListItem(List=beam_displacements_karamba3d.Translations_m, Index=Slider(7, range=0..11), Wrap=True)
list_item_5 = ListItem(List=beam_displacements_karamba3d.Translations_m, Index=Slider(10, range=0..11), Wrap=True)
list_item_6 = ListItem(List=beam_displacements_karamba3d.Translations_m, Index=Slider(4, range=0..11), Wrap=True)
panel_54 = Panel(list_item_3)
panel_55 = Panel(list_item_4)
panel_56 = Panel(list_item_5)
panel_57 = Panel(list_item_6)
deconstruct_vector = DeconstructVector(Vector=list_item_3)  # -> XComponent, YComponent, ZComponent
deconstruct_vector_2 = DeconstructVector(Vector=list_item_4)  # -> XComponent, YComponent, ZComponent
deconstruct_vector_3 = DeconstructVector(Vector=list_item_5)  # -> XComponent, YComponent, ZComponent
deconstruct_vector_4 = DeconstructVector(Vector=list_item_6)  # -> XComponent, YComponent, ZComponent
panel_58 = Panel(deconstruct_vector.XComponent)
panel_59 = Panel(deconstruct_vector_2.XComponent)
panel_60 = Panel(deconstruct_vector_3.XComponent)
panel_61 = Panel(deconstruct_vector_4.XComponent)
converting_to_mm = Panel("-1000")
converting_to_mm_2 = Panel("-1000")
converting_to_mm_3 = Panel("-1000")
converting_to_mm_4 = Panel("-1000")
multiplication_4 = Multiplication(A=converting_to_mm, B=deconstruct_vector.XComponent)
multiplication_5 = Multiplication(A=converting_to_mm_2, B=deconstruct_vector_2.XComponent)
multiplication_6 = Multiplication(A=converting_to_mm_3, B=deconstruct_vector_3.XComponent)
multiplication_7 = Multiplication(A=converting_to_mm_4, B=deconstruct_vector_4.XComponent)
panel_62 = Panel(multiplication_4)
absolute = Absolute(Value=multiplication_4)
panel_63 = Panel(multiplication_5)
panel_64 = Panel(multiplication_6)
panel_65 = Panel(multiplication_7)
absolute_2 = Absolute(Value=multiplication_5)
absolute_3 = Absolute(Value=multiplication_6)
absolute_4 = Absolute(Value=multiplication_7)
smaller_than = SmallerThan(FirstNumber=absolute, SecondNumber=division_3)  # -> SmallerThan, OrEqualTo
smaller_than_2 = SmallerThan(FirstNumber=absolute_2, SecondNumber=division_3)  # -> SmallerThan, OrEqualTo
smaller_than_3 = SmallerThan(FirstNumber=absolute_3, SecondNumber=division_3)  # -> SmallerThan, OrEqualTo
smaller_than_4 = SmallerThan(FirstNumber=absolute_4, SecondNumber=division_3)  # -> SmallerThan, OrEqualTo
panel_66 = Panel(smaller_than.SmallerThan)
panel_67 = Panel(smaller_than_2.SmallerThan)
panel_68 = Panel(smaller_than_3.SmallerThan)
panel_69 = Panel(smaller_than_4.SmallerThan)
gate_and = GateAnd(A=smaller_than.SmallerThan, B=smaller_than_4.SmallerThan, C=smaller_than_2.SmallerThan, D=smaller_than_3.SmallerThan)
panel_70 = Panel(gate_and)

# ----
# Columns, Lateral Deflection Y
panel_71 = Panel("1000")
multiplication_8 = Multiplication(A=number_slider_2, B=panel_71)
division_4 = Division(A=multiplication_8, B=Slider(400, range=0..1000))
panel_72 = Panel(division_4)
list_item_7 = ListItem(List=beam_displacements_karamba3d.Translations_m, Index=Slider(1, range=0..11), Wrap=True)
list_item_8 = ListItem(List=beam_displacements_karamba3d.Translations_m, Index=Slider(7, range=0..11), Wrap=True)
list_item_9 = ListItem(List=beam_displacements_karamba3d.Translations_m, Index=Slider(10, range=0..11), Wrap=True)
list_item_10 = ListItem(List=beam_displacements_karamba3d.Translations_m, Index=Slider(4, range=0..11), Wrap=True)
panel_73 = Panel(list_item_7)
panel_74 = Panel(list_item_8)
panel_75 = Panel(list_item_9)
panel_76 = Panel(list_item_10)
deconstruct_vector_5 = DeconstructVector(Vector=list_item_7)  # -> XComponent, YComponent, ZComponent
deconstruct_vector_6 = DeconstructVector(Vector=list_item_8)  # -> XComponent, YComponent, ZComponent
deconstruct_vector_7 = DeconstructVector(Vector=list_item_9)  # -> XComponent, YComponent, ZComponent
deconstruct_vector_8 = DeconstructVector(Vector=list_item_10)  # -> XComponent, YComponent, ZComponent
panel_77 = Panel(deconstruct_vector_5.YComponent)
panel_78 = Panel(deconstruct_vector_6.YComponent)
panel_79 = Panel(deconstruct_vector_7.YComponent)
panel_80 = Panel(deconstruct_vector_8.YComponent)
converting_to_mm_5 = Panel("-1000")
converting_to_mm_6 = Panel("-1000")
converting_to_mm_7 = Panel("-1000")
converting_to_mm_8 = Panel("-1000")
multiplication_9 = Multiplication(A=converting_to_mm_5, B=deconstruct_vector_5.YComponent)
multiplication_10 = Multiplication(A=converting_to_mm_6, B=deconstruct_vector_6.YComponent)
multiplication_11 = Multiplication(A=converting_to_mm_7, B=deconstruct_vector_7.YComponent)
multiplication_12 = Multiplication(A=converting_to_mm_8, B=deconstruct_vector_8.YComponent)
panel_81 = Panel(multiplication_9)
absolute_5 = Absolute(Value=multiplication_9)
panel_82 = Panel(multiplication_10)
panel_83 = Panel(multiplication_11)
panel_84 = Panel(multiplication_12)
absolute_6 = Absolute(Value=multiplication_10)
absolute_7 = Absolute(Value=multiplication_11)
absolute_8 = Absolute(Value=multiplication_12)
smaller_than_5 = SmallerThan(FirstNumber=absolute_5, SecondNumber=division_4)  # -> SmallerThan, OrEqualTo
smaller_than_6 = SmallerThan(FirstNumber=absolute_6, SecondNumber=division_4)  # -> SmallerThan, OrEqualTo
smaller_than_7 = SmallerThan(FirstNumber=absolute_7, SecondNumber=division_4)  # -> SmallerThan, OrEqualTo
smaller_than_8 = SmallerThan(FirstNumber=absolute_8, SecondNumber=division_4)  # -> SmallerThan, OrEqualTo
panel_85 = Panel(smaller_than_5.SmallerThan)
panel_86 = Panel(smaller_than_6.SmallerThan)
panel_87 = Panel(smaller_than_7.SmallerThan)
panel_88 = Panel(smaller_than_8.SmallerThan)
gate_and_2 = GateAnd(A=smaller_than_5.SmallerThan, B=smaller_than_8.SmallerThan, C=smaller_than_6.SmallerThan, D=smaller_than_7.SmallerThan)
panel_89 = Panel(gate_and_2)

# ----
# Load Bearing Beams Vertical Deflection
# Non-Load Bearing Beams Vertical Deflection
number_slider_14 = Slider(1, range=0..5)
list_item_11 = ListItem(List=beam_displacements_karamba3d_3.Translations_m, Index=number_slider_14, Wrap=True)
list_item_12 = ListItem(List=beam_displacements_karamba3d_2.Translations_m, Index=Slider(1, range=0..5), Wrap=True)
panel_90 = Panel(list_item_11)
panel_91 = Panel(list_item_12)
multiplication_13 = Multiplication(A=number_slider_3, B="1000")
deconstruct_vector_9 = DeconstructVector(Vector=list_item_11)  # -> XComponent, YComponent, ZComponent
deconstruct_vector_10 = DeconstructVector(Vector=list_item_12)  # -> XComponent, YComponent, ZComponent
division_5 = Division(A=multiplication_13, B=Slider(360, range=0..1000))
multiplication_14 = Multiplication(A=number_slider, B="1000")
panel_92 = Panel(deconstruct_vector_9.ZComponent)
panel_93 = Panel(deconstruct_vector_10.ZComponent)
panel_94 = Panel(division_5)
division_6 = Division(A=multiplication_14, B=Slider(360, range=0..1000))
converting_to_m = Panel("-1000")
panel_95 = Panel(division_6)
converting_to_m_2 = Panel("-1000")
multiplication_15 = Multiplication(A=converting_to_m, B=deconstruct_vector_9.ZComponent)
panel_96 = Panel(multiplication_15)
multiplication_16 = Multiplication(A=converting_to_m_2, B=deconstruct_vector_10.ZComponent)
panel_97 = Panel(multiplication_16)
smaller_than_9 = SmallerThan(FirstNumber=multiplication_15, SecondNumber=division_5)  # -> SmallerThan, OrEqualTo
panel_98 = Panel(smaller_than_9.SmallerThan)
smaller_than_10 = SmallerThan(FirstNumber=multiplication_16, SecondNumber=division_6)  # -> SmallerThan, OrEqualTo
panel_99 = Panel(smaller_than_10.SmallerThan)

# ----
# Load Bearing Beams
# Non-Load Bearing Beams
# Columns
# Braces
number_slider_15 = Slider(1, range=0..3)
list_item_13 = ListItem(List=panel_39, Index=Slider(0, range=0..3), Wrap=True)
list_item_14 = ListItem(List=panel_39, Index=Slider(2, range=0..3), Wrap=True)
list_item_15 = ListItem(List=panel_39, Index=number_slider_15, Wrap=True)
list_item_16 = ListItem(List=panel_49, Index=Slider(0, range=0..3), Wrap=True)
list_item_17 = ListItem(List=panel_49, Index=Slider(2, range=0..3), Wrap=True)
list_item_18 = ListItem(List=panel_39, Index=Slider(3, range=0..3), Wrap=True)
list_item_19 = ListItem(List=panel_49, Index=Slider(1, range=0..3), Wrap=True)
list_item_20 = ListItem(List=panel_49, Index=Slider(3, range=0..3), Wrap=True)
number_slider_16 = Slider(1, range=0..1)
# Fitness Function 2
number_slider_17 = Slider(1, range=0..1)
number_slider_18 = Slider(1, range=0..1)
smaller_than_11 = SmallerThan(FirstNumber=list_item_2, SecondNumber=Slider(1, range=0..1))  # -> SmallerThan, OrEqualTo
smaller_than_12 = SmallerThan(FirstNumber=list_item_15, SecondNumber=number_slider_16)  # -> SmallerThan, OrEqualTo
smaller_than_13 = SmallerThan(FirstNumber=list_item_13, SecondNumber=number_slider_16)  # -> SmallerThan, OrEqualTo
smaller_than_14 = SmallerThan(FirstNumber=list_item_18, SecondNumber=number_slider_16)  # -> SmallerThan, OrEqualTo
smaller_than_15 = SmallerThan(FirstNumber=list_item_14, SecondNumber=number_slider_16)  # -> SmallerThan, OrEqualTo
smaller_than_16 = SmallerThan(FirstNumber=list_item, SecondNumber=number_slider_17)  # -> SmallerThan, OrEqualTo
smaller_than_17 = SmallerThan(FirstNumber=list_item_19, SecondNumber=number_slider_18)  # -> SmallerThan, OrEqualTo
smaller_than_18 = SmallerThan(FirstNumber=list_item_16, SecondNumber=number_slider_18)  # -> SmallerThan, OrEqualTo
smaller_than_19 = SmallerThan(FirstNumber=list_item_20, SecondNumber=number_slider_18)  # -> SmallerThan, OrEqualTo
smaller_than_20 = SmallerThan(FirstNumber=list_item_17, SecondNumber=number_slider_18)  # -> SmallerThan, OrEqualTo
panel_100 = Panel(smaller_than_11.SmallerThan)
panel_101 = Panel(smaller_than_16.SmallerThan)
gate_and_3 = GateAnd(
    A=smaller_than_13.SmallerThan,
    B=smaller_than_12.SmallerThan,
    C=smaller_than_15.SmallerThan,
    D=smaller_than_14.SmallerThan)
gate_and_4 = GateAnd(
    A=smaller_than_18.SmallerThan,
    B=smaller_than_17.SmallerThan,
    C=smaller_than_20.SmallerThan,
    D=smaller_than_19.SmallerThan)
panel_102 = Panel(gate_and_3)
panel_103 = Panel(gate_and_4)

penalty_factor_p = Panel("""1000000
1""")
list_item_21 = ListItem(List=penalty_factor_p, Index=panel_102, Wrap=True)
list_item_22 = ListItem(List=penalty_factor_p, Index=smaller_than_16.SmallerThan, Wrap=True)
list_item_23 = ListItem(List=penalty_factor_p, Index=panel_103, Wrap=True)
list_item_24 = ListItem(List=penalty_factor_p, Index=smaller_than_11.SmallerThan, Wrap=True)
panel_104 = Panel(list_item_21)
list_item_25 = ListItem(List=penalty_factor_p, Index=smaller_than_9.SmallerThan, Wrap=True)
panel_105 = Panel(list_item_22)
panel_106 = Panel(list_item_23)
panel_107 = Panel(list_item_24)
list_item_26 = ListItem(List=penalty_factor_p, Index=smaller_than_10.SmallerThan, Wrap=True)
list_item_27 = ListItem(List=penalty_factor_p, Index=gate_and, Wrap=True)
panel_108 = Panel(list_item_25)
list_item_28 = ListItem(List=penalty_factor_p, Index=gate_and_2, Wrap=True)
panel_109 = Panel(list_item_26)
panel_110 = Panel(list_item_27)
panel_111 = Panel(list_item_28)

# ----
# 1. Optimize Beam Sizes
multiplication_17 = Multiplication(A=assemble_model_karamba3d.Mass_kg, B=list_item_25)
multiplication_18 = Multiplication(A=multiplication_17, B=list_item_26)
multiplication_19 = Multiplication(A=multiplication_18, B=list_item_22)
multiplication_20 = Multiplication(A=multiplication_19, B=list_item_24)
galapagos = Galapagos(fitness=multiplication_20)

panel_112 = Panel(multiplication_20)

# ----
# 2. Optimize Bracing and Column Sizes
multiplication_21 = Multiplication(A=multiplication_20, B=list_item_27)
multiplication_22 = Multiplication(A=multiplication_21, B=list_item_28)
multiplication_23 = Multiplication(A=multiplication_22, B=list_item_21)
multiplication_24 = Multiplication(A=multiplication_23, B=list_item_23)
galapagos_2 = Galapagos(fitness=multiplication_24)
mass_kg = Panel(multiplication_24)
