# Grasshopper definition FRAME_wind loads_sortlistresults_newfitfunc_exportISM_pinnedconnections.gh (Grasshopper 1.0.7)
# plug-ins: ggISMIFC, TT Toolbox, ggGHKarambaGHA, karambaGH

# ----
# Lines and Nodes
point = Point(Point(0, 0, 0))
deconstruct = Deconstruct(Point=point)  # -> XComponent, YComponent, ZComponent
number_slider = Slider(7, range=0..20)
number_slider_2 = Slider(5, range=0..20)
number_slider_3 = Slider(10, range=0..30)
number_slider_4 = Slider(7, range=0..30)
addition = Addition(A=deconstruct.ZComponent, B=Slider(5, range=0..20))
addition_2 = Addition(A=deconstruct.XComponent, B=number_slider)
construct_point = ConstructPoint(XCoordinate=deconstruct.XComponent, YCoordinate=deconstruct.YComponent, ZCoordinate=addition)
deconstruct_2 = Deconstruct(Point=construct_point)  # -> XComponent, YComponent, ZComponent
addition_3 = Addition(A=deconstruct_2.YComponent, B=number_slider_3)
construct_point_2 = ConstructPoint(XCoordinate=Slider(0, range=0..30), YCoordinate=Slider(10, range=0..30), ZCoordinate=Slider(0, range=0..30))
construct_point_3 = ConstructPoint(XCoordinate=addition_2, YCoordinate=deconstruct.YComponent, ZCoordinate=deconstruct.ZComponent)
deconstruct_3 = Deconstruct(Point=construct_point_3)  # -> XComponent, YComponent, ZComponent
addition_4 = Addition(A=deconstruct_3.ZComponent, B=number_slider_2)
construct_point_4 = ConstructPoint(XCoordinate=deconstruct_3.XComponent, YCoordinate=deconstruct_3.YComponent, ZCoordinate=addition_4)
deconstruct_4 = Deconstruct(Point=construct_point_4)  # -> XComponent, YComponent, ZComponent
addition_5 = Addition(A=deconstruct_4.YComponent, B=Slider(10, range=0..30))
construct_point_5 = ConstructPoint(XCoordinate=deconstruct_2.XComponent, YCoordinate=addition_3, ZCoordinate=deconstruct_2.ZComponent)
construct_point_6 = ConstructPoint(XCoordinate=number_slider_4, YCoordinate=Slider(10, range=0..30), ZCoordinate=Slider(0, range=0..30))
construct_point_7 = ConstructPoint(XCoordinate=deconstruct_4.XComponent, YCoordinate=addition_5, ZCoordinate=deconstruct_4.ZComponent)
line = Line(StartPoint=construct_point, EndPoint=construct_point_5)
line_2 = Line(StartPoint=construct_point, EndPoint=construct_point_4)
line_3 = Line(StartPoint=construct_point_5, EndPoint=construct_point_7)
line_4 = Line(StartPoint=construct_point_4, EndPoint=construct_point_7)
line_5 = Line(StartPoint=point, EndPoint=construct_point)
line_6 = Line(StartPoint=construct_point_3, EndPoint=construct_point_4)
line_7 = Line(StartPoint=construct_point_7, EndPoint=construct_point_6)
line_8 = Line(StartPoint=construct_point_5, EndPoint=construct_point_2)

# ----
# Support  Nodes
point_2 = Point([point, construct_point_2, construct_point_6, construct_point_3])

# ----
# Truss Diagonal Braces
line_9 = Line(StartPoint=construct_point, EndPoint=construct_point_3)
line_10 = Line(StartPoint=construct_point_5, EndPoint=construct_point_6)
line_11 = Line(StartPoint=construct_point, EndPoint=construct_point_2)
line_12 = Line(StartPoint=construct_point_4, EndPoint=construct_point_6)

cross_section_range_selector_karamba3d = CrossSectionRangeSelectorKaramba3D(MaximumHeight_cm=-1, MaximumWidth_cm=-1, menu=[dropdown(7), dropdown(1), dropdown(4)])
point_3 = Point([construct_point, construct_point_3, construct_point_4, construct_point_5, construct_point_7, construct_point_6, construct_point_2, point])

# ----
# Pinned Joint Connections
panel = Panel("Non-Load Bearing Beams")
beam_joints_karamba3d = BeamJointsKaramba3D(
    ElementIdentifiers=panel,
    CtKNMAtStartingNode=Vector(0, 0, 0),
    CrKNmRadAtStartingNode=Vector(0, 0, 0),
    CtKNMAtEndNode=Vector(0, 0, 0),
    CrKNmRadAtEndNode=Vector(0, 0, 0),
    menu=[buttons(off, off, off, off, on, on), buttons(off, off, off, off, on, on)])
panel_2 = Panel(beam_joints_karamba3d)

# ----
# Ridged Joint Connections
panel_3 = Panel("Load Bearing Beams")
beam_joints_karamba3d_2 = BeamJointsKaramba3D(
    ElementIdentifiers=panel_3,
    CtKNMAtStartingNode=Vector(0, 0, 0),
    CrKNmRadAtStartingNode=Vector(0, 0, 0),
    CtKNMAtEndNode=Vector(0, 0, 0),
    CrKNmRadAtEndNode=Vector(0, 0, 0),
    menu=[buttons(off, off, off, off, off, off), buttons(off, off, off, off, off, off)])
panel_4 = Panel(beam_joints_karamba3d_2)

name_or_list_of_index_of_materials = Slider(0, range=0..116)
read_material_table_from_file_karamba3d = ReadMaterialTableFromFileKaramba3D()
material_selection_karamba3d = MaterialSelectionKaramba3D(
    Materials=read_material_table_from_file_karamba3d,
    NameOrListIndexOfMaterial=name_or_list_of_index_of_materials,
    menu=[dropdown(1), dropdown(1)])
panel_5 = Panel(material_selection_karamba3d)
disassemble_material_karamba3d = DisassembleMaterialKaramba3D(Material=material_selection_karamba3d)  # -> Material, TypeOfMaterial, FamilyNameOfMaterial, NameOfMaterial, ElemIdentifiers, Color, YoungsModulusKNCm2Dir12, InPlaneShearModulus_kN_cm2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
panel_6 = Panel(disassemble_material_karamba3d.SpecificWeight_kN_m3)

# ----
# Live Loads UDL
live_load_load_bearing = Slider(-10, range=-50..0)
live_load_non_load_bearing = Slider(-10, range=-50..0)
panel_7 = Panel("""2
3""")
panel_8 = Panel("""0
1""")
unit_z = UnitZ(Factor=live_load_load_bearing)
unit_z_2 = UnitZ(Factor=live_load_non_load_bearing)
loads_karamba3d = LoadsKaramba3D(Vector=unit_z, BeamIdentifiers=panel_7, LCase=" 0", mode="Uniform Line", menu=[buttons(off, on, off)])
loads_karamba3d_2 = LoadsKaramba3D(Vector=unit_z_2, BeamIdentifiers=panel_8, LCase=" 0", mode="Uniform Line", menu=[buttons(off, on, off)])
panel_9 = Panel(loads_karamba3d)
panel_10 = Panel(loads_karamba3d_2)

# ----
# Wind Loads UDL
wind_load_p_kpa = Slider(3, range=-5..5)
wind_load_p_kpa_2 = Slider(3, range=-5..5)
multiplication = Multiplication(A=wind_load_p_kpa, B=number_slider_4)
multiplication_2 = Multiplication(A=wind_load_p_kpa_2, B=number_slider_3)
panel_11 = Panel("""4
5""")
unit_y = UnitY(Factor=multiplication)
panel_12 = Panel("""4
7""")
unit_x = UnitX(Factor=multiplication_2)
loads_karamba3d_3 = LoadsKaramba3D(Vector=unit_y, BeamIdentifiers=panel_11, LCase="1", mode="Uniform Line", menu=[buttons(off, on, off)])
loads_karamba3d_4 = LoadsKaramba3D(Vector=unit_x, BeamIdentifiers=panel_12, LCase="1", mode="Uniform Line", menu=[buttons(off, on, off)])

# ----
# Fixed Supports
# Relase Rx and Rz to make Pinned Supports
support_karamba3d = SupportKaramba3D(PosInd=point_2, menu=[buttons(on, on, on, on, on, on)])

vertical_0 = Slider(0, range=0..1)
panel_13 = Panel("""2
3""")
vertical_0_2 = Slider(0, range=0..1)

# ----
# 7m Bearing Beams (non load bearing)
# Genes
line_13 = Line([line_3, line_2])
name_or_list_of_index_of_cross_section_f = Slider(225, range=0..270)  # "Name or list of index of cross section FOR NON LOAD BEARING BEAMS"
cross_section_range_selector_karamba3d_2 = CrossSectionRangeSelectorKaramba3D(MaximumHeight_cm=-1, MaximumWidth_cm=-1, menu=[dropdown(7), dropdown(1), dropdown(4)])
cross_section_selector_karamba3d = CrossSectionSelectorKaramba3D(
    CrossSections=cross_section_range_selector_karamba3d_2,
    NameOrListIndexOfCrossSection=name_or_list_of_index_of_cross_section_f)  # -> CrossSection, Info
panel_14 = Panel(cross_section_selector_karamba3d.CrossSection)
disassemble_cross_section_karamba3d = DisassembleCrossSectionKaramba3D(CroSec=cross_section_selector_karamba3d.CrossSection)  # -> CrossSection, FamilyNameOfCrossSection, TypeNameOfCrossSection, ElemIdentifiers, Color, Material, LocalEccentricity_cm, Heights_cm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
panel_15 = Panel(disassemble_cross_section_karamba3d.Area_cm2)
panel_16 = Panel(disassemble_cross_section_karamba3d.CrossSection)
panel_17 = Panel(disassemble_cross_section_karamba3d.Wely_cm3)
line_to_beam_karamba3d = LineToBeamKaramba3D(
    Line=line_13,
    Identifier="Non-Load Bearing Beams",
    CrossSection=cross_section_selector_karamba3d.CrossSection,
    New=True,
    Remove=True,
    LimitDistance_m=0.005)  # -> Element, Points, Info

# ----
# 10m Beams (Load Bearing)
# Genes
line_14 = Line([line, line_4])
name_or_list_of_index_of_cross_section_f_2 = Slider(225, range=0..270)  # "Name or list of index of cross section FOR LOAD BEARING BEAMS"
cross_section_selector_karamba3d_2 = CrossSectionSelectorKaramba3D(
    CrossSections=cross_section_range_selector_karamba3d,
    NameOrListIndexOfCrossSection=name_or_list_of_index_of_cross_section_f_2)  # -> CrossSection, Info
panel_18 = Panel(cross_section_selector_karamba3d_2.CrossSection)
disassemble_cross_section_karamba3d_2 = DisassembleCrossSectionKaramba3D(CroSec=cross_section_selector_karamba3d_2.CrossSection)  # -> CrossSection, FamilyNameOfCrossSection, TypeNameOfCrossSection, ElemIdentifiers, Color, Material, LocalEccentricity_cm, Heights_cm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
panel_19 = Panel(disassemble_cross_section_karamba3d_2.CrossSection)
panel_20 = Panel(disassemble_cross_section_karamba3d_2.Area_cm2)
panel_21 = Panel(disassemble_cross_section_karamba3d_2.Wely_cm3)
line_to_beam_karamba3d_2 = LineToBeamKaramba3D(
    Line=line_14,
    Identifier="Load Bearing Beams",
    CrossSection=cross_section_selector_karamba3d_2.CrossSection,
    New=True,
    Remove=True,
    LimitDistance_m=0.005)  # -> Element, Points, Info

# ----
# Genes
name_or_list_of_index_of_cross_section_f_3 = Slider(252, range=0..270)  # "Name or list of index of cross section FOR COLUMNS"

# ----
# Columns
line_15 = Line([line_5, line_6, line_7, line_8])
cross_section_range_selector_karamba3d_3 = CrossSectionRangeSelectorKaramba3D(MaximumHeight_cm=-1, MaximumWidth_cm=-1, menu=[dropdown(7), dropdown(1), dropdown(4)])
cross_section_selector_karamba3d_3 = CrossSectionSelectorKaramba3D(
    CrossSections=cross_section_range_selector_karamba3d_3,
    NameOrListIndexOfCrossSection=name_or_list_of_index_of_cross_section_f_3)  # -> CrossSection, Info
disassemble_cross_section_karamba3d_3 = DisassembleCrossSectionKaramba3D(CroSec=cross_section_selector_karamba3d_3.CrossSection)  # -> CrossSection, FamilyNameOfCrossSection, TypeNameOfCrossSection, ElemIdentifiers, Color, Material, LocalEccentricity_cm, Heights_cm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
panel_22 = Panel(disassemble_cross_section_karamba3d_3.Area_cm2)
line_to_beam_karamba3d_3 = LineToBeamKaramba3D(
    Line=line_15,
    Identifier="Columns",
    CrossSection=cross_section_selector_karamba3d_3.CrossSection,
    New=True,
    Remove=True,
    LimitDistance_m=0.005)  # -> Element, Points, Info

# ----
# Column Joint Connections
beam_joints_karamba3d_3 = BeamJointsKaramba3D(
    ElementIdentifiers=line_to_beam_karamba3d_3.Element,
    CtKNMAtStartingNode=Vector(0, 0, 0),
    CrKNmRadAtStartingNode=Vector(0, 0, 0),
    CtKNMAtEndNode=Vector(0, 0, 0),
    CrKNmRadAtEndNode=Vector(0, 0, 0),
    menu=[buttons(off, off, off, off, off, off), buttons(off, off, off, off, off, off)])
panel_23 = Panel(beam_joints_karamba3d_3)

# ----
# Truss Diagonal Braces
line_16 = Line([line_9, line_10, line_11, line_12])
cross_section_range_selector_karamba3d_4 = CrossSectionRangeSelectorKaramba3D(MaximumHeight_cm=-1, MaximumWidth_cm=-1, menu=[dropdown(7), dropdown(4), dropdown(1)])

# ----
# Genes
name_or_list_of_index_of_cross_section_f_4 = Slider(42, range=0..187)  # "Name or list of index of cross section FOR COLUMNS"

cross_section_selector_karamba3d_4 = CrossSectionSelectorKaramba3D(
    CrossSections=cross_section_range_selector_karamba3d_4,
    NameOrListIndexOfCrossSection=name_or_list_of_index_of_cross_section_f_4)  # -> CrossSection, Info
disassemble_cross_section_karamba3d_4 = DisassembleCrossSectionKaramba3D(CroSec=cross_section_selector_karamba3d_4.CrossSection)  # -> CrossSection, FamilyNameOfCrossSection, TypeNameOfCrossSection, ElemIdentifiers, Color, Material, LocalEccentricity_cm, Heights_cm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
panel_24 = Panel(disassemble_cross_section_karamba3d_4.Area_cm2)
line_to_beam_karamba3d_4 = LineToBeamKaramba3D(
    Line=line_16,
    Identifier="Diagonal Braces",
    CrossSection=cross_section_selector_karamba3d_4.CrossSection,
    New=True,
    Remove=True,
    LimitDistance_m=0.005,
    Bending=Toggle(False))  # -> Element, Points, Info

assemble_model_karamba3d = AssembleModelKaramba3D(
    Point=point_3,
    Elem=[line_to_beam_karamba3d.Element, line_to_beam_karamba3d_2.Element, line_to_beam_karamba3d_3.Element, line_to_beam_karamba3d_4.Element],
    Support=support_karamba3d,
    Load=[loads_karamba3d, loads_karamba3d_2, loads_karamba3d_3, loads_karamba3d_4],
    Material=material_selection_karamba3d,
    Joint=beam_joints_karamba3d,
    LimitDistance_m=0.005)  # -> Model, Info, Mass_kg, CenterOfGravity
panel_25 = Panel(assemble_model_karamba3d.Mass_kg)
analyze_karamba3d = AnalyzeKaramba3D(Model=assemble_model_karamba3d.Model)  # -> CalculatedModel, simplify(MaximumDisplacement_cm), ResultingForceOfGravity_kN, ElasticEnergy_kNm
panel_26 = Panel(analyze_karamba3d.MaximumDisplacement_cm)

ggkarambaexport = GgKarambaExport(
    Enabled=Toggle(False),
    Model=assemble_model_karamba3d.Model,
    IFC4=Toggle(False),
    Zip=False,
    Compliant=True,
    VerticalColumns=True)
ggkarambatoism = GgKarambaToISM(Enabled=Toggle(False), Model=assemble_model_karamba3d.Model, Independent=True)

# ----
# Viewing
model_view_karamba3d = ModelViewKaramba3D(Model=analyze_karamba3d.CalculatedModel, ResultFactors=1, ResultCase=-1)  # -> Model, DeformedMesh, DeformedAxes, DeformedModel
beam_view_karamba3d = BeamViewKaramba3D(Model=model_view_karamba3d.Model)  # -> Model, MeshesOfRenderedBeams, DeformedBeamAxes, LegendColors, LegendTags

# ----
# Column Displacements
number_slider_5 = Slider(3, range=0..10)
lateral_1 = Slider(1, range=0..1)
panel_27 = Panel("""4
5
6
7""")
beam_displacements_karamba3d = BeamDisplacementsKaramba3D(
    AnalyzedModel=analyze_karamba3d.CalculatedModel,
    BeamIdentifiers=panel_27,
    LoadCase=lateral_1,
    MaximumDistanceBetweenResults_m=-1,
    NumberOfResultsPerElement=number_slider_5)  # -> AnalyzedModel, simplify(flatten(Translations_m)), Rotations_rad
_0_2_is_4_3_5_is_5_6_8_is_6_9_11_is_7_x = Panel(beam_displacements_karamba3d.Translations_m)  # "0-2 is 4, 3-5 is 5, 6-8 is 6, 9-11 is 7 (X,Y,Z)"

column_displacement_x_y_z = Panel(beam_displacements_karamba3d.Translations_m)
panel_28 = Panel(cross_section_selector_karamba3d_3.CrossSection)

panel_30 = Panel(cross_section_selector_karamba3d_4.CrossSection)

# ----
# Load Bearing Beam Displacement
number_slider_6 = Slider(3, range=0..10)
beam_displacements_karamba3d_2 = BeamDisplacementsKaramba3D(
    AnalyzedModel=analyze_karamba3d.CalculatedModel,
    BeamIdentifiers=panel_13,
    LoadCase=vertical_0_2,
    MaximumDistanceBetweenResults_m=-1,
    NumberOfResultsPerElement=number_slider_6)  # -> AnalyzedModel, simplify(flatten(Translations_m)), Rotations_rad
_0_2_are_beam_0_2_3_5_are_beam_1_2_ident = Panel(beam_displacements_karamba3d_2.Translations_m)  # "0-2 are beam 0/2, 3-5 are beam 1/2 (identical)"

# ----
# Non- Load Bearing Beam Displacement
panel_31 = Panel("""0
1""")
beam_displacements_karamba3d_3 = BeamDisplacementsKaramba3D(
    AnalyzedModel=analyze_karamba3d.CalculatedModel,
    BeamIdentifiers=panel_31,
    LoadCase=vertical_0,
    MaximumDistanceBetweenResults_m=-1,
    NumberOfResultsPerElement=Slider(3, range=0..10))  # -> AnalyzedModel, simplify(flatten(Translations_m)), Rotations_rad
_0_2_are_beam_0_3_5_are_beam_1_identical = Panel(beam_displacements_karamba3d_3.Translations_m)

# ----
# Load Bearing Beam Moments
number_slider_7 = Slider(3, range=1..10)
# Optimizing Cross Section Using Karamba
# Load Bearing Beams
# Non-Load Bearing Beams
panel_32 = Panel("""2
3""")
beam_forces_karamba3d = BeamForcesKaramba3D(
    AnalyzedModel=analyze_karamba3d.CalculatedModel,
    BeamIdentifiers=panel_32,
    LCase=Slider(0, range=0..100),
    MaximumDistanceBetweenResults_m=-1,
    NumberOfResultsPerBeamElement=number_slider_7)  # -> AnalyzedModel, NormalForce_kN, ShearForceVz_kN, ShearForceVy_kN, BendingMomentMt_kNm, simplify(BendingMomentMy_kNm), BendingMomentMz_kNm
utilization_of_elements_karamba3d = UtilizationOfElementsKaramba3D(
    AnalyzedModel=beam_forces_karamba3d.AnalyzedModel,
    ElemIdentifiers=panel_32,
    ResultCase=-1,
    NumberOfSamplePoints=3,
    ElasticDesign=True,
    GammaM0=1,
    GammaM1=1,
    WithDetails=False,
    mode="Beams")  # -> AnalyzedModel, Utilization, SigMax_kN_cm2, SigMin_kN_cm2, TauMax_kN_cm2, UtilN, UtilVy, UtilVz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
list_item = ListItem(List=utilization_of_elements_karamba3d.UtilMy, Index=Slider(0, range=0..1), Wrap=True)
panel_33 = Panel(beam_forces_karamba3d.BendingMomentMy_kNm)
panel_34 = Panel(utilization_of_elements_karamba3d.UtilMy)
panel_35 = Panel(utilization_of_elements_karamba3d.Utilization)
panel_36 = Panel(list_item)

# ----
# Column Axial Loads
panel_37 = Panel("""4
5
6
7""")
beam_forces_karamba3d_2 = BeamForcesKaramba3D(
    AnalyzedModel=analyze_karamba3d.CalculatedModel,
    BeamIdentifiers=panel_37,
    LCase=-1,
    MaximumDistanceBetweenResults_m=-1,
    NumberOfResultsPerBeamElement=Slider(3, range=0..10))  # -> AnalyzedModel, simplify(NormalForce_kN), ShearForceVz_kN, ShearForceVy_kN, BendingMomentMt_kNm, BendingMomentMy_kNm, BendingMomentMz_kNm
utilization_of_elements_karamba3d_2 = UtilizationOfElementsKaramba3D(
    AnalyzedModel=beam_forces_karamba3d_2.AnalyzedModel,
    ElemIdentifiers=panel_37,
    ResultCase=-1,
    NumberOfSamplePoints=3,
    ElasticDesign=True,
    GammaM0=1,
    GammaM1=1,
    WithDetails=False,
    mode="Beams")  # -> AnalyzedModel, Utilization, SigMax_kN_cm2, SigMin_kN_cm2, TauMax_kN_cm2, UtilN, UtilVy, UtilVz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
panel_38 = Panel(beam_forces_karamba3d_2.NormalForce_kN)
panel_39 = Panel(utilization_of_elements_karamba3d_2.UtilN)

# ----
# Non-Load Bearing Beam Moments
number_slider_8 = Slider(3, range=0..10)
panel_40 = Panel("""0
1""")
beam_forces_karamba3d_3 = BeamForcesKaramba3D(
    AnalyzedModel=analyze_karamba3d.CalculatedModel,
    BeamIdentifiers=panel_40,
    LCase=Slider(0, range=0..100),
    MaximumDistanceBetweenResults_m=-1,
    NumberOfResultsPerBeamElement=number_slider_8)  # -> AnalyzedModel, NormalForce_kN, ShearForceVz_kN, ShearForceVy_kN, BendingMomentMt_kNm, simplify(BendingMomentMy_kNm), simplify(BendingMomentMz_kNm)
utilization_of_elements_karamba3d_3 = UtilizationOfElementsKaramba3D(
    AnalyzedModel=beam_forces_karamba3d_3.AnalyzedModel,
    ElemIdentifiers=panel_40,
    ResultCase=-1,
    NumberOfSamplePoints=3,
    ElasticDesign=True,
    GammaM0=1,
    GammaM1=1,
    WithDetails=False,
    mode="Beams")  # -> AnalyzedModel, Utilization, SigMax_kN_cm2, SigMin_kN_cm2, TauMax_kN_cm2, UtilN, UtilVy, UtilVz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
list_item_2 = ListItem(List=utilization_of_elements_karamba3d_3.UtilMy, Index=Slider(2, range=2..3), Wrap=True)
panel_41 = Panel(utilization_of_elements_karamba3d_3.Utilization)
panel_42 = Panel(utilization_of_elements_karamba3d_3.UtilMy)
panel_43 = Panel(beam_forces_karamba3d_3.BendingMomentMy_kNm)
panel_44 = Panel(list_item_2)

# ----
# Bracing Axial Loads
number_slider_9 = Slider(3, range=0..10)
panel_47 = Panel("""8
9
10
11""")
beam_forces_karamba3d_4 = BeamForcesKaramba3D(
    AnalyzedModel=analyze_karamba3d.CalculatedModel,
    BeamIdentifiers=panel_47,
    LCase=-1,
    MaximumDistanceBetweenResults_m=-1,
    NumberOfResultsPerBeamElement=number_slider_9)  # -> AnalyzedModel, NormalForce_kN, ShearForceVz_kN, ShearForceVy_kN, BendingMomentMt_kNm, BendingMomentMy_kNm, BendingMomentMz_kNm
utilization_of_elements_karamba3d_4 = UtilizationOfElementsKaramba3D(
    AnalyzedModel=beam_forces_karamba3d_4.AnalyzedModel,
    ElemIdentifiers=panel_47,
    ResultCase=-1,
    NumberOfSamplePoints=3,
    ElasticDesign=True,
    GammaM0=1,
    GammaM1=1,
    WithDetails=False,
    mode="Beams")  # -> AnalyzedModel, Utilization, SigMax_kN_cm2, SigMin_kN_cm2, TauMax_kN_cm2, UtilN, UtilVy, UtilVz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
panel_48 = Panel(utilization_of_elements_karamba3d_4.UtilN)
panel_49 = Panel(beam_forces_karamba3d_4.NormalForce_kN)

# ----
# Columns, Lateral Deflection X
panel_50 = Panel("1000")
multiplication_3 = Multiplication(A=number_slider_2, B=panel_50)
division = Division(A=multiplication_3, B=Slider(400, range=0..1000))
panel_51 = Panel(multiplication_3)
panel_52 = Panel(division)
list_item_3 = ListItem(List=beam_displacements_karamba3d.Translations_m, Index=Slider(1, range=0..11), Wrap=True)
list_item_4 = ListItem(List=beam_displacements_karamba3d.Translations_m, Index=Slider(7, range=0..11), Wrap=True)
list_item_5 = ListItem(List=beam_displacements_karamba3d.Translations_m, Index=Slider(10, range=0..11), Wrap=True)
list_item_6 = ListItem(List=beam_displacements_karamba3d.Translations_m, Index=Slider(4, range=0..11), Wrap=True)
panel_53 = Panel(list_item_3)
panel_54 = Panel(list_item_4)
panel_55 = Panel(list_item_5)
panel_56 = Panel(list_item_6)
deconstruct_vector = DeconstructVector(Vector=list_item_3)  # -> XComponent, YComponent, ZComponent
deconstruct_vector_2 = DeconstructVector(Vector=list_item_4)  # -> XComponent, YComponent, ZComponent
deconstruct_vector_3 = DeconstructVector(Vector=list_item_5)  # -> XComponent, YComponent, ZComponent
deconstruct_vector_4 = DeconstructVector(Vector=list_item_6)  # -> XComponent, YComponent, ZComponent
panel_57 = Panel(deconstruct_vector.XComponent)
panel_58 = Panel(deconstruct_vector_2.XComponent)
panel_59 = Panel(deconstruct_vector_3.XComponent)
panel_60 = Panel(deconstruct_vector_4.XComponent)
converting_to_mm = Panel("-1000")
converting_to_mm_2 = Panel("-1000")
converting_to_mm_3 = Panel("-1000")
converting_to_mm_4 = Panel("-1000")
multiplication_4 = Multiplication(A=converting_to_mm, B=deconstruct_vector.XComponent)
multiplication_5 = Multiplication(A=converting_to_mm_2, B=deconstruct_vector_2.XComponent)
multiplication_6 = Multiplication(A=converting_to_mm_3, B=deconstruct_vector_3.XComponent)
multiplication_7 = Multiplication(A=converting_to_mm_4, B=deconstruct_vector_4.XComponent)
panel_61 = Panel(multiplication_4)
absolute = Absolute(Value=multiplication_4)
panel_62 = Panel(multiplication_5)
panel_63 = Panel(multiplication_6)
panel_64 = Panel(multiplication_7)
absolute_2 = Absolute(Value=multiplication_5)
absolute_3 = Absolute(Value=multiplication_6)
absolute_4 = Absolute(Value=multiplication_7)
smaller_than = SmallerThan(FirstNumber=absolute, SecondNumber=division)  # -> SmallerThan, OrEqualTo
smaller_than_2 = SmallerThan(FirstNumber=absolute_2, SecondNumber=division)  # -> SmallerThan, OrEqualTo
smaller_than_3 = SmallerThan(FirstNumber=absolute_3, SecondNumber=division)  # -> SmallerThan, OrEqualTo
smaller_than_4 = SmallerThan(FirstNumber=absolute_4, SecondNumber=division)  # -> SmallerThan, OrEqualTo
panel_65 = Panel(smaller_than.SmallerThan)
panel_66 = Panel(smaller_than_2.SmallerThan)
panel_67 = Panel(smaller_than_3.SmallerThan)
panel_68 = Panel(smaller_than_4.SmallerThan)
gate_and = GateAnd(A=smaller_than.SmallerThan, B=smaller_than_4.SmallerThan, C=smaller_than_2.SmallerThan, D=smaller_than_3.SmallerThan)
panel_69 = Panel(gate_and)

# ----
# Columns, Lateral Deflection Y
panel_70 = Panel("1000")
multiplication_8 = Multiplication(A=number_slider_2, B=panel_70)
division_2 = Division(A=multiplication_8, B=Slider(400, range=0..1000))
panel_71 = Panel(division_2)
list_item_7 = ListItem(List=beam_displacements_karamba3d.Translations_m, Index=Slider(1, range=0..11), Wrap=True)
list_item_8 = ListItem(List=beam_displacements_karamba3d.Translations_m, Index=Slider(7, range=0..11), Wrap=True)
list_item_9 = ListItem(List=beam_displacements_karamba3d.Translations_m, Index=Slider(10, range=0..11), Wrap=True)
list_item_10 = ListItem(List=beam_displacements_karamba3d.Translations_m, Index=Slider(4, range=0..11), Wrap=True)
panel_72 = Panel(list_item_7)
panel_73 = Panel(list_item_8)
panel_74 = Panel(list_item_9)
panel_75 = Panel(list_item_10)
deconstruct_vector_5 = DeconstructVector(Vector=list_item_7)  # -> XComponent, YComponent, ZComponent
deconstruct_vector_6 = DeconstructVector(Vector=list_item_8)  # -> XComponent, YComponent, ZComponent
deconstruct_vector_7 = DeconstructVector(Vector=list_item_9)  # -> XComponent, YComponent, ZComponent
deconstruct_vector_8 = DeconstructVector(Vector=list_item_10)  # -> XComponent, YComponent, ZComponent
panel_76 = Panel(deconstruct_vector_5.YComponent)
panel_77 = Panel(deconstruct_vector_6.YComponent)
panel_78 = Panel(deconstruct_vector_7.YComponent)
panel_79 = Panel(deconstruct_vector_8.YComponent)
converting_to_mm_5 = Panel("-1000")
converting_to_mm_6 = Panel("-1000")
converting_to_mm_7 = Panel("-1000")
converting_to_mm_8 = Panel("-1000")
multiplication_9 = Multiplication(A=converting_to_mm_5, B=deconstruct_vector_5.YComponent)
multiplication_10 = Multiplication(A=converting_to_mm_6, B=deconstruct_vector_6.YComponent)
multiplication_11 = Multiplication(A=converting_to_mm_7, B=deconstruct_vector_7.YComponent)
multiplication_12 = Multiplication(A=converting_to_mm_8, B=deconstruct_vector_8.YComponent)
panel_80 = Panel(multiplication_9)
absolute_5 = Absolute(Value=multiplication_9)
panel_81 = Panel(multiplication_10)
panel_82 = Panel(multiplication_11)
panel_83 = Panel(multiplication_12)
absolute_6 = Absolute(Value=multiplication_10)
absolute_7 = Absolute(Value=multiplication_11)
absolute_8 = Absolute(Value=multiplication_12)
smaller_than_5 = SmallerThan(FirstNumber=absolute_5, SecondNumber=division_2)  # -> SmallerThan, OrEqualTo
smaller_than_6 = SmallerThan(FirstNumber=absolute_6, SecondNumber=division_2)  # -> SmallerThan, OrEqualTo
smaller_than_7 = SmallerThan(FirstNumber=absolute_7, SecondNumber=division_2)  # -> SmallerThan, OrEqualTo
smaller_than_8 = SmallerThan(FirstNumber=absolute_8, SecondNumber=division_2)  # -> SmallerThan, OrEqualTo
panel_84 = Panel(smaller_than_5.SmallerThan)
panel_85 = Panel(smaller_than_6.SmallerThan)
panel_86 = Panel(smaller_than_7.SmallerThan)
panel_87 = Panel(smaller_than_8.SmallerThan)
gate_and_2 = GateAnd(A=smaller_than_5.SmallerThan, B=smaller_than_8.SmallerThan, C=smaller_than_6.SmallerThan, D=smaller_than_7.SmallerThan)
panel_88 = Panel(gate_and_2)

# ----
# Load Bearing Beams Vertical Deflection
# Non-Load Bearing Beams Vertical Deflection
number_slider_10 = Slider(1, range=0..5)
list_item_11 = ListItem(List=beam_displacements_karamba3d_2.Translations_m, Index=number_slider_10, Wrap=True)
list_item_12 = ListItem(List=beam_displacements_karamba3d_3.Translations_m, Index=Slider(1, range=0..5), Wrap=True)
panel_89 = Panel(list_item_11)
panel_90 = Panel(list_item_12)
multiplication_13 = Multiplication(A=number_slider_3, B="1000")
deconstruct_vector_9 = DeconstructVector(Vector=list_item_11)  # -> XComponent, YComponent, ZComponent
deconstruct_vector_10 = DeconstructVector(Vector=list_item_12)  # -> XComponent, YComponent, ZComponent
division_3 = Division(A=multiplication_13, B=Slider(360, range=0..1000))
multiplication_14 = Multiplication(A=number_slider, B="1000")
panel_91 = Panel(deconstruct_vector_9.ZComponent)
panel_92 = Panel(deconstruct_vector_10.ZComponent)
panel_93 = Panel(division_3)
division_4 = Division(A=multiplication_14, B=Slider(360, range=0..1000))
converting_to_m = Panel("-1000")
panel_94 = Panel(division_4)
converting_to_m_2 = Panel("-1000")
multiplication_15 = Multiplication(A=converting_to_m, B=deconstruct_vector_9.ZComponent)
panel_95 = Panel(multiplication_15)
multiplication_16 = Multiplication(A=converting_to_m_2, B=deconstruct_vector_10.ZComponent)
panel_96 = Panel(multiplication_16)
smaller_than_9 = SmallerThan(FirstNumber=multiplication_15, SecondNumber=division_3)  # -> SmallerThan, OrEqualTo
panel_97 = Panel(smaller_than_9.SmallerThan)
smaller_than_10 = SmallerThan(FirstNumber=multiplication_16, SecondNumber=division_4)  # -> SmallerThan, OrEqualTo
panel_98 = Panel(smaller_than_10.SmallerThan)

# ----
# Load Bearing Beams
# Non-Load Bearing Beams
# Columns
# Braces
number_slider_11 = Slider(1, range=0..3)
list_item_13 = ListItem(List=panel_39, Index=Slider(0, range=0..3), Wrap=True)
list_item_14 = ListItem(List=panel_39, Index=Slider(2, range=0..3), Wrap=True)
list_item_15 = ListItem(List=panel_39, Index=number_slider_11, Wrap=True)
list_item_16 = ListItem(List=panel_48, Index=Slider(0, range=0..3), Wrap=True)
list_item_17 = ListItem(List=panel_48, Index=Slider(2, range=0..3), Wrap=True)
list_item_18 = ListItem(List=panel_39, Index=Slider(3, range=0..3), Wrap=True)
list_item_19 = ListItem(List=panel_48, Index=Slider(1, range=0..3), Wrap=True)
list_item_20 = ListItem(List=panel_48, Index=Slider(3, range=0..3), Wrap=True)
number_slider_12 = Slider(1, range=0..1)
# Fitness Function 2
number_slider_13 = Slider(1, range=0..1)
number_slider_14 = Slider(1, range=0..1)
smaller_than_11 = SmallerThan(FirstNumber=list_item_2, SecondNumber=Slider(1, range=0..1))  # -> SmallerThan, OrEqualTo
smaller_than_12 = SmallerThan(FirstNumber=list_item_15, SecondNumber=number_slider_12)  # -> SmallerThan, OrEqualTo
smaller_than_13 = SmallerThan(FirstNumber=list_item_13, SecondNumber=number_slider_12)  # -> SmallerThan, OrEqualTo
smaller_than_14 = SmallerThan(FirstNumber=list_item_18, SecondNumber=number_slider_12)  # -> SmallerThan, OrEqualTo
smaller_than_15 = SmallerThan(FirstNumber=list_item_14, SecondNumber=number_slider_12)  # -> SmallerThan, OrEqualTo
# Non- Load Bearing Beams
smaller_than_16 = SmallerThan(FirstNumber=list_item, SecondNumber=number_slider_13)  # -> SmallerThan, OrEqualTo
smaller_than_17 = SmallerThan(FirstNumber=list_item_19, SecondNumber=number_slider_14)  # -> SmallerThan, OrEqualTo
smaller_than_18 = SmallerThan(FirstNumber=list_item_16, SecondNumber=number_slider_14)  # -> SmallerThan, OrEqualTo
smaller_than_19 = SmallerThan(FirstNumber=list_item_20, SecondNumber=number_slider_14)  # -> SmallerThan, OrEqualTo
smaller_than_20 = SmallerThan(FirstNumber=list_item_17, SecondNumber=number_slider_14)  # -> SmallerThan, OrEqualTo
panel_99 = Panel(smaller_than_11.SmallerThan)
# Load Bearing Beams
# Non- Load Bearing Beams
# Load Bearing Beams
panel_100 = Panel(smaller_than_16.SmallerThan)
gate_and_3 = GateAnd(
    A=smaller_than_13.SmallerThan,
    B=smaller_than_12.SmallerThan,
    C=smaller_than_15.SmallerThan,
    D=smaller_than_14.SmallerThan)
gate_and_4 = GateAnd(
    A=smaller_than_18.SmallerThan,
    B=smaller_than_17.SmallerThan,
    C=smaller_than_20.SmallerThan,
    D=smaller_than_19.SmallerThan)
panel_101 = Panel(gate_and_3)
panel_102 = Panel(gate_and_4)

penalty_factor_p1 = Panel("""1000000
1""")
list_item_21 = ListItem(List=penalty_factor_p1, Index=panel_101, Wrap=True)
list_item_22 = ListItem(List=penalty_factor_p1, Index=smaller_than_16.SmallerThan, Wrap=True)
list_item_23 = ListItem(List=penalty_factor_p1, Index=panel_102, Wrap=True)
list_item_24 = ListItem(List=penalty_factor_p1, Index=smaller_than_11.SmallerThan, Wrap=True)
panel_103 = Panel(list_item_21)
list_item_25 = ListItem(List=penalty_factor_p1, Index=smaller_than_9.SmallerThan, Wrap=True)
panel_104 = Panel(list_item_22)
panel_105 = Panel(list_item_23)
panel_106 = Panel(list_item_24)
list_item_26 = ListItem(List=penalty_factor_p1, Index=smaller_than_10.SmallerThan, Wrap=True)
list_item_27 = ListItem(List=penalty_factor_p1, Index=gate_and, Wrap=True)
panel_107 = Panel(list_item_25)
list_item_28 = ListItem(List=penalty_factor_p1, Index=gate_and_2, Wrap=True)
panel_108 = Panel(list_item_26)
panel_109 = Panel(list_item_27)
panel_110 = Panel(list_item_28)

# ----
# Load Bearing Beams
# Non-Load Bearing Beams
# Columns
# Braces
# Load Bearing Beams Vertical Deflection
# Non-Load Bearing Beams Vertical Deflection
# Columns, Lateral Deflection X
number_slider_15 = Slider(10, range=0..11)
# Columns, Lateral Deflection Y
number_slider_16 = Slider(1, range=0..11)
list_item_29 = ListItem(List=beam_displacements_karamba3d.Translations_m, Index=number_slider_15, Wrap=True)
list_item_30 = ListItem(List=beam_displacements_karamba3d.Translations_m, Index=Slider(7, range=0..11), Wrap=True)
list_item_31 = ListItem(List=beam_displacements_karamba3d.Translations_m, Index=Slider(10, range=0..11), Wrap=True)
list_item_32 = ListItem(List=beam_displacements_karamba3d.Translations_m, Index=Slider(4, range=0..11), Wrap=True)
list_item_33 = ListItem(List=beam_displacements_karamba3d.Translations_m, Index=Slider(1, range=0..11), Wrap=True)
list_item_34 = ListItem(List=beam_displacements_karamba3d.Translations_m, Index=Slider(7, range=0..11), Wrap=True)
list_item_35 = ListItem(List=beam_displacements_karamba3d.Translations_m, Index=Slider(4, range=0..11), Wrap=True)
list_item_36 = ListItem(List=beam_displacements_karamba3d.Translations_m, Index=number_slider_16, Wrap=True)
absolute_9 = Absolute(Value=list_item_29)
absolute_10 = Absolute(Value=list_item_30)
absolute_11 = Absolute(Value=list_item_31)
absolute_12 = Absolute(Value=list_item_32)
absolute_13 = Absolute(Value=list_item_33)
absolute_14 = Absolute(Value=list_item_34)
absolute_15 = Absolute(Value=list_item_35)
absolute_16 = Absolute(Value=list_item_36)
deconstruct_vector_11 = DeconstructVector(Vector=absolute_9)  # -> XComponent, YComponent, ZComponent
deconstruct_vector_12 = DeconstructVector(Vector=absolute_10)  # -> XComponent, YComponent, ZComponent
deconstruct_vector_13 = DeconstructVector(Vector=absolute_13)  # -> XComponent, YComponent, ZComponent
deconstruct_vector_14 = DeconstructVector(Vector=absolute_12)  # -> XComponent, YComponent, ZComponent
deconstruct_vector_15 = DeconstructVector(Vector=absolute_11)  # -> XComponent, YComponent, ZComponent
deconstruct_vector_16 = DeconstructVector(Vector=absolute_14)  # -> XComponent, YComponent, ZComponent
deconstruct_vector_17 = DeconstructVector(Vector=absolute_16)  # -> XComponent, YComponent, ZComponent
deconstruct_vector_18 = DeconstructVector(Vector=absolute_15)  # -> XComponent, YComponent, ZComponent
sort_list = SortList(Keys=panel_48, ValuesValuesA=panel_48)  # -> reverse(Keys), ValuesValuesA
# Fitness Function 1
number_slider_17 = Slider(1, range=0..1)
sort_list_2 = SortList(Keys=panel_39, ValuesValuesA=panel_39)  # -> reverse(Keys), ValuesValuesA
panel_111 = Panel(deconstruct_vector_12.XComponent)
panel_112 = Panel(deconstruct_vector_14.XComponent)
panel_113 = Panel(deconstruct_vector_11.XComponent)
panel_114 = Panel(deconstruct_vector_16.YComponent)
panel_115 = Panel(deconstruct_vector_18.YComponent)
panel_116 = Panel(deconstruct_vector_13.XComponent)
panel_117 = Panel(deconstruct_vector_15.YComponent)
panel_118 = Panel(deconstruct_vector_17.YComponent)
list_item_37 = ListItem(List=sort_list.Keys, Index=Slider(0, range=0..3), Wrap=True)
subtraction = Subtraction(A=Slider(1, range=0..1), B=list_item_2)
division_5 = Division(A=panel_95, B=panel_93)
list_item_38 = ListItem(List=sort_list_2.Keys, Index=Slider(0, range=0..3), Wrap=True)
subtraction_2 = Subtraction(A=number_slider_17, B=list_item)
maximum = Maximum(A=deconstruct_vector_13.XComponent, B=deconstruct_vector_14.XComponent)
maximum_2 = Maximum(A=deconstruct_vector_12.XComponent, B=deconstruct_vector_11.XComponent)
maximum_3 = Maximum(A=deconstruct_vector_17.YComponent, B=deconstruct_vector_18.YComponent)
division_6 = Division(A=panel_96, B=panel_94)
maximum_4 = Maximum(A=deconstruct_vector_16.YComponent, B=deconstruct_vector_15.YComponent)
panel_119 = Panel(list_item_37)
absolute_17 = Absolute(Value=subtraction)
panel_120 = Panel(list_item_38)
subtraction_3 = Subtraction(A=Slider(1, range=0..1), B=division_5)
maximum_5 = Maximum(A=maximum, B=maximum_2)
absolute_18 = Absolute(Value=subtraction_2)
maximum_6 = Maximum(A=maximum_3, B=maximum_4)
converting_to_mm_9 = Panel("1000")
subtraction_4 = Subtraction(A=Slider(1, range=0..1), B=division_6)
converting_to_mm_10 = Panel("1000")
p1 = Panel(absolute_17)
absolute_19 = Absolute(Value=subtraction_3)
subtraction_5 = Subtraction(A=Slider(1, range=0..1), B=panel_119)
p1_2 = Panel(absolute_18)
subtraction_6 = Subtraction(A=Slider(1, range=0..1), B=panel_120)
absolute_20 = Absolute(Value=subtraction_4)
multiplication_17 = Multiplication(A=maximum_5, B=converting_to_mm_9)
multiplication_18 = Multiplication(A=maximum_6, B=converting_to_mm_10)
absolute_21 = Absolute(Value=subtraction_5)
p1_3 = Panel(absolute_19)
absolute_22 = Absolute(Value=subtraction_6)
panel_121 = Panel(multiplication_17)
panel_122 = Panel(multiplication_18)
p1_4 = Panel(absolute_20)
p1_5 = Panel(absolute_21)
p1_6 = Panel(absolute_22)
division_7 = Division(A=panel_121, B=panel_52)
division_8 = Division(A=panel_122, B=panel_71)
subtraction_7 = Subtraction(A=Slider(1, range=0..1), B=division_7)
subtraction_8 = Subtraction(A=Slider(1, range=0..1), B=division_8)
absolute_23 = Absolute(Value=subtraction_7)
absolute_24 = Absolute(Value=subtraction_8)
p1_7 = Panel(absolute_23)
p1_8 = Panel(absolute_24)

# ----
# 1. Optimize Beam Sizes
multiplication_19 = Multiplication(A=assemble_model_karamba3d.Mass_kg, B=list_item_25)
multiplication_20 = Multiplication(A=multiplication_19, B=list_item_26)
multiplication_21 = Multiplication(A=multiplication_20, B=list_item_22)
multiplication_22 = Multiplication(A=multiplication_21, B=list_item_24)
multiplication_23 = Multiplication(A=multiplication_22, B=p1_2)
multiplication_24 = Multiplication(A=multiplication_23, B=p1)
multiplication_25 = Multiplication(A=multiplication_24, B=p1_3)
multiplication_26 = Multiplication(A=multiplication_25, B=p1_4)
panel_123 = Panel(multiplication_26)
panel_124 = Panel(multiplication_22)
galapagos = Galapagos(fitness=multiplication_26, gene=[name_or_list_of_index_of_cross_section_f_2, name_or_list_of_index_of_cross_section_f])
galapagos_listener = GalapagosListener(
    Genomes=[name_or_list_of_index_of_cross_section_f, name_or_list_of_index_of_cross_section_f_2],
    Fitness=panel_123,
    Reset=Toggle(False))  # -> flatten(Fitness), Iterations
panel_125 = Panel(galapagos_listener.Iterations)
panel_126 = Panel(galapagos_listener.Fitness)

# ----
# 2. Optimize Bracing and Column Sizes
multiplication_27 = Multiplication(A=multiplication_22, B=list_item_27)
multiplication_28 = Multiplication(A=multiplication_27, B=list_item_28)
multiplication_29 = Multiplication(A=multiplication_28, B=list_item_21)
multiplication_30 = Multiplication(A=multiplication_29, B=list_item_23)
multiplication_31 = Multiplication(A=multiplication_30, B=p1_6)
multiplication_32 = Multiplication(A=multiplication_31, B=p1_5)
multiplication_33 = Multiplication(A=multiplication_32, B=p1_7)
multiplication_34 = Multiplication(A=multiplication_33, B=p1_8)
galapagos_2 = Galapagos(fitness=multiplication_34, gene=[name_or_list_of_index_of_cross_section_f_3, name_or_list_of_index_of_cross_section_f_4])
panel_127 = Panel(multiplication_30)
panel_128 = Panel(multiplication_34)
galapagos_listener_2 = GalapagosListener(
    Genomes=[name_or_list_of_index_of_cross_section_f_3, name_or_list_of_index_of_cross_section_f_4],
    Fitness=panel_128,
    Reset=Toggle(False))  # -> flatten(Fitness), Iterations
panel_129 = Panel(galapagos_listener_2.Iterations)
panel_130 = Panel(galapagos_listener_2.Fitness)

# ----
# Key Structural Results
ult_load_bearing_moment_connections = Panel(list_item)
column_ults = Panel(panel_39)
bracing_ults = Panel(panel_48)
bracing_numbering = Panel("""8
9
10
11""")
column_numbering = Panel("""4
5
6
7""")
all_lateral_delfc_x_satisfied = Panel(panel_69)
defl_load_bearing = Panel(panel_95)
defl_non_load_bearing = Panel(panel_96)
defl_limit_load_bear = Panel(panel_93)
defl_limit_non_load_bearing = Panel(panel_94)
all_lateral_delfc_y_satisfied = Panel(panel_88)
panel_131 = Panel(panel_28)
panel_133 = Panel(panel_30)

# ----
# Optimized Beams
# Optimized Columns and Braces
number_slider_18 = Slider(1, range=0..1)
number = Number(panel_125)
split_list = SplitList(List=number, Index=number_slider_18)  # -> flatten(ListA), flatten(ListB)
split_list_2 = SplitList(List=panel_129, Index=Slider(1, range=0..1))  # -> flatten(ListA), flatten(ListB)
non_load_bearing = Panel(split_list.ListA)
load_bearing = Panel(split_list.ListB)
columns = Panel(split_list_2.ListA)
bracing = Panel(split_list_2.ListB)
sort_list_3 = SortList(Keys=panel_126, ValuesNonLoadBearing=non_load_bearing, ValuesLoadBearing=load_bearing)  # -> flatten(Keys), flatten(ValuesNonLoadBearing), flatten(ValuesLoadBearing)
sort_list_4 = SortList(Keys=panel_130, ValuesNonLoadBearing=columns, ValuesLoadBearing=bracing)  # -> flatten(Keys), flatten(ValuesNonLoadBearing), flatten(ValuesLoadBearing)
lower_limit = Panel("0")
top_40_optimized_solutions = Slider(0, range=0..40)
panel_135 = Panel(sort_list_3.Keys)
panel_136 = Panel(sort_list_3.ValuesNonLoadBearing)
panel_137 = Panel(sort_list_3.ValuesLoadBearing)
panel_138 = Panel(sort_list_4.Keys)
panel_139 = Panel(sort_list_4.ValuesNonLoadBearing)
panel_140 = Panel(sort_list_4.ValuesLoadBearing)
upper_limit = Panel("40")
list_item_39 = ListItem(List=panel_135, Index=top_40_optimized_solutions, Wrap=True)
list_item_40 = ListItem(List=panel_136, Index=top_40_optimized_solutions, Wrap=True)
list_item_41 = ListItem(List=panel_138, Index=top_40_optimized_solutions, Wrap=True)
list_item_42 = ListItem(List=panel_137, Index=top_40_optimized_solutions, Wrap=True)
list_item_43 = ListItem(List=panel_139, Index=top_40_optimized_solutions, Wrap=True)
list_item_44 = ListItem(List=panel_140, Index=top_40_optimized_solutions, Wrap=True)
bounds = Bounds(Numbers=list_item_42)
bounds_2 = Bounds(Numbers=list_item_40)

# ----
# 7m Bearing Beams (non load bearing)
line_17 = Line([line_3, line_2])
cross_section_range_selector_karamba3d_5 = CrossSectionRangeSelectorKaramba3D(MaximumHeight_cm=-1, MaximumWidth_cm=-1, menu=[dropdown(7), dropdown(1), dropdown(4)])
cross_section_selector_karamba3d_5 = CrossSectionSelectorKaramba3D(CrossSections=cross_section_range_selector_karamba3d_5, NameOrListIndexOfCrossSection=list_item_40)  # -> CrossSection, Info
disassemble_cross_section_karamba3d_5 = DisassembleCrossSectionKaramba3D(CroSec=cross_section_selector_karamba3d_5.CrossSection)  # -> CrossSection, FamilyNameOfCrossSection, TypeNameOfCrossSection, ElemIdentifiers, Color, Material, LocalEccentricity_cm, Heights_cm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
panel_141 = Panel(disassemble_cross_section_karamba3d_5.Area_cm2)
panel_142 = Panel(disassemble_cross_section_karamba3d_5.CrossSection)
panel_143 = Panel(disassemble_cross_section_karamba3d_5.Wely_cm3)
line_to_beam_karamba3d_5 = LineToBeamKaramba3D(
    Line=line_17,
    Identifier="Non-Load Bearing Beams",
    CrossSection=cross_section_selector_karamba3d_5.CrossSection,
    New=True,
    Remove=True,
    LimitDistance_m=0.005)  # -> Element, Points, Info

# ----
# 10m Beams (Load Bearing)
line_18 = Line([line, line_4])
cross_section_range_selector_karamba3d_6 = CrossSectionRangeSelectorKaramba3D(MaximumHeight_cm=-1, MaximumWidth_cm=-1, menu=[dropdown(7), dropdown(1), dropdown(4)])
cross_section_selector_karamba3d_6 = CrossSectionSelectorKaramba3D(CrossSections=cross_section_range_selector_karamba3d_6, NameOrListIndexOfCrossSection=list_item_42)  # -> CrossSection, Info
disassemble_cross_section_karamba3d_6 = DisassembleCrossSectionKaramba3D(CroSec=cross_section_selector_karamba3d_6.CrossSection)  # -> CrossSection, FamilyNameOfCrossSection, TypeNameOfCrossSection, ElemIdentifiers, Color, Material, LocalEccentricity_cm, Heights_cm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
panel_144 = Panel(disassemble_cross_section_karamba3d_6.CrossSection)
panel_145 = Panel(disassemble_cross_section_karamba3d_6.Area_cm2)
panel_146 = Panel(disassemble_cross_section_karamba3d_6.Wely_cm3)
line_to_beam_karamba3d_6 = LineToBeamKaramba3D(
    Line=line_18,
    Identifier="Load Bearing Beams",
    CrossSection=cross_section_selector_karamba3d_6.CrossSection,
    New=True,
    Remove=True,
    LimitDistance_m=0.005)  # -> Element, Points, Info

# ----
# Truss Diagonal Braces
line_19 = Line([line_9, line_10, line_11, line_12])
cross_section_range_selector_karamba3d_7 = CrossSectionRangeSelectorKaramba3D(MaximumHeight_cm=-1, MaximumWidth_cm=-1, menu=[dropdown(7), dropdown(4), dropdown(1)])
cross_section_selector_karamba3d_7 = CrossSectionSelectorKaramba3D(CrossSections=cross_section_range_selector_karamba3d_7, NameOrListIndexOfCrossSection=list_item_44)  # -> CrossSection, Info
disassemble_cross_section_karamba3d_7 = DisassembleCrossSectionKaramba3D(CroSec=cross_section_selector_karamba3d_7.CrossSection)  # -> CrossSection, FamilyNameOfCrossSection, TypeNameOfCrossSection, ElemIdentifiers, Color, Material, LocalEccentricity_cm, Heights_cm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
panel_147 = Panel(disassemble_cross_section_karamba3d_7.Area_cm2)
line_to_beam_karamba3d_7 = LineToBeamKaramba3D(
    Line=line_19,
    Identifier="Diagonal Braces",
    CrossSection=cross_section_selector_karamba3d_7.CrossSection,
    New=True,
    Remove=True,
    LimitDistance_m=0.005,
    Bending=Toggle(False))  # -> Element, Points, Info

# ----
# Columns
line_20 = Line([line_5, line_6, line_7, line_8])
cross_section_range_selector_karamba3d_8 = CrossSectionRangeSelectorKaramba3D(MaximumHeight_cm=-1, MaximumWidth_cm=-1, menu=[dropdown(7), dropdown(1), dropdown(4)])
cross_section_selector_karamba3d_8 = CrossSectionSelectorKaramba3D(CrossSections=cross_section_range_selector_karamba3d_8, NameOrListIndexOfCrossSection=list_item_43)  # -> CrossSection, Info
disassemble_cross_section_karamba3d_8 = DisassembleCrossSectionKaramba3D(CroSec=cross_section_selector_karamba3d_8.CrossSection)  # -> CrossSection, FamilyNameOfCrossSection, TypeNameOfCrossSection, ElemIdentifiers, Color, Material, LocalEccentricity_cm, Heights_cm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
panel_148 = Panel(disassemble_cross_section_karamba3d_8.Area_cm2)
line_to_beam_karamba3d_8 = LineToBeamKaramba3D(
    Line=line_20,
    Identifier="Columns",
    CrossSection=cross_section_selector_karamba3d_8.CrossSection,
    New=True,
    Remove=True,
    LimitDistance_m=0.005)  # -> Element, Points, Info

# ----
# Genes
panel_149 = Panel(cross_section_selector_karamba3d_5.CrossSection)

# ----
# Genes
panel_150 = Panel(cross_section_selector_karamba3d_6.CrossSection)

# ----
# Genes
panel_151 = Panel(cross_section_selector_karamba3d_8.CrossSection)

# ----
# Genes
panel_152 = Panel(cross_section_selector_karamba3d_7.CrossSection)

# ----
# Disable Original Assemble Model and Enablle this to see the best optimized solutions
gradient = Gradient(
    LowerLimit=lower_limit,
    UpperLimit=upper_limit,
    Parameter=top_40_optimized_solutions,
    stops=[0: RGB(0, 128, 0), 0.526: RGB(255, 255, 0), 1: RGB(255, 0, 0)])  # disabled
assemble_model_karamba3d_2 = AssembleModelKaramba3D(
    Point=point_3,
    Elem=[line_to_beam_karamba3d_5.Element, line_to_beam_karamba3d_6.Element, line_to_beam_karamba3d_8.Element, line_to_beam_karamba3d_7.Element],
    Support=support_karamba3d,
    Load=[loads_karamba3d, loads_karamba3d_2, loads_karamba3d_3, loads_karamba3d_4],
    Material=material_selection_karamba3d,
    LimitDistance_m=0.005)  # -> Model, Info, Mass_kg, CenterOfGravity; disabled
custom_preview = CustomPreview(Geometry=[line_20, line_18, line_17, line_19], Material=gradient)
model_view_karamba3d_2 = ModelViewKaramba3D(Model=assemble_model_karamba3d_2.Model, ResultFactors=1, ResultCase=-1)  # -> Model, DeformedMesh, DeformedAxes, DeformedModel; disabled
