# Grasshopper definition FRAME(with wind loads)adjust1-DEMO_lunchboxML-supervised-niave bayes.gh (Grasshopper 1.0.7)
# plug-ins: karambaGH, TT Toolbox, LunchBoxML, LunchBox

# ----
# Lines and Nodes
point = Point(Point(0, 0, 0))
deconstruct = Deconstruct(Point=point)  # -> XComponent, YComponent, ZComponent
number_slider = Slider(7, range=0..20)
number_slider_2 = Slider(5, range=0..20)
number_slider_3 = Slider(10, range=0..30)
number_slider_4 = Slider(7, range=0..30)
addition = Addition(A=deconstruct.ZComponent, B=Slider(5, range=0..20))
addition_2 = Addition(A=deconstruct.XComponent, B=number_slider)
construct_point = ConstructPoint(XCoordinate=deconstruct.XComponent, YCoordinate=deconstruct.YComponent, ZCoordinate=addition)
deconstruct_2 = Deconstruct(Point=construct_point)  # -> XComponent, YComponent, ZComponent
addition_3 = Addition(A=deconstruct_2.YComponent, B=number_slider_3)
construct_point_2 = ConstructPoint(XCoordinate=Slider(0, range=0..30), YCoordinate=Slider(10, range=0..30), ZCoordinate=Slider(0, range=0..30))
construct_point_3 = ConstructPoint(XCoordinate=addition_2, YCoordinate=deconstruct.YComponent, ZCoordinate=deconstruct.ZComponent)
deconstruct_3 = Deconstruct(Point=construct_point_3)  # -> XComponent, YComponent, ZComponent
addition_4 = Addition(A=deconstruct_3.ZComponent, B=number_slider_2)
construct_point_4 = ConstructPoint(XCoordinate=deconstruct_3.XComponent, YCoordinate=deconstruct_3.YComponent, ZCoordinate=addition_4)
deconstruct_4 = Deconstruct(Point=construct_point_4)  # -> XComponent, YComponent, ZComponent
addition_5 = Addition(A=deconstruct_4.YComponent, B=Slider(10, range=0..30))
construct_point_5 = ConstructPoint(XCoordinate=deconstruct_2.XComponent, YCoordinate=addition_3, ZCoordinate=deconstruct_2.ZComponent)
construct_point_6 = ConstructPoint(XCoordinate=number_slider_4, YCoordinate=Slider(10, range=0..30), ZCoordinate=Slider(0, range=0..30))
construct_point_7 = ConstructPoint(XCoordinate=deconstruct_4.XComponent, YCoordinate=addition_5, ZCoordinate=deconstruct_4.ZComponent)
line = Line(StartPoint=construct_point, EndPoint=construct_point_4)
line_2 = Line(StartPoint=construct_point, EndPoint=construct_point_5)
line_3 = Line(StartPoint=construct_point_5, EndPoint=construct_point_7)
line_4 = Line(StartPoint=construct_point_4, EndPoint=construct_point_7)
line_5 = Line(StartPoint=point, EndPoint=construct_point)
line_6 = Line(StartPoint=construct_point_3, EndPoint=construct_point_4)
line_7 = Line(StartPoint=construct_point_7, EndPoint=construct_point_6)
line_8 = Line(StartPoint=construct_point_5, EndPoint=construct_point_2)

# ----
# Support  Nodes
point_2 = Point([point, construct_point_2, construct_point_6, construct_point_3])

# ----
# Truss Diagonal Braces
line_9 = Line(StartPoint=construct_point, EndPoint=construct_point_3)
line_10 = Line(StartPoint=construct_point_5, EndPoint=construct_point_6)
line_11 = Line(StartPoint=construct_point, EndPoint=construct_point_2)
line_12 = Line(StartPoint=construct_point_4, EndPoint=construct_point_6)
point_3 = Point([construct_point, construct_point_3, construct_point_4, construct_point_5, construct_point_7, construct_point_6, construct_point_2, point])
layer_reference = LayerReference(ReferenceToggle=Toggle(True), LayerName="Non-Load Bearing Beams")  # -> Geometry, Name, UserStrings, GUID

# ----
# Pinned Joint Connections
beam_joints_karamba3d = BeamJointsKaramba3D(
    ElementIdentifiers="Non-Load Bearing Beams",
    CtKNMAtStartingNode=Vector(0, 0, 0),
    CrKNmRadAtStartingNode=Vector(0, 0, 0),
    CtKNMAtEndNode=Vector(0, 0, 0),
    CrKNmRadAtEndNode=Vector(0, 0, 0),
    menu=[buttons(off, off, off, off, on, on), buttons(off, off, off, off, on, on)])
panel = Panel(beam_joints_karamba3d)

line_13 = Line(layer_reference.Geometry)

name_or_list_of_index_of_materials = Slider(0, range=0..116)
read_material_table_from_file_karamba3d = ReadMaterialTableFromFileKaramba3D()
material_selection_karamba3d = MaterialSelectionKaramba3D(
    Materials=read_material_table_from_file_karamba3d,
    NameOrListIndexOfMaterial=name_or_list_of_index_of_materials,
    menu=[dropdown(1), dropdown(1)])
panel_2 = Panel(material_selection_karamba3d)
disassemble_material_karamba3d = DisassembleMaterialKaramba3D(Material=material_selection_karamba3d)  # -> Material, TypeOfMaterial, FamilyNameOfMaterial, NameOfMaterial, ElemIdentifiers, Color, YoungsModulusKNCm2Dir12, InPlaneShearModulus_kN_cm2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
panel_3 = Panel(disassemble_material_karamba3d.SpecificWeight_kN_m3)

# ----
# "Orientation" feature
# non-load bearing beams
# load bearing beams
# columns
# braces
# braces
unit_vector = UnitVector(Vector=line_3)
unit_vector_2 = UnitVector(Vector=line_2)
unit_vector_3 = UnitVector(Vector=line_9)
unit_vector_4 = UnitVector(Vector=line_5)
unit_vector_5 = UnitVector(Vector=line_11)
deconstruct_vector = DeconstructVector(Vector=unit_vector)  # -> XComponent, YComponent, ZComponent
deconstruct_vector_2 = DeconstructVector(Vector=unit_vector_3)  # -> XComponent, YComponent, ZComponent
deconstruct_vector_3 = DeconstructVector(Vector=unit_vector_4)  # -> XComponent, YComponent, ZComponent
deconstruct_vector_4 = DeconstructVector(Vector=unit_vector_5)  # -> XComponent, YComponent, ZComponent
deconstruct_vector_5 = DeconstructVector(Vector=unit_vector_2)  # -> XComponent, YComponent, ZComponent
absolute = Absolute(Value=deconstruct_vector_2.ZComponent)
absolute_2 = Absolute(Value=deconstruct_vector_2.YComponent)
absolute_3 = Absolute(Value=deconstruct_vector_2.XComponent)
absolute_4 = Absolute(Value=deconstruct_vector_4.ZComponent)
absolute_5 = Absolute(Value=deconstruct_vector_4.YComponent)
absolute_6 = Absolute(Value=deconstruct_vector_4.XComponent)
merge = Merge(Data1=deconstruct_vector.XComponent, Data2=deconstruct_vector.YComponent, Data3=deconstruct_vector.ZComponent)  # -> flatten(Result)
merge_2 = Merge(Data1=deconstruct_vector_5.XComponent, Data2=deconstruct_vector_5.YComponent, Data3=deconstruct_vector_5.ZComponent)  # -> flatten(Result)
merge_3 = Merge(Data1=deconstruct_vector_3.XComponent, Data2=deconstruct_vector_3.YComponent, Data3=deconstruct_vector_3.ZComponent)
merge_4 = Merge(Data1=absolute_3, Data2=absolute_2, Data3=absolute)
merge_5 = Merge(Data1=absolute_6, Data2=absolute_5, Data3=absolute_4)
panel_4 = Panel(merge_3)
panel_5 = Panel(merge)
panel_6 = Panel(merge_2)
panel_7 = Panel(merge_4)
panel_8 = Panel(merge_5)
ghpython_script = GhPythonScript(input=panel_6)  # -> out, a; inputs input: list of Int32, y: list
# ---------- ghpython_script: Python ----------
a=[]
x=input[0]
y=input[1]
z=input[2]

if x>0 and y==0 and z==0:
    a.append("x")
elif y>0 and x==0 and z==0:
    a.append("y")
elif z>0 and x==0 and y==0:
    a.append("z")
elif x>0 and z>0 and y==0:
    a.append("xz")
elif y>0 and z>0 and x==0:
    a.append("yz")
elif x>0 and y>0 and z==0:
    a.append("xy")   
print(a)
# ---------- end ghpython_script ----------
ghpython_script_2 = GhPythonScript(input=panel_4)  # -> out, a; inputs input: list of Int32, y: list; same code as ghpython_script
ghpython_script_3 = GhPythonScript(input=panel_5)  # -> out, a; inputs input: list of Int32; same code as ghpython_script
ghpython_script_4 = GhPythonScript(input=panel_7)  # -> out, a; inputs input: list, y: list
# ---------- ghpython_script_4: Python ----------
a=[]
x=input[0]
y=input[1]
z=input[2]



if x>0 and y==0 and z==0:
    a.append("x")
elif y>0 and x==0 and z==0:
    a.append("y")
elif z>0 and x==0 and y==0:
    a.append("z")
elif x>0 and z>0 and y==0:
    a.append("xz")
elif y>0 and z>0 and x==0:
    a.append("yz")
elif x>0 and y>0 and z==0:
    a.append("xy")   
print(a)
# ---------- end ghpython_script_4 ----------
ghpython_script_5 = GhPythonScript(input=panel_8)  # -> out, a; inputs input: list, y: list; same code as ghpython_script_4
panel_9 = Panel(ghpython_script_2.a)
panel_10 = Panel(ghpython_script.a)
panel_11 = Panel(ghpython_script_3.a)
panel_12 = Panel(ghpython_script_4.a)
panel_13 = Panel(ghpython_script_5.a)
duplicate_data = DuplicateData(Data=panel_11, Number=2, Order=True)
duplicate_data_2 = DuplicateData(Data=panel_12, Number=2, Order=True)
duplicate_data_3 = DuplicateData(Data=panel_10, Number=2, Order=True)
duplicate_data_4 = DuplicateData(Data=panel_9, Number=Slider(4, range=0..10), Order=True)
duplicate_data_5 = DuplicateData(Data=panel_13, Number=2, Order=True)
merge_6 = Merge(Data1=duplicate_data_2, Data2=duplicate_data_5, Data3=duplicate_data_4, Data4=duplicate_data, Data5=duplicate_data_3)  # -> flatten(Result)

# ----
# Training Data
# Input Column Names
# Output Column Name
boolean_toggle = BooleanToggle(True)
file_path = FilePath("C:\Users\beck97179\OneDrive - Hatch Ltd\Queens ONEDRIVE\Genetic Algorithm and Rhino-Grasshopper\Grasshopper Models\major files\lunchboxML\LunchoxMLFrameTrainingData.xlsx")
excel_reader = ExcelReader(ReadExcelData=boolean_toggle, WorkbookPath=file_path, WorksheetName="Sheet1")  # -> Exceptions, ExcelData
panel_14 = Panel(excel_reader.ExcelData)
explode_tree = ExplodeTree(Data=panel_14)  # -> Branch0, Branch1, Branch2, Branch3
panel_15 = Panel(explode_tree.Branch1)
panel_16 = Panel(explode_tree.Branch0)
panel_17 = Panel(explode_tree.Branch2)
panel_18 = Panel(explode_tree.Branch3)
list_item = ListItem(List=excel_reader.ExcelData, Index=0, Wrap=True)  # -> flatten(Item)
panel_19 = Panel(list_item)
list_item_2 = ListItem(List=panel_15, Index=0, Wrap=True)
list_item_3 = ListItem(List=panel_18, Index=0, Wrap=True)  # -> flatten(Item)
list_item_4 = ListItem(List=panel_17, Index=0, Wrap=True)
panel_20 = Panel(list_item_2)
panel_21 = Panel(list_item_4)
create_datatable = CreateDataTable(TableHeaders=panel_19, ValueTree=excel_reader.ExcelData)
panel_22 = Panel(list_item_3)
entwine = Entwine(Branch00=panel_20, Branch01=panel_21, FlattenInputs=True)
panel_23 = Panel(entwine)
flatten_tree = FlattenTree(Tree=panel_23, Path="{0}")  # -> flatten(Tree)
panel_24 = Panel(flatten_tree)

# ----
# Wind Loads UDL
wind_load_p_kpa = Slider(3, range=-5..5)
wind_load_p_kpa_2 = Slider(3, range=-5..5)
multiplication = Multiplication(A=wind_load_p_kpa, B=number_slider_4)
multiplication_2 = Multiplication(A=wind_load_p_kpa_2, B=number_slider_3)
panel_25 = Panel("""4
5""")
unit_y = UnitY(Factor=multiplication)
panel_26 = Panel("""4
7""")
unit_x = UnitX(Factor=multiplication_2)
loads_karamba3d = LoadsKaramba3D(Vector=unit_y, BeamIdentifiers=panel_25, LCase="1", mode="Uniform Line", menu=[buttons(off, on, off)])
loads_karamba3d_2 = LoadsKaramba3D(Vector=unit_x, BeamIdentifiers=panel_26, LCase="1", mode="Uniform Line", menu=[buttons(off, on, off)])

# ----
# Live Loads UDL
live_load_load_bearing = Slider(-10, range=-50..0)
live_load_non_load_bearing = Slider(-10, range=-50..0)
panel_27 = Panel("""2
3""")
panel_28 = Panel("""0
1""")
unit_z = UnitZ(Factor=live_load_load_bearing)
unit_z_2 = UnitZ(Factor=live_load_non_load_bearing)
loads_karamba3d_3 = LoadsKaramba3D(Vector=unit_z, BeamIdentifiers=panel_27, LCase=" 0", mode="Uniform Line", menu=[buttons(off, on, off)])
loads_karamba3d_4 = LoadsKaramba3D(Vector=unit_z_2, BeamIdentifiers=panel_28, LCase=" 0", mode="Uniform Line", menu=[buttons(off, on, off)])
panel_29 = Panel(loads_karamba3d_3)
panel_30 = Panel(loads_karamba3d_4)

# ----
# Fixed Supports
# Relase Rx and Rz to make Pinned Supports
support_karamba3d = SupportKaramba3D(PosInd=point_2, menu=[buttons(on, on, on, on, on, on)])

orientation = Panel(merge_6)
vertical_0 = Slider(0, range=0..1)
panel_31 = Panel("""2
3""")
vertical_0_2 = Slider(0, range=0..1)

# ----
# 7m Bearing Beams (non load bearing)
line_14 = Line([line_3, line])
cross_section_range_selector_karamba3d = CrossSectionRangeSelectorKaramba3D(MaximumHeight_cm=-1, MaximumWidth_cm=-1, menu=[dropdown(7), dropdown(1), dropdown(4)])

# ----
# Genes
name_or_list_of_index_of_cross_section_f = Slider(163, range=0..270)  # "Name or list of index of cross section FOR NON LOAD BEARING BEAMS"

cross_section_selector_karamba3d = CrossSectionSelectorKaramba3D(
    CrossSections=cross_section_range_selector_karamba3d,
    NameOrListIndexOfCrossSection=name_or_list_of_index_of_cross_section_f)  # -> CrossSection, Info
disassemble_cross_section_karamba3d = DisassembleCrossSectionKaramba3D(CroSec=cross_section_selector_karamba3d.CrossSection)  # -> CrossSection, FamilyNameOfCrossSection, TypeNameOfCrossSection, ElemIdentifiers, Color, Material, LocalEccentricity_cm, Heights_cm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
panel_32 = Panel(disassemble_cross_section_karamba3d.Area_cm2)
panel_33 = Panel(disassemble_cross_section_karamba3d.CrossSection)
panel_34 = Panel(disassemble_cross_section_karamba3d.Wely_cm3)
line_to_beam_karamba3d = LineToBeamKaramba3D(
    Line=line_14,
    Identifier="Non-Load Bearing Beams",
    CrossSection=cross_section_selector_karamba3d.CrossSection,
    New=True,
    Remove=True,
    LimitDistance_m=0.005)  # -> Element, Points, Info

# ----
# 10m Beams (Load Bearing)
line_15 = Line([line_2, line_4])
cross_section_range_selector_karamba3d_2 = CrossSectionRangeSelectorKaramba3D(MaximumHeight_cm=-1, MaximumWidth_cm=-1, menu=[dropdown(7), dropdown(1), dropdown(4)])

# ----
# Genes
name_or_list_of_index_of_cross_section_f_2 = Slider(195, range=0..270)  # "Name or list of index of cross section FOR LOAD BEARING BEAMS"

cross_section_selector_karamba3d_2 = CrossSectionSelectorKaramba3D(
    CrossSections=cross_section_range_selector_karamba3d_2,
    NameOrListIndexOfCrossSection=name_or_list_of_index_of_cross_section_f_2)  # -> CrossSection, Info
disassemble_cross_section_karamba3d_2 = DisassembleCrossSectionKaramba3D(CroSec=cross_section_selector_karamba3d_2.CrossSection)  # -> CrossSection, FamilyNameOfCrossSection, TypeNameOfCrossSection, ElemIdentifiers, Color, Material, LocalEccentricity_cm, Heights_cm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
panel_35 = Panel(disassemble_cross_section_karamba3d_2.CrossSection)
panel_36 = Panel(disassemble_cross_section_karamba3d_2.Area_cm2)
panel_37 = Panel(disassemble_cross_section_karamba3d_2.Wely_cm3)
line_to_beam_karamba3d_2 = LineToBeamKaramba3D(
    Line=line_15,
    Identifier="Load Bearing Beams",
    CrossSection=cross_section_selector_karamba3d_2.CrossSection,
    New=True,
    Remove=True,
    LimitDistance_m=0.005)  # -> Element, Points, Info

# ----
# Ridged Joint Connections
beam_joints_karamba3d_2 = BeamJointsKaramba3D(
    ElementIdentifiers=line_to_beam_karamba3d_2.Element,
    CtKNMAtStartingNode=Vector(0, 0, 0),
    CrKNmRadAtStartingNode=Vector(0, 0, 0),
    CtKNMAtEndNode=Vector(0, 0, 0),
    CrKNmRadAtEndNode=Vector(0, 0, 0),
    menu=[buttons(off, off, off, off, off, off), buttons(off, off, off, off, off, off)])
panel_38 = Panel(beam_joints_karamba3d_2)

# ----
# Genes
name_or_list_of_index_of_cross_section_f_3 = Slider(221, range=0..270)  # "Name or list of index of cross section FOR COLUMNS"

# ----
# Columns
line_16 = Line([line_5, line_6, line_7, line_8])
cross_section_range_selector_karamba3d_3 = CrossSectionRangeSelectorKaramba3D(MaximumHeight_cm=-1, MaximumWidth_cm=-1, menu=[dropdown(7), dropdown(1), dropdown(4)])
cross_section_selector_karamba3d_3 = CrossSectionSelectorKaramba3D(
    CrossSections=cross_section_range_selector_karamba3d_3,
    NameOrListIndexOfCrossSection=name_or_list_of_index_of_cross_section_f_3)  # -> CrossSection, Info
disassemble_cross_section_karamba3d_3 = DisassembleCrossSectionKaramba3D(CroSec=cross_section_selector_karamba3d_3.CrossSection)  # -> CrossSection, FamilyNameOfCrossSection, TypeNameOfCrossSection, ElemIdentifiers, Color, Material, LocalEccentricity_cm, Heights_cm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
panel_39 = Panel(disassemble_cross_section_karamba3d_3.Area_cm2)
line_to_beam_karamba3d_3 = LineToBeamKaramba3D(
    Line=line_16,
    Identifier="Columns",
    CrossSection=cross_section_selector_karamba3d_3.CrossSection,
    New=True,
    Remove=True,
    LimitDistance_m=0.005)  # -> Element, Points, Info

# ----
# Column Joint Connections
beam_joints_karamba3d_3 = BeamJointsKaramba3D(
    ElementIdentifiers=line_to_beam_karamba3d_3.Element,
    CtKNMAtStartingNode=Vector(0, 0, 0),
    CrKNmRadAtStartingNode=Vector(0, 0, 0),
    CtKNMAtEndNode=Vector(0, 0, 0),
    CrKNmRadAtEndNode=Vector(0, 0, 0),
    menu=[buttons(off, off, off, off, off, off), buttons(off, off, off, off, off, off)])
panel_40 = Panel(beam_joints_karamba3d_3)

# ----
# Truss Diagonal Braces
line_17 = Line([line_9, line_10, line_11, line_12])
cross_section_range_selector_karamba3d_4 = CrossSectionRangeSelectorKaramba3D(MaximumHeight_cm=-1, MaximumWidth_cm=-1, menu=[dropdown(7), dropdown(4), dropdown(1)])

# ----
# Genes
name_or_list_of_index_of_cross_section_f_4 = Slider(52, range=0..187)  # "Name or list of index of cross section FOR COLUMNS"

cross_section_selector_karamba3d_4 = CrossSectionSelectorKaramba3D(
    CrossSections=cross_section_range_selector_karamba3d_4,
    NameOrListIndexOfCrossSection=name_or_list_of_index_of_cross_section_f_4)  # -> CrossSection, Info
disassemble_cross_section_karamba3d_4 = DisassembleCrossSectionKaramba3D(CroSec=cross_section_selector_karamba3d_4.CrossSection)  # -> CrossSection, FamilyNameOfCrossSection, TypeNameOfCrossSection, ElemIdentifiers, Color, Material, LocalEccentricity_cm, Heights_cm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
panel_41 = Panel(disassemble_cross_section_karamba3d_4.Area_cm2)
line_to_beam_karamba3d_4 = LineToBeamKaramba3D(
    Line=line_17,
    Identifier="Diagonal Braces",
    CrossSection=cross_section_selector_karamba3d_4.CrossSection,
    New=True,
    Remove=True,
    LimitDistance_m=0.005,
    Bending=Toggle(False))  # -> Element, Points, Info

assemble_model_karamba3d = AssembleModelKaramba3D(
    Point=point_3,
    Elem=[line_to_beam_karamba3d.Element, line_to_beam_karamba3d_2.Element, line_to_beam_karamba3d_3.Element, line_to_beam_karamba3d_4.Element],
    Support=support_karamba3d,
    Load=[loads_karamba3d_3, loads_karamba3d_4, loads_karamba3d, loads_karamba3d_2],
    Material=material_selection_karamba3d,
    Joint=beam_joints_karamba3d,
    LimitDistance_m=0.005)  # -> Model, Info, Mass_kg, CenterOfGravity
panel_42 = Panel(assemble_model_karamba3d.Mass_kg)
analyze_karamba3d = AnalyzeKaramba3D(Model=assemble_model_karamba3d.Model)  # -> CalculatedModel, simplify(MaximumDisplacement_cm), ResultingForceOfGravity_kN, ElasticEnergy_kNm
panel_43 = Panel(analyze_karamba3d.MaximumDisplacement_cm)

# ----
# Viewing
model_view_karamba3d = ModelViewKaramba3D(Model=analyze_karamba3d.CalculatedModel, ResultFactors=1, ResultCase=-1)  # -> Model, DeformedMesh, DeformedAxes, DeformedModel
beam_view_karamba3d = BeamViewKaramba3D(Model=model_view_karamba3d.Model)  # -> Model, MeshesOfRenderedBeams, DeformedBeamAxes, LegendColors, LegendTags

# ----
# Column Displacements
number_slider_5 = Slider(3, range=0..10)
lateral_1 = Slider(1, range=0..1)
panel_44 = Panel("""4
5
6
7""")
beam_displacements_karamba3d = BeamDisplacementsKaramba3D(
    AnalyzedModel=analyze_karamba3d.CalculatedModel,
    BeamIdentifiers=panel_44,
    LoadCase=lateral_1,
    MaximumDistanceBetweenResults_m=-1,
    NumberOfResultsPerElement=number_slider_5)  # -> AnalyzedModel, simplify(flatten(Translations_m)), Rotations_rad
_0_2_is_4_3_5_is_5_6_8_is_6_9_11_is_7_x = Panel(beam_displacements_karamba3d.Translations_m)  # "0-2 is 4, 3-5 is 5, 6-8 is 6, 9-11 is 7 (X,Y,Z)"

column_displacement_x_y_z = Panel(beam_displacements_karamba3d.Translations_m)
panel_45 = Panel(cross_section_selector_karamba3d_3.CrossSection)

panel_47 = Panel(cross_section_selector_karamba3d_4.CrossSection)

# ----
# Load Bearing Beam Displacement
number_slider_6 = Slider(3, range=0..10)
beam_displacements_karamba3d_2 = BeamDisplacementsKaramba3D(
    AnalyzedModel=analyze_karamba3d.CalculatedModel,
    BeamIdentifiers=panel_31,
    LoadCase=vertical_0_2,
    MaximumDistanceBetweenResults_m=-1,
    NumberOfResultsPerElement=number_slider_6)  # -> AnalyzedModel, simplify(flatten(Translations_m)), Rotations_rad
_0_3_are_beam_0_2_3_5_are_beam_1_2_ident = Panel(beam_displacements_karamba3d_2.Translations_m)  # "0-3 are beam 0/2, 3-5 are beam 1/2 (identical)"

# ----
# Non- Load Bearing Beam Displacement
panel_48 = Panel("""0
1""")
beam_displacements_karamba3d_3 = BeamDisplacementsKaramba3D(
    AnalyzedModel=analyze_karamba3d.CalculatedModel,
    BeamIdentifiers=panel_48,
    LoadCase=vertical_0,
    MaximumDistanceBetweenResults_m=-1,
    NumberOfResultsPerElement=Slider(3, range=0..10))  # -> AnalyzedModel, simplify(flatten(Translations_m)), Rotations_rad
_0_3_are_beam_0_3_5_are_beam_1_identical = Panel(beam_displacements_karamba3d_3.Translations_m)

# ----
# Load Bearing Beam Moments
number_slider_7 = Slider(3, range=1..10)
# Optimizing Cross Section Using Karamba
# Load Bearing Beams
# Non-Load Bearing Beams
panel_49 = Panel("""2
3""")
beam_forces_karamba3d = BeamForcesKaramba3D(
    AnalyzedModel=analyze_karamba3d.CalculatedModel,
    BeamIdentifiers=panel_49,
    LCase=-1,
    MaximumDistanceBetweenResults_m=-1,
    NumberOfResultsPerBeamElement=number_slider_7)  # -> AnalyzedModel, NormalForce_kN, ShearForceVz_kN, ShearForceVy_kN, BendingMomentMt_kNm, simplify(BendingMomentMy_kNm), BendingMomentMz_kNm
utilization_of_elements_karamba3d = UtilizationOfElementsKaramba3D(
    AnalyzedModel=beam_forces_karamba3d.AnalyzedModel,
    ElemIdentifiers=panel_49,
    ResultCase=-1,
    NumberOfSamplePoints=3,
    ElasticDesign=True,
    GammaM0=1,
    GammaM1=1,
    WithDetails=False,
    mode="Beams")  # -> AnalyzedModel, Utilization, SigMax_kN_cm2, SigMin_kN_cm2, TauMax_kN_cm2, UtilN, UtilVy, UtilVz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
list_item_5 = ListItem(List=utilization_of_elements_karamba3d.UtilMy, Index=Slider(0, range=0..1), Wrap=True)
panel_50 = Panel(utilization_of_elements_karamba3d.UtilMy)
panel_51 = Panel(beam_forces_karamba3d.BendingMomentMy_kNm)
panel_52 = Panel(utilization_of_elements_karamba3d.Utilization)
panel_53 = Panel(list_item_5)

panel_54 = Panel(cross_section_selector_karamba3d_2.CrossSection)

# ----
# Column Axial Loads
panel_55 = Panel("""4
5
6
7""")
beam_forces_karamba3d_2 = BeamForcesKaramba3D(
    AnalyzedModel=analyze_karamba3d.CalculatedModel,
    BeamIdentifiers=panel_55,
    LCase=-1,
    MaximumDistanceBetweenResults_m=-1,
    NumberOfResultsPerBeamElement=Slider(3, range=0..10))  # -> AnalyzedModel, simplify(NormalForce_kN), ShearForceVz_kN, ShearForceVy_kN, BendingMomentMt_kNm, BendingMomentMy_kNm, BendingMomentMz_kNm
utilization_of_elements_karamba3d_2 = UtilizationOfElementsKaramba3D(
    AnalyzedModel=beam_forces_karamba3d_2.AnalyzedModel,
    ElemIdentifiers=panel_55,
    ResultCase=-1,
    NumberOfSamplePoints=3,
    ElasticDesign=True,
    GammaM0=1,
    GammaM1=1,
    WithDetails=False,
    mode="Beams")  # -> AnalyzedModel, Utilization, SigMax_kN_cm2, SigMin_kN_cm2, TauMax_kN_cm2, UtilN, UtilVy, UtilVz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
panel_56 = Panel(beam_forces_karamba3d_2.NormalForce_kN)
panel_57 = Panel(utilization_of_elements_karamba3d_2.UtilN)

# ----
# Non-Load Bearing Beam Moments
number_slider_8 = Slider(3, range=0..10)
panel_58 = Panel("""0
1""")
beam_forces_karamba3d_3 = BeamForcesKaramba3D(
    AnalyzedModel=analyze_karamba3d.CalculatedModel,
    BeamIdentifiers=panel_58,
    LCase=-1,
    MaximumDistanceBetweenResults_m=-1,
    NumberOfResultsPerBeamElement=number_slider_8)  # -> AnalyzedModel, NormalForce_kN, ShearForceVz_kN, ShearForceVy_kN, BendingMomentMt_kNm, simplify(BendingMomentMy_kNm), simplify(BendingMomentMz_kNm)
utilization_of_elements_karamba3d_3 = UtilizationOfElementsKaramba3D(
    AnalyzedModel=beam_forces_karamba3d_3.AnalyzedModel,
    ElemIdentifiers=panel_58,
    ResultCase=-1,
    NumberOfSamplePoints=3,
    ElasticDesign=True,
    GammaM0=1,
    GammaM1=1,
    WithDetails=False,
    mode="Beams")  # -> AnalyzedModel, Utilization, SigMax_kN_cm2, SigMin_kN_cm2, TauMax_kN_cm2, UtilN, UtilVy, UtilVz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
list_item_6 = ListItem(List=utilization_of_elements_karamba3d_3.UtilMy, Index=Slider(2, range=2..3), Wrap=True)
panel_59 = Panel(utilization_of_elements_karamba3d_3.UtilMy)
panel_60 = Panel(utilization_of_elements_karamba3d_3.Utilization)
panel_61 = Panel(beam_forces_karamba3d_3.BendingMomentMy_kNm)
panel_62 = Panel(list_item_6)

panel_63 = Panel(cross_section_selector_karamba3d.CrossSection)

# ----
# Bracing Axial Loads
number_slider_9 = Slider(3, range=0..10)
panel_66 = Panel("""8
9
10
11""")
beam_forces_karamba3d_4 = BeamForcesKaramba3D(
    AnalyzedModel=analyze_karamba3d.CalculatedModel,
    BeamIdentifiers=panel_66,
    LCase=-1,
    MaximumDistanceBetweenResults_m=-1,
    NumberOfResultsPerBeamElement=number_slider_9)  # -> AnalyzedModel, NormalForce_kN, ShearForceVz_kN, ShearForceVy_kN, BendingMomentMt_kNm, BendingMomentMy_kNm, BendingMomentMz_kNm
utilization_of_elements_karamba3d_4 = UtilizationOfElementsKaramba3D(
    AnalyzedModel=beam_forces_karamba3d_4.AnalyzedModel,
    ElemIdentifiers=panel_66,
    ResultCase=-1,
    NumberOfSamplePoints=3,
    ElasticDesign=True,
    GammaM0=1,
    GammaM1=1,
    WithDetails=False,
    mode="Beams")  # -> AnalyzedModel, Utilization, SigMax_kN_cm2, SigMin_kN_cm2, TauMax_kN_cm2, UtilN, UtilVy, UtilVz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
panel_67 = Panel(utilization_of_elements_karamba3d_4.UtilN)
panel_68 = Panel(beam_forces_karamba3d_4.NormalForce_kN)

# ----
# Test Data
# "Moment Z"
# Column Moments
# Bracing Moments
# Non-Load Bearing Beam Moments
# Load Bearing Beam Moments
panel_69 = Panel(beam_forces_karamba3d.BendingMomentMy_kNm)
panel_70 = Panel(beam_forces_karamba3d_3.BendingMomentMy_kNm)
flatten_tree_2 = FlattenTree(Tree=panel_69, Path="{0}")
panel_71 = Panel("""1
4""")
flatten_tree_3 = FlattenTree(Tree=panel_70, Path="{0}")
list_item_7 = ListItem(List=flatten_tree_3, Index=panel_71, Wrap=True)
panel_72 = Panel(beam_forces_karamba3d_2.BendingMomentMy_kNm)
list_item_8 = ListItem(List=flatten_tree_2, Index=panel_71, Wrap=True)
panel_73 = Panel("""1
4
7
10""")
flatten_tree_4 = FlattenTree(Tree=panel_72, Path="{0}")
list_item_9 = ListItem(List=flatten_tree_4, Index=panel_73, Wrap=True)
panel_74 = Panel(flatten_tree_4)
panel_75 = Panel(beam_forces_karamba3d_4.BendingMomentMy_kNm)
flatten_tree_5 = FlattenTree(Tree=panel_75, Path="{0}")
list_item_10 = ListItem(List=flatten_tree_5, Index=panel_73, Wrap=True)
merge_7 = Merge(Data1=list_item_10, Data2=list_item_9, Data3=list_item_7, Data4=list_item_8)  # -> flatten(Result)
absolute_7 = Absolute(Value=merge_7)
panel_76 = Panel(merge_7)
panel_77 = Panel(absolute_7)
ghpython_script_6 = GhPythonScript(x=panel_77)  # -> out, a; inputs x: list
# ---------- ghpython_script_6: Python ----------
a=[]
for i in range(12):
    
    if x[i]==0:
        a.append("None")
    elif 0<x[i]<=5:
        a.append("Low")
    elif x[i]>5:
        a.append("High")
print(a)
# ---------- end ghpython_script_6 ----------

moment_z = Panel(ghpython_script_6.a)
entwine_2 = Entwine(Branch00=orientation, Branch01=moment_z, FlattenInputs=True)
flip_matrix = FlipMatrix(Data=entwine_2)
# Naive Bayes Classifcation
test_data = Panel(flip_matrix)

naive_bayes_classification = NaiveBayesClassification(TestData=test_data, TrainingData=create_datatable, InputColumnNames=panel_24, OutputColumnName=panel_22, RandomSeed=5)  # -> flatten(Result), Numeric, Probabilities
panel_78 = Panel(naive_bayes_classification.Result)
construct_domain = ConstructDomain(DomainStart=Slider(0, range=0..100), DomainEnd=Slider(100, range=0..100))
remap_numbers = RemapNumbers(Value=naive_bayes_classification.Probabilities, Source=Domain(0, 1), Target=construct_domain)  # -> Mapped, Clipped
panel_79 = Panel(remap_numbers.Mapped)
cull_index = CullIndex(List=panel_79, Indices=Slider(0, range=0..100), Wrap=True)
panel_80 = Panel(cull_index)
concatenate = Concatenate(FragmentA=panel_80, FragmentB="%")
panel_81 = Panel(concatenate)
panel_82 = Panel("""Beam
Column
Brace""")

panel_83 = Panel(beam_forces_karamba3d.NormalForce_kN)
panel_84 = Panel(beam_forces_karamba3d_2.BendingMomentMy_kNm)
panel_85 = Panel(beam_forces_karamba3d_3.NormalForce_kN)

# ----
# Columns, Lateral Deflection X
panel_86 = Panel("1000")
multiplication_3 = Multiplication(A=number_slider_2, B=panel_86)
division = Division(A=multiplication_3, B=Slider(400, range=0..1000))
panel_87 = Panel(multiplication_3)
panel_88 = Panel(division)
list_item_11 = ListItem(List=beam_displacements_karamba3d.Translations_m, Index=Slider(1, range=0..11), Wrap=True)
list_item_12 = ListItem(List=beam_displacements_karamba3d.Translations_m, Index=Slider(7, range=0..11), Wrap=True)
list_item_13 = ListItem(List=beam_displacements_karamba3d.Translations_m, Index=Slider(10, range=0..11), Wrap=True)
list_item_14 = ListItem(List=beam_displacements_karamba3d.Translations_m, Index=Slider(4, range=0..11), Wrap=True)
panel_89 = Panel(list_item_11)
panel_90 = Panel(list_item_12)
panel_91 = Panel(list_item_13)
panel_92 = Panel(list_item_14)
deconstruct_vector_6 = DeconstructVector(Vector=list_item_11)  # -> XComponent, YComponent, ZComponent
deconstruct_vector_7 = DeconstructVector(Vector=list_item_12)  # -> XComponent, YComponent, ZComponent
deconstruct_vector_8 = DeconstructVector(Vector=list_item_13)  # -> XComponent, YComponent, ZComponent
deconstruct_vector_9 = DeconstructVector(Vector=list_item_14)  # -> XComponent, YComponent, ZComponent
panel_93 = Panel(deconstruct_vector_6.XComponent)
panel_94 = Panel(deconstruct_vector_7.XComponent)
panel_95 = Panel(deconstruct_vector_8.XComponent)
panel_96 = Panel(deconstruct_vector_9.XComponent)
converting_to_mm = Panel("-1000")
converting_to_mm_2 = Panel("-1000")
converting_to_mm_3 = Panel("-1000")
converting_to_mm_4 = Panel("-1000")
multiplication_4 = Multiplication(A=converting_to_mm, B=deconstruct_vector_6.XComponent)
multiplication_5 = Multiplication(A=converting_to_mm_2, B=deconstruct_vector_7.XComponent)
multiplication_6 = Multiplication(A=converting_to_mm_3, B=deconstruct_vector_8.XComponent)
multiplication_7 = Multiplication(A=converting_to_mm_4, B=deconstruct_vector_9.XComponent)
panel_97 = Panel(multiplication_4)
absolute_8 = Absolute(Value=multiplication_4)
panel_98 = Panel(multiplication_5)
panel_99 = Panel(multiplication_6)
panel_100 = Panel(multiplication_7)
absolute_9 = Absolute(Value=multiplication_5)
absolute_10 = Absolute(Value=multiplication_6)
absolute_11 = Absolute(Value=multiplication_7)
smaller_than = SmallerThan(FirstNumber=absolute_8, SecondNumber=division)  # -> SmallerThan, OrEqualTo
smaller_than_2 = SmallerThan(FirstNumber=absolute_9, SecondNumber=division)  # -> SmallerThan, OrEqualTo
smaller_than_3 = SmallerThan(FirstNumber=absolute_10, SecondNumber=division)  # -> SmallerThan, OrEqualTo
smaller_than_4 = SmallerThan(FirstNumber=absolute_11, SecondNumber=division)  # -> SmallerThan, OrEqualTo
panel_101 = Panel(smaller_than.SmallerThan)
panel_102 = Panel(smaller_than_2.SmallerThan)
panel_103 = Panel(smaller_than_3.SmallerThan)
panel_104 = Panel(smaller_than_4.SmallerThan)
gate_and = GateAnd(A=smaller_than.SmallerThan, B=smaller_than_4.SmallerThan, C=smaller_than_2.SmallerThan, D=smaller_than_3.SmallerThan)
panel_105 = Panel(gate_and)

# ----
# Columns, Lateral Deflection Y
panel_106 = Panel("1000")
multiplication_8 = Multiplication(A=number_slider_2, B=panel_106)
division_2 = Division(A=multiplication_8, B=Slider(400, range=0..1000))
panel_107 = Panel(division_2)
list_item_15 = ListItem(List=beam_displacements_karamba3d.Translations_m, Index=Slider(1, range=0..11), Wrap=True)
list_item_16 = ListItem(List=beam_displacements_karamba3d.Translations_m, Index=Slider(7, range=0..11), Wrap=True)
list_item_17 = ListItem(List=beam_displacements_karamba3d.Translations_m, Index=Slider(10, range=0..11), Wrap=True)
list_item_18 = ListItem(List=beam_displacements_karamba3d.Translations_m, Index=Slider(4, range=0..11), Wrap=True)
panel_108 = Panel(list_item_15)
panel_109 = Panel(list_item_16)
panel_110 = Panel(list_item_17)
panel_111 = Panel(list_item_18)
deconstruct_vector_10 = DeconstructVector(Vector=list_item_15)  # -> XComponent, YComponent, ZComponent
deconstruct_vector_11 = DeconstructVector(Vector=list_item_16)  # -> XComponent, YComponent, ZComponent
deconstruct_vector_12 = DeconstructVector(Vector=list_item_17)  # -> XComponent, YComponent, ZComponent
deconstruct_vector_13 = DeconstructVector(Vector=list_item_18)  # -> XComponent, YComponent, ZComponent
panel_112 = Panel(deconstruct_vector_10.YComponent)
panel_113 = Panel(deconstruct_vector_11.YComponent)
panel_114 = Panel(deconstruct_vector_12.YComponent)
panel_115 = Panel(deconstruct_vector_13.YComponent)
converting_to_mm_5 = Panel("-1000")
converting_to_mm_6 = Panel("-1000")
converting_to_mm_7 = Panel("-1000")
converting_to_mm_8 = Panel("-1000")
multiplication_9 = Multiplication(A=converting_to_mm_5, B=deconstruct_vector_10.YComponent)
multiplication_10 = Multiplication(A=converting_to_mm_6, B=deconstruct_vector_11.YComponent)
multiplication_11 = Multiplication(A=converting_to_mm_7, B=deconstruct_vector_12.YComponent)
multiplication_12 = Multiplication(A=converting_to_mm_8, B=deconstruct_vector_13.YComponent)
panel_116 = Panel(multiplication_9)
absolute_12 = Absolute(Value=multiplication_9)
panel_117 = Panel(multiplication_10)
panel_118 = Panel(multiplication_11)
panel_119 = Panel(multiplication_12)
absolute_13 = Absolute(Value=multiplication_10)
absolute_14 = Absolute(Value=multiplication_11)
absolute_15 = Absolute(Value=multiplication_12)
smaller_than_5 = SmallerThan(FirstNumber=absolute_12, SecondNumber=division_2)  # -> SmallerThan, OrEqualTo
smaller_than_6 = SmallerThan(FirstNumber=absolute_13, SecondNumber=division_2)  # -> SmallerThan, OrEqualTo
smaller_than_7 = SmallerThan(FirstNumber=absolute_14, SecondNumber=division_2)  # -> SmallerThan, OrEqualTo
smaller_than_8 = SmallerThan(FirstNumber=absolute_15, SecondNumber=division_2)  # -> SmallerThan, OrEqualTo
panel_120 = Panel(smaller_than_5.SmallerThan)
panel_121 = Panel(smaller_than_6.SmallerThan)
panel_122 = Panel(smaller_than_7.SmallerThan)
panel_123 = Panel(smaller_than_8.SmallerThan)
gate_and_2 = GateAnd(A=smaller_than_5.SmallerThan, B=smaller_than_8.SmallerThan, C=smaller_than_6.SmallerThan, D=smaller_than_7.SmallerThan)
panel_124 = Panel(gate_and_2)

# ----
# Load Bearing Beams Vertical Deflection
# Non-Load Bearing Beams Vertical Deflection
number_slider_10 = Slider(1, range=0..5)
list_item_19 = ListItem(List=beam_displacements_karamba3d_2.Translations_m, Index=number_slider_10, Wrap=True)
list_item_20 = ListItem(List=beam_displacements_karamba3d_3.Translations_m, Index=Slider(1, range=0..5), Wrap=True)
panel_125 = Panel(list_item_19)
panel_126 = Panel(list_item_20)
multiplication_13 = Multiplication(A=number_slider_3, B="1000")
deconstruct_vector_14 = DeconstructVector(Vector=list_item_19)  # -> XComponent, YComponent, ZComponent
deconstruct_vector_15 = DeconstructVector(Vector=list_item_20)  # -> XComponent, YComponent, ZComponent
division_3 = Division(A=multiplication_13, B=Slider(360, range=0..1000))
multiplication_14 = Multiplication(A=number_slider, B="1000")
panel_127 = Panel(deconstruct_vector_14.ZComponent)
panel_128 = Panel(deconstruct_vector_15.ZComponent)
panel_129 = Panel(division_3)
division_4 = Division(A=multiplication_14, B=Slider(360, range=0..1000))
converting_to_m = Panel("-1000")
panel_130 = Panel(division_4)
converting_to_m_2 = Panel("-1000")
multiplication_15 = Multiplication(A=converting_to_m, B=deconstruct_vector_14.ZComponent)
panel_131 = Panel(multiplication_15)
multiplication_16 = Multiplication(A=converting_to_m_2, B=deconstruct_vector_15.ZComponent)
panel_132 = Panel(multiplication_16)
smaller_than_9 = SmallerThan(FirstNumber=multiplication_15, SecondNumber=division_3)  # -> SmallerThan, OrEqualTo
panel_133 = Panel(smaller_than_9.SmallerThan)
smaller_than_10 = SmallerThan(FirstNumber=multiplication_16, SecondNumber=division_4)  # -> SmallerThan, OrEqualTo
panel_134 = Panel(smaller_than_10.SmallerThan)

# ----
# Load Bearing Beams
# Non-Load Bearing Beams
# Columns
# Braces
number_slider_11 = Slider(1, range=0..3)
list_item_21 = ListItem(List=panel_57, Index=Slider(0, range=0..3), Wrap=True)
list_item_22 = ListItem(List=panel_57, Index=Slider(2, range=0..3), Wrap=True)
list_item_23 = ListItem(List=panel_57, Index=number_slider_11, Wrap=True)
list_item_24 = ListItem(List=panel_67, Index=Slider(0, range=0..3), Wrap=True)
list_item_25 = ListItem(List=panel_67, Index=Slider(2, range=0..3), Wrap=True)
list_item_26 = ListItem(List=panel_57, Index=Slider(3, range=0..3), Wrap=True)
list_item_27 = ListItem(List=panel_67, Index=Slider(1, range=0..3), Wrap=True)
list_item_28 = ListItem(List=panel_67, Index=Slider(3, range=0..3), Wrap=True)
number_slider_12 = Slider(1, range=0..1)
# Fitness Function 2
number_slider_13 = Slider(1, range=0..1)
number_slider_14 = Slider(1, range=0..1)
smaller_than_11 = SmallerThan(FirstNumber=list_item_6, SecondNumber=Slider(1, range=0..1))  # -> SmallerThan, OrEqualTo
smaller_than_12 = SmallerThan(FirstNumber=list_item_23, SecondNumber=number_slider_12)  # -> SmallerThan, OrEqualTo
smaller_than_13 = SmallerThan(FirstNumber=list_item_21, SecondNumber=number_slider_12)  # -> SmallerThan, OrEqualTo
smaller_than_14 = SmallerThan(FirstNumber=list_item_26, SecondNumber=number_slider_12)  # -> SmallerThan, OrEqualTo
smaller_than_15 = SmallerThan(FirstNumber=list_item_22, SecondNumber=number_slider_12)  # -> SmallerThan, OrEqualTo
smaller_than_16 = SmallerThan(FirstNumber=list_item_5, SecondNumber=number_slider_13)  # -> SmallerThan, OrEqualTo
smaller_than_17 = SmallerThan(FirstNumber=list_item_27, SecondNumber=number_slider_14)  # -> SmallerThan, OrEqualTo
smaller_than_18 = SmallerThan(FirstNumber=list_item_24, SecondNumber=number_slider_14)  # -> SmallerThan, OrEqualTo
smaller_than_19 = SmallerThan(FirstNumber=list_item_28, SecondNumber=number_slider_14)  # -> SmallerThan, OrEqualTo
smaller_than_20 = SmallerThan(FirstNumber=list_item_25, SecondNumber=number_slider_14)  # -> SmallerThan, OrEqualTo
panel_135 = Panel(smaller_than_11.SmallerThan)
panel_136 = Panel(smaller_than_16.SmallerThan)
gate_and_3 = GateAnd(
    A=smaller_than_13.SmallerThan,
    B=smaller_than_12.SmallerThan,
    C=smaller_than_15.SmallerThan,
    D=smaller_than_14.SmallerThan)
gate_and_4 = GateAnd(
    A=smaller_than_18.SmallerThan,
    B=smaller_than_17.SmallerThan,
    C=smaller_than_20.SmallerThan,
    D=smaller_than_19.SmallerThan)
panel_137 = Panel(gate_and_3)
panel_138 = Panel(gate_and_4)

penalty_factor_p = Panel("""1000000
1""")
list_item_29 = ListItem(List=penalty_factor_p, Index=panel_137, Wrap=True)
list_item_30 = ListItem(List=penalty_factor_p, Index=smaller_than_16.SmallerThan, Wrap=True)
list_item_31 = ListItem(List=penalty_factor_p, Index=panel_138, Wrap=True)
list_item_32 = ListItem(List=penalty_factor_p, Index=smaller_than_11.SmallerThan, Wrap=True)
panel_139 = Panel(list_item_29)
list_item_33 = ListItem(List=penalty_factor_p, Index=smaller_than_9.SmallerThan, Wrap=True)
panel_140 = Panel(list_item_30)
panel_141 = Panel(list_item_31)
panel_142 = Panel(list_item_32)
list_item_34 = ListItem(List=penalty_factor_p, Index=smaller_than_10.SmallerThan, Wrap=True)
list_item_35 = ListItem(List=penalty_factor_p, Index=gate_and, Wrap=True)
panel_143 = Panel(list_item_33)
list_item_36 = ListItem(List=penalty_factor_p, Index=gate_and_2, Wrap=True)
panel_144 = Panel(list_item_34)
panel_145 = Panel(list_item_35)
panel_146 = Panel(list_item_36)

# ----
# 1. Optimize Beam Sizes
multiplication_17 = Multiplication(A=assemble_model_karamba3d.Mass_kg, B=list_item_33)
multiplication_18 = Multiplication(A=multiplication_17, B=list_item_34)
multiplication_19 = Multiplication(A=multiplication_18, B=list_item_30)
multiplication_20 = Multiplication(A=multiplication_19, B=list_item_32)
panel_147 = Panel(multiplication_20)
galapagos = Galapagos(fitness=multiplication_20, gene=[name_or_list_of_index_of_cross_section_f_2, name_or_list_of_index_of_cross_section_f])
galapagos_listener = GalapagosListener(
    Genomes=[name_or_list_of_index_of_cross_section_f, name_or_list_of_index_of_cross_section_f_2],
    Fitness=multiplication_20,
    Reset=Toggle(False))  # -> Fitness, Iterations
panel_148 = Panel(galapagos_listener.Iterations)
panel_149 = Panel(galapagos_listener.Fitness)

# ----
# 2. Optimize Bracing and Column Sizes
multiplication_21 = Multiplication(A=multiplication_20, B=list_item_35)
multiplication_22 = Multiplication(A=multiplication_21, B=list_item_36)
multiplication_23 = Multiplication(A=multiplication_22, B=list_item_29)
multiplication_24 = Multiplication(A=multiplication_23, B=list_item_31)
galapagos_2 = Galapagos(fitness=multiplication_24, gene=[name_or_list_of_index_of_cross_section_f_3, name_or_list_of_index_of_cross_section_f_4])
panel_150 = Panel(multiplication_24)
galapagos_listener_2 = GalapagosListener(
    Genomes=[name_or_list_of_index_of_cross_section_f_3, name_or_list_of_index_of_cross_section_f_4],
    Fitness=multiplication_24,
    Reset=Toggle(False))  # -> Fitness, Iterations
panel_151 = Panel(galapagos_listener_2.Iterations)
panel_152 = Panel(galapagos_listener_2.Fitness)

# ----
# Key Structural Results
ult_load_bearing = Panel(list_item_5)
column_ults = Panel(panel_57)
bracing_ults = Panel(panel_67)
bracing_numbering = Panel("""8
9
10
11""")
column_numbering = Panel("""4
5
6
7""")
all_lateral_delfc_x_satisfied = Panel(panel_105)
defl_load_bearing = Panel(panel_131)
defl_non_load_bearing = Panel(panel_132)
defl_limit_load_bear = Panel(panel_129)
defl_limit_non_load_bearing = Panel(panel_130)
all_lateral_delfc_y_satisfied = Panel(panel_124)
panel_154 = Panel(panel_45)
panel_155 = Panel(panel_47)
