# Grasshopper definition FRAME(with wind loads)adjust1-lunchboxML-unsupervised and supervised NN.gh (Grasshopper 1.0.7)
# plug-ins: karambaGH, TT Toolbox, LunchBoxML

# ----
# Lines and Nodes
point = Point(Point(0, 0, 0))
deconstruct = Deconstruct(Point=point)  # -> XComponent, YComponent, ZComponent
number_slider = Slider(7, range=0..20)
number_slider_2 = Slider(5, range=0..20)
number_slider_3 = Slider(10, range=0..30)
number_slider_4 = Slider(7, range=0..30)
addition = Addition(A=deconstruct.ZComponent, B=Slider(5, range=0..20))
addition_2 = Addition(A=deconstruct.XComponent, B=number_slider)
construct_point = ConstructPoint(XCoordinate=deconstruct.XComponent, YCoordinate=deconstruct.YComponent, ZCoordinate=addition)
deconstruct_2 = Deconstruct(Point=construct_point)  # -> XComponent, YComponent, ZComponent
addition_3 = Addition(A=deconstruct_2.YComponent, B=number_slider_3)
construct_point_2 = ConstructPoint(XCoordinate=Slider(0, range=0..30), YCoordinate=Slider(10, range=0..30), ZCoordinate=Slider(0, range=0..30))
construct_point_3 = ConstructPoint(XCoordinate=addition_2, YCoordinate=deconstruct.YComponent, ZCoordinate=deconstruct.ZComponent)
deconstruct_3 = Deconstruct(Point=construct_point_3)  # -> XComponent, YComponent, ZComponent
addition_4 = Addition(A=deconstruct_3.ZComponent, B=number_slider_2)
construct_point_4 = ConstructPoint(XCoordinate=deconstruct_3.XComponent, YCoordinate=deconstruct_3.YComponent, ZCoordinate=addition_4)
deconstruct_4 = Deconstruct(Point=construct_point_4)  # -> XComponent, YComponent, ZComponent
addition_5 = Addition(A=deconstruct_4.YComponent, B=Slider(10, range=0..30))
construct_point_5 = ConstructPoint(XCoordinate=deconstruct_2.XComponent, YCoordinate=addition_3, ZCoordinate=deconstruct_2.ZComponent)
construct_point_6 = ConstructPoint(XCoordinate=number_slider_4, YCoordinate=Slider(10, range=0..30), ZCoordinate=Slider(0, range=0..30))
construct_point_7 = ConstructPoint(XCoordinate=deconstruct_4.XComponent, YCoordinate=addition_5, ZCoordinate=deconstruct_4.ZComponent)
line = Line(StartPoint=construct_point, EndPoint=construct_point_4)
line_2 = Line(StartPoint=construct_point, EndPoint=construct_point_5)
line_3 = Line(StartPoint=construct_point_5, EndPoint=construct_point_7)
line_4 = Line(StartPoint=construct_point_4, EndPoint=construct_point_7)
line_5 = Line(StartPoint=point, EndPoint=construct_point)
line_6 = Line(StartPoint=construct_point_3, EndPoint=construct_point_4)
line_7 = Line(StartPoint=construct_point_7, EndPoint=construct_point_6)
line_8 = Line(StartPoint=construct_point_5, EndPoint=construct_point_2)

# ----
# Support  Nodes
point_2 = Point([point, construct_point_2, construct_point_6, construct_point_3])

# ----
# Truss Diagonal Braces
line_9 = Line(StartPoint=construct_point, EndPoint=construct_point_3)
line_10 = Line(StartPoint=construct_point_5, EndPoint=construct_point_6)
line_11 = Line(StartPoint=construct_point, EndPoint=construct_point_2)
line_12 = Line(StartPoint=construct_point_4, EndPoint=construct_point_6)
point_3 = Point([construct_point, construct_point_3, construct_point_4, construct_point_5, construct_point_7, construct_point_6, construct_point_2, point])

# ----
# Pinned Joint Connections
beam_joints_karamba3d = BeamJointsKaramba3D(
    ElementIdentifiers="Non-Load Bearing Beams",
    CtKNMAtStartingNode=Vector(0, 0, 0),
    CrKNmRadAtStartingNode=Vector(0, 0, 0),
    CtKNMAtEndNode=Vector(0, 0, 0),
    CrKNmRadAtEndNode=Vector(0, 0, 0),
    menu=[buttons(off, off, off, off, on, on), buttons(off, off, off, off, on, on)])
panel = Panel(beam_joints_karamba3d)

name_or_list_of_index_of_materials = Slider(0, range=0..116)
read_material_table_from_file_karamba3d = ReadMaterialTableFromFileKaramba3D()
material_selection_karamba3d = MaterialSelectionKaramba3D(
    Materials=read_material_table_from_file_karamba3d,
    NameOrListIndexOfMaterial=name_or_list_of_index_of_materials,
    menu=[dropdown(1), dropdown(1)])
panel_2 = Panel(material_selection_karamba3d)
disassemble_material_karamba3d = DisassembleMaterialKaramba3D(Material=material_selection_karamba3d)  # -> Material, TypeOfMaterial, FamilyNameOfMaterial, NameOfMaterial, ElemIdentifiers, Color, YoungsModulusKNCm2Dir12, InPlaneShearModulus_kN_cm2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
panel_3 = Panel(disassemble_material_karamba3d.SpecificWeight_kN_m3)

# ----
# Wind Loads UDL
wind_load_p_kpa = Slider(3, range=-5..5)
wind_load_p_kpa_2 = Slider(3, range=-5..5)
multiplication = Multiplication(A=wind_load_p_kpa, B=number_slider_4)
multiplication_2 = Multiplication(A=wind_load_p_kpa_2, B=number_slider_3)
panel_4 = Panel("""4
5""")
unit_y = UnitY(Factor=multiplication)
panel_5 = Panel("""4
7""")
unit_x = UnitX(Factor=multiplication_2)
loads_karamba3d = LoadsKaramba3D(Vector=unit_y, BeamIdentifiers=panel_4, LCase="1", mode="Uniform Line", menu=[buttons(off, on, off)])
loads_karamba3d_2 = LoadsKaramba3D(Vector=unit_x, BeamIdentifiers=panel_5, LCase="1", mode="Uniform Line", menu=[buttons(off, on, off)])

# ----
# Live Loads UDL
live_load_load_bearing = Slider(-10, range=-50..0)
live_load_non_load_bearing = Slider(-10, range=-50..0)
panel_6 = Panel("""2
3""")
panel_7 = Panel("""0
1""")
unit_z = UnitZ(Factor=live_load_load_bearing)
unit_z_2 = UnitZ(Factor=live_load_non_load_bearing)
loads_karamba3d_3 = LoadsKaramba3D(Vector=unit_z, BeamIdentifiers=panel_6, LCase=" 0", mode="Uniform Line", menu=[buttons(off, on, off)])
loads_karamba3d_4 = LoadsKaramba3D(Vector=unit_z_2, BeamIdentifiers=panel_7, LCase=" 0", mode="Uniform Line", menu=[buttons(off, on, off)])
panel_8 = Panel(loads_karamba3d_3)
panel_9 = Panel(loads_karamba3d_4)

# ----
# Fixed Supports
# Relase Rx and Rz to make Pinned Supports
support_karamba3d = SupportKaramba3D(PosInd=point_2, menu=[buttons(on, on, on, on, on, on)])

vertical_0 = Slider(0, range=0..1)
panel_10 = Panel("""2
3""")
vertical_0_2 = Slider(0, range=0..1)
# Member Name: Brace
# Brace
# Brace
# Brace
# Col
# Col
# Col
# Col
# Non-load beam
# Non-load beam
# Load beam
# Load Beam
member_index = Panel("""0
1
2
3
4
5
6
7
8
9
10
11""")
construct_point_8 = ConstructPoint(XCoordinate=0, YCoordinate=0, ZCoordinate=0)

# ----
# 7m Bearing Beams (non load bearing)
line_13 = Line([line_3, line])
cross_section_range_selector_karamba3d = CrossSectionRangeSelectorKaramba3D(MaximumHeight_cm=-1, MaximumWidth_cm=-1, menu=[dropdown(7), dropdown(1), dropdown(4)])

# ----
# Genes
name_or_list_of_index_of_cross_section_f = Slider(163, range=0..270)  # "Name or list of index of cross section FOR NON LOAD BEARING BEAMS"

cross_section_selector_karamba3d = CrossSectionSelectorKaramba3D(
    CrossSections=cross_section_range_selector_karamba3d,
    NameOrListIndexOfCrossSection=name_or_list_of_index_of_cross_section_f)  # -> CrossSection, Info
disassemble_cross_section_karamba3d = DisassembleCrossSectionKaramba3D(CroSec=cross_section_selector_karamba3d.CrossSection)  # -> CrossSection, FamilyNameOfCrossSection, TypeNameOfCrossSection, ElemIdentifiers, Color, Material, LocalEccentricity_cm, Heights_cm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
panel_11 = Panel(disassemble_cross_section_karamba3d.Area_cm2)
panel_12 = Panel(disassemble_cross_section_karamba3d.CrossSection)
panel_13 = Panel(disassemble_cross_section_karamba3d.Wely_cm3)
line_to_beam_karamba3d = LineToBeamKaramba3D(
    Line=line_13,
    Identifier="Non-Load Bearing Beams",
    CrossSection=cross_section_selector_karamba3d.CrossSection,
    New=True,
    Remove=True,
    LimitDistance_m=0.005)  # -> Element, Points, Info

# ----
# 10m Beams (Load Bearing)
line_14 = Line([line_2, line_4])
cross_section_range_selector_karamba3d_2 = CrossSectionRangeSelectorKaramba3D(MaximumHeight_cm=-1, MaximumWidth_cm=-1, menu=[dropdown(7), dropdown(1), dropdown(4)])

# ----
# Genes
name_or_list_of_index_of_cross_section_f_2 = Slider(195, range=0..270)  # "Name or list of index of cross section FOR LOAD BEARING BEAMS"

cross_section_selector_karamba3d_2 = CrossSectionSelectorKaramba3D(
    CrossSections=cross_section_range_selector_karamba3d_2,
    NameOrListIndexOfCrossSection=name_or_list_of_index_of_cross_section_f_2)  # -> CrossSection, Info
disassemble_cross_section_karamba3d_2 = DisassembleCrossSectionKaramba3D(CroSec=cross_section_selector_karamba3d_2.CrossSection)  # -> CrossSection, FamilyNameOfCrossSection, TypeNameOfCrossSection, ElemIdentifiers, Color, Material, LocalEccentricity_cm, Heights_cm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
panel_14 = Panel(disassemble_cross_section_karamba3d_2.CrossSection)
panel_15 = Panel(disassemble_cross_section_karamba3d_2.Area_cm2)
panel_16 = Panel(disassemble_cross_section_karamba3d_2.Wely_cm3)
line_to_beam_karamba3d_2 = LineToBeamKaramba3D(
    Line=line_14,
    Identifier="Load Bearing Beams",
    CrossSection=cross_section_selector_karamba3d_2.CrossSection,
    New=True,
    Remove=True,
    LimitDistance_m=0.005)  # -> Element, Points, Info

# ----
# Ridged Joint Connections
beam_joints_karamba3d_2 = BeamJointsKaramba3D(
    ElementIdentifiers=line_to_beam_karamba3d_2.Element,
    CtKNMAtStartingNode=Vector(0, 0, 0),
    CrKNmRadAtStartingNode=Vector(0, 0, 0),
    CtKNMAtEndNode=Vector(0, 0, 0),
    CrKNmRadAtEndNode=Vector(0, 0, 0),
    menu=[buttons(off, off, off, off, off, off), buttons(off, off, off, off, off, off)])
panel_17 = Panel(beam_joints_karamba3d_2)

# ----
# Genes
name_or_list_of_index_of_cross_section_f_3 = Slider(221, range=0..270)  # "Name or list of index of cross section FOR COLUMNS"

# ----
# Columns
line_15 = Line([line_5, line_6, line_7, line_8])
cross_section_range_selector_karamba3d_3 = CrossSectionRangeSelectorKaramba3D(MaximumHeight_cm=-1, MaximumWidth_cm=-1, menu=[dropdown(7), dropdown(1), dropdown(4)])
cross_section_selector_karamba3d_3 = CrossSectionSelectorKaramba3D(
    CrossSections=cross_section_range_selector_karamba3d_3,
    NameOrListIndexOfCrossSection=name_or_list_of_index_of_cross_section_f_3)  # -> CrossSection, Info
disassemble_cross_section_karamba3d_3 = DisassembleCrossSectionKaramba3D(CroSec=cross_section_selector_karamba3d_3.CrossSection)  # -> CrossSection, FamilyNameOfCrossSection, TypeNameOfCrossSection, ElemIdentifiers, Color, Material, LocalEccentricity_cm, Heights_cm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
panel_18 = Panel(disassemble_cross_section_karamba3d_3.Area_cm2)
line_to_beam_karamba3d_3 = LineToBeamKaramba3D(
    Line=line_15,
    Identifier="Columns",
    CrossSection=cross_section_selector_karamba3d_3.CrossSection,
    New=True,
    Remove=True,
    LimitDistance_m=0.005)  # -> Element, Points, Info

# ----
# Column Joint Connections
beam_joints_karamba3d_3 = BeamJointsKaramba3D(
    ElementIdentifiers=line_to_beam_karamba3d_3.Element,
    CtKNMAtStartingNode=Vector(0, 0, 0),
    CrKNmRadAtStartingNode=Vector(0, 0, 0),
    CtKNMAtEndNode=Vector(0, 0, 0),
    CrKNmRadAtEndNode=Vector(0, 0, 0),
    menu=[buttons(off, off, off, off, off, off), buttons(off, off, off, off, off, off)])
panel_19 = Panel(beam_joints_karamba3d_3)

# ----
# Truss Diagonal Braces
line_16 = Line([line_9, line_10, line_11, line_12])
cross_section_range_selector_karamba3d_4 = CrossSectionRangeSelectorKaramba3D(MaximumHeight_cm=-1, MaximumWidth_cm=-1, menu=[dropdown(7), dropdown(4), dropdown(1)])

# ----
# Genes
name_or_list_of_index_of_cross_section_f_4 = Slider(52, range=0..187)  # "Name or list of index of cross section FOR COLUMNS"

cross_section_selector_karamba3d_4 = CrossSectionSelectorKaramba3D(
    CrossSections=cross_section_range_selector_karamba3d_4,
    NameOrListIndexOfCrossSection=name_or_list_of_index_of_cross_section_f_4)  # -> CrossSection, Info
disassemble_cross_section_karamba3d_4 = DisassembleCrossSectionKaramba3D(CroSec=cross_section_selector_karamba3d_4.CrossSection)  # -> CrossSection, FamilyNameOfCrossSection, TypeNameOfCrossSection, ElemIdentifiers, Color, Material, LocalEccentricity_cm, Heights_cm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
# Columns, Lateral Deflection Y/X (mm)
# Beams, Lateral Deflection X (mm)
# non-load bearing beams
# load bearing beams
panel_20 = Panel(disassemble_cross_section_karamba3d_4.Area_cm2)
line_to_beam_karamba3d_4 = LineToBeamKaramba3D(
    Line=line_16,
    Identifier="Diagonal Braces",
    CrossSection=cross_section_selector_karamba3d_4.CrossSection,
    New=True,
    Remove=True,
    LimitDistance_m=0.005,
    Bending=Toggle(False))  # -> Element, Points, Info

assemble_model_karamba3d = AssembleModelKaramba3D(
    Point=point_3,
    Elem=[line_to_beam_karamba3d.Element, line_to_beam_karamba3d_2.Element, line_to_beam_karamba3d_3.Element, line_to_beam_karamba3d_4.Element],
    Support=support_karamba3d,
    Load=[loads_karamba3d_3, loads_karamba3d_4, loads_karamba3d, loads_karamba3d_2],
    Material=material_selection_karamba3d,
    Joint=beam_joints_karamba3d,
    LimitDistance_m=0.005)  # -> Model, Info, Mass_kg, CenterOfGravity
panel_21 = Panel(assemble_model_karamba3d.Mass_kg)
analyze_karamba3d = AnalyzeKaramba3D(Model=assemble_model_karamba3d.Model)  # -> CalculatedModel, simplify(MaximumDisplacement_cm), ResultingForceOfGravity_kN, ElasticEnergy_kNm
panel_22 = Panel(analyze_karamba3d.MaximumDisplacement_cm)

# ----
# Viewing
model_view_karamba3d = ModelViewKaramba3D(Model=analyze_karamba3d.CalculatedModel, ResultFactors=1, ResultCase=-1)  # -> Model, DeformedMesh, DeformedAxes, DeformedModel
beam_view_karamba3d = BeamViewKaramba3D(Model=model_view_karamba3d.Model)  # -> Model, MeshesOfRenderedBeams, DeformedBeamAxes, LegendColors, LegendTags

# ----
# Column Displacements
number_slider_5 = Slider(3, range=0..10)
lateral_1 = Slider(1, range=0..1)
panel_23 = Panel("""4
5
6
7""")
beam_displacements_karamba3d = BeamDisplacementsKaramba3D(
    AnalyzedModel=analyze_karamba3d.CalculatedModel,
    BeamIdentifiers=panel_23,
    LoadCase=lateral_1,
    MaximumDistanceBetweenResults_m=-1,
    NumberOfResultsPerElement=number_slider_5)  # -> AnalyzedModel, simplify(flatten(Translations_m)), Rotations_rad
_0_2_is_4_3_5_is_5_6_8_is_6_9_11_is_7_x = Panel(beam_displacements_karamba3d.Translations_m)  # "0-2 is 4, 3-5 is 5, 6-8 is 6, 9-11 is 7 (X,Y,Z)"

column_displacement_x_y_z = Panel(beam_displacements_karamba3d.Translations_m)
panel_24 = Panel(cross_section_selector_karamba3d_3.CrossSection)

panel_26 = Panel(cross_section_selector_karamba3d_4.CrossSection)

# ----
# Load Bearing Beam Displacement
number_slider_6 = Slider(3, range=0..10)
beam_displacements_karamba3d_2 = BeamDisplacementsKaramba3D(
    AnalyzedModel=analyze_karamba3d.CalculatedModel,
    BeamIdentifiers=panel_10,
    LoadCase=vertical_0_2,
    MaximumDistanceBetweenResults_m=-1,
    NumberOfResultsPerElement=number_slider_6)  # -> AnalyzedModel, simplify(flatten(Translations_m)), Rotations_rad
_0_3_are_beam_0_2_3_5_are_beam_1_2_ident = Panel(beam_displacements_karamba3d_2.Translations_m)  # "0-3 are beam 0/2, 3-5 are beam 1/2 (identical)"

# ----
# Non- Load Bearing Beam Displacement
panel_27 = Panel("""0
1""")
beam_displacements_karamba3d_3 = BeamDisplacementsKaramba3D(
    AnalyzedModel=analyze_karamba3d.CalculatedModel,
    BeamIdentifiers=panel_27,
    LoadCase=vertical_0,
    MaximumDistanceBetweenResults_m=-1,
    NumberOfResultsPerElement=Slider(3, range=0..10))  # -> AnalyzedModel, simplify(flatten(Translations_m)), Rotations_rad
_0_3_are_beam_0_3_5_are_beam_1_identical = Panel(beam_displacements_karamba3d_3.Translations_m)

# ----
# Load Bearing Beam Moments
number_slider_7 = Slider(3, range=1..10)
# Optimizing Cross Section Using Karamba
# Load Bearing Beams
# Non-Load Bearing Beams
panel_28 = Panel("""2
3""")
beam_forces_karamba3d = BeamForcesKaramba3D(
    AnalyzedModel=analyze_karamba3d.CalculatedModel,
    BeamIdentifiers=panel_28,
    LCase=-1,
    MaximumDistanceBetweenResults_m=-1,
    NumberOfResultsPerBeamElement=number_slider_7)  # -> AnalyzedModel, NormalForce_kN, ShearForceVz_kN, ShearForceVy_kN, BendingMomentMt_kNm, simplify(BendingMomentMy_kNm), BendingMomentMz_kNm
utilization_of_elements_karamba3d = UtilizationOfElementsKaramba3D(
    AnalyzedModel=beam_forces_karamba3d.AnalyzedModel,
    ElemIdentifiers=panel_28,
    ResultCase=-1,
    NumberOfSamplePoints=3,
    ElasticDesign=True,
    GammaM0=1,
    GammaM1=1,
    WithDetails=False,
    mode="Beams")  # -> AnalyzedModel, Utilization, SigMax_kN_cm2, SigMin_kN_cm2, TauMax_kN_cm2, UtilN, UtilVy, UtilVz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
list_item = ListItem(List=utilization_of_elements_karamba3d.UtilMy, Index=Slider(0, range=0..1), Wrap=True)
panel_29 = Panel(utilization_of_elements_karamba3d.UtilMy)
panel_30 = Panel(beam_forces_karamba3d.BendingMomentMy_kNm)
panel_31 = Panel(utilization_of_elements_karamba3d.Utilization)
panel_32 = Panel(list_item)

panel_33 = Panel(cross_section_selector_karamba3d_2.CrossSection)

# ----
# Column Axial Loads
panel_34 = Panel("""4
5
6
7""")
beam_forces_karamba3d_2 = BeamForcesKaramba3D(
    AnalyzedModel=analyze_karamba3d.CalculatedModel,
    BeamIdentifiers=panel_34,
    LCase=-1,
    MaximumDistanceBetweenResults_m=-1,
    NumberOfResultsPerBeamElement=Slider(3, range=0..10))  # -> AnalyzedModel, simplify(NormalForce_kN), ShearForceVz_kN, ShearForceVy_kN, BendingMomentMt_kNm, BendingMomentMy_kNm, BendingMomentMz_kNm
utilization_of_elements_karamba3d_2 = UtilizationOfElementsKaramba3D(
    AnalyzedModel=beam_forces_karamba3d_2.AnalyzedModel,
    ElemIdentifiers=panel_34,
    ResultCase=-1,
    NumberOfSamplePoints=3,
    ElasticDesign=True,
    GammaM0=1,
    GammaM1=1,
    WithDetails=False,
    mode="Beams")  # -> AnalyzedModel, Utilization, SigMax_kN_cm2, SigMin_kN_cm2, TauMax_kN_cm2, UtilN, UtilVy, UtilVz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
panel_35 = Panel(beam_forces_karamba3d_2.NormalForce_kN)
panel_36 = Panel(utilization_of_elements_karamba3d_2.UtilN)

# ----
# Non-Load Bearing Beam Moments
number_slider_8 = Slider(3, range=0..10)
panel_37 = Panel("""0
1""")
beam_forces_karamba3d_3 = BeamForcesKaramba3D(
    AnalyzedModel=analyze_karamba3d.CalculatedModel,
    BeamIdentifiers=panel_37,
    LCase=-1,
    MaximumDistanceBetweenResults_m=-1,
    NumberOfResultsPerBeamElement=number_slider_8)  # -> AnalyzedModel, NormalForce_kN, ShearForceVz_kN, ShearForceVy_kN, BendingMomentMt_kNm, simplify(BendingMomentMy_kNm), simplify(BendingMomentMz_kNm)
utilization_of_elements_karamba3d_3 = UtilizationOfElementsKaramba3D(
    AnalyzedModel=beam_forces_karamba3d_3.AnalyzedModel,
    ElemIdentifiers=panel_37,
    ResultCase=-1,
    NumberOfSamplePoints=3,
    ElasticDesign=True,
    GammaM0=1,
    GammaM1=1,
    WithDetails=False,
    mode="Beams")  # -> AnalyzedModel, Utilization, SigMax_kN_cm2, SigMin_kN_cm2, TauMax_kN_cm2, UtilN, UtilVy, UtilVz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
list_item_2 = ListItem(List=utilization_of_elements_karamba3d_3.UtilMy, Index=Slider(2, range=2..3), Wrap=True)
panel_38 = Panel(utilization_of_elements_karamba3d_3.UtilMy)
panel_39 = Panel(utilization_of_elements_karamba3d_3.Utilization)
panel_40 = Panel(beam_forces_karamba3d_3.BendingMomentMy_kNm)
panel_41 = Panel(list_item_2)

panel_42 = Panel(cross_section_selector_karamba3d.CrossSection)

# ----
# Bracing Axial Loads
number_slider_9 = Slider(3, range=0..10)
panel_45 = Panel("""8
9
10
11""")
beam_forces_karamba3d_4 = BeamForcesKaramba3D(
    AnalyzedModel=analyze_karamba3d.CalculatedModel,
    BeamIdentifiers=panel_45,
    LCase=-1,
    MaximumDistanceBetweenResults_m=-1,
    NumberOfResultsPerBeamElement=number_slider_9)  # -> AnalyzedModel, NormalForce_kN, ShearForceVz_kN, ShearForceVy_kN, BendingMomentMt_kNm, BendingMomentMy_kNm, BendingMomentMz_kNm
utilization_of_elements_karamba3d_4 = UtilizationOfElementsKaramba3D(
    AnalyzedModel=beam_forces_karamba3d_4.AnalyzedModel,
    ElemIdentifiers=panel_45,
    ResultCase=-1,
    NumberOfSamplePoints=3,
    ElasticDesign=True,
    GammaM0=1,
    GammaM1=1,
    WithDetails=False,
    mode="Beams")  # -> AnalyzedModel, Utilization, SigMax_kN_cm2, SigMin_kN_cm2, TauMax_kN_cm2, UtilN, UtilVy, UtilVz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
panel_46 = Panel(utilization_of_elements_karamba3d_4.UtilN)
panel_47 = Panel(beam_forces_karamba3d_4.NormalForce_kN)

panel_48 = Panel(beam_forces_karamba3d.NormalForce_kN)
panel_49 = Panel(beam_forces_karamba3d_2.BendingMomentMy_kNm)
panel_50 = Panel(beam_forces_karamba3d_3.NormalForce_kN)

# ----
# Columns, Lateral Deflection X
panel_51 = Panel("1000")
multiplication_3 = Multiplication(A=number_slider_2, B=panel_51)
division = Division(A=multiplication_3, B=Slider(400, range=0..1000))
panel_52 = Panel(multiplication_3)
panel_53 = Panel(division)
list_item_3 = ListItem(List=beam_displacements_karamba3d.Translations_m, Index=Slider(1, range=0..11), Wrap=True)
list_item_4 = ListItem(List=beam_displacements_karamba3d.Translations_m, Index=Slider(7, range=0..11), Wrap=True)
list_item_5 = ListItem(List=beam_displacements_karamba3d.Translations_m, Index=Slider(10, range=0..11), Wrap=True)
list_item_6 = ListItem(List=beam_displacements_karamba3d.Translations_m, Index=Slider(4, range=0..11), Wrap=True)
panel_54 = Panel(list_item_3)
panel_55 = Panel(list_item_4)
panel_56 = Panel(list_item_5)
panel_57 = Panel(list_item_6)
deconstruct_vector = DeconstructVector(Vector=list_item_3)  # -> XComponent, YComponent, ZComponent
deconstruct_vector_2 = DeconstructVector(Vector=list_item_4)  # -> XComponent, YComponent, ZComponent
deconstruct_vector_3 = DeconstructVector(Vector=list_item_5)  # -> XComponent, YComponent, ZComponent
deconstruct_vector_4 = DeconstructVector(Vector=list_item_6)  # -> XComponent, YComponent, ZComponent
panel_58 = Panel(deconstruct_vector.XComponent)
panel_59 = Panel(deconstruct_vector_2.XComponent)
panel_60 = Panel(deconstruct_vector_3.XComponent)
panel_61 = Panel(deconstruct_vector_4.XComponent)
converting_to_mm = Panel("-1000")
converting_to_mm_2 = Panel("-1000")
converting_to_mm_3 = Panel("-1000")
converting_to_mm_4 = Panel("-1000")
multiplication_4 = Multiplication(A=converting_to_mm, B=deconstruct_vector.XComponent)
multiplication_5 = Multiplication(A=converting_to_mm_2, B=deconstruct_vector_2.XComponent)
multiplication_6 = Multiplication(A=converting_to_mm_3, B=deconstruct_vector_3.XComponent)
multiplication_7 = Multiplication(A=converting_to_mm_4, B=deconstruct_vector_4.XComponent)
panel_62 = Panel(multiplication_4)
absolute = Absolute(Value=multiplication_4)
panel_63 = Panel(multiplication_5)
panel_64 = Panel(multiplication_6)
panel_65 = Panel(multiplication_7)
absolute_2 = Absolute(Value=multiplication_5)
absolute_3 = Absolute(Value=multiplication_6)
absolute_4 = Absolute(Value=multiplication_7)
smaller_than = SmallerThan(FirstNumber=absolute, SecondNumber=division)  # -> SmallerThan, OrEqualTo
smaller_than_2 = SmallerThan(FirstNumber=absolute_2, SecondNumber=division)  # -> SmallerThan, OrEqualTo
smaller_than_3 = SmallerThan(FirstNumber=absolute_3, SecondNumber=division)  # -> SmallerThan, OrEqualTo
smaller_than_4 = SmallerThan(FirstNumber=absolute_4, SecondNumber=division)  # -> SmallerThan, OrEqualTo
panel_66 = Panel(smaller_than.SmallerThan)
panel_67 = Panel(smaller_than_2.SmallerThan)
panel_68 = Panel(smaller_than_3.SmallerThan)
panel_69 = Panel(smaller_than_4.SmallerThan)
gate_and = GateAnd(A=smaller_than.SmallerThan, B=smaller_than_4.SmallerThan, C=smaller_than_2.SmallerThan, D=smaller_than_3.SmallerThan)
panel_70 = Panel(gate_and)

# ----
# Columns, Lateral Deflection Y
panel_71 = Panel("1000")
multiplication_8 = Multiplication(A=number_slider_2, B=panel_71)
division_2 = Division(A=multiplication_8, B=Slider(400, range=0..1000))
panel_72 = Panel(division_2)
list_item_7 = ListItem(List=beam_displacements_karamba3d.Translations_m, Index=Slider(1, range=0..11), Wrap=True)
list_item_8 = ListItem(List=beam_displacements_karamba3d.Translations_m, Index=Slider(7, range=0..11), Wrap=True)
list_item_9 = ListItem(List=beam_displacements_karamba3d.Translations_m, Index=Slider(10, range=0..11), Wrap=True)
list_item_10 = ListItem(List=beam_displacements_karamba3d.Translations_m, Index=Slider(4, range=0..11), Wrap=True)
panel_73 = Panel(list_item_7)
panel_74 = Panel(list_item_8)
panel_75 = Panel(list_item_9)
panel_76 = Panel(list_item_10)
deconstruct_vector_5 = DeconstructVector(Vector=list_item_7)  # -> XComponent, YComponent, ZComponent
deconstruct_vector_6 = DeconstructVector(Vector=list_item_8)  # -> XComponent, YComponent, ZComponent
deconstruct_vector_7 = DeconstructVector(Vector=list_item_9)  # -> XComponent, YComponent, ZComponent
deconstruct_vector_8 = DeconstructVector(Vector=list_item_10)  # -> XComponent, YComponent, ZComponent
panel_77 = Panel(deconstruct_vector_5.YComponent)
panel_78 = Panel(deconstruct_vector_6.YComponent)
panel_79 = Panel(deconstruct_vector_7.YComponent)
panel_80 = Panel(deconstruct_vector_8.YComponent)
converting_to_mm_5 = Panel("-1000")
converting_to_mm_6 = Panel("-1000")
converting_to_mm_7 = Panel("-1000")
converting_to_mm_8 = Panel("-1000")
multiplication_9 = Multiplication(A=converting_to_mm_5, B=deconstruct_vector_5.YComponent)
multiplication_10 = Multiplication(A=converting_to_mm_6, B=deconstruct_vector_6.YComponent)
multiplication_11 = Multiplication(A=converting_to_mm_7, B=deconstruct_vector_7.YComponent)
multiplication_12 = Multiplication(A=converting_to_mm_8, B=deconstruct_vector_8.YComponent)
panel_81 = Panel(multiplication_9)
absolute_5 = Absolute(Value=multiplication_9)
panel_82 = Panel(multiplication_10)
panel_83 = Panel(multiplication_11)
panel_84 = Panel(multiplication_12)
absolute_6 = Absolute(Value=multiplication_10)
absolute_7 = Absolute(Value=multiplication_11)
absolute_8 = Absolute(Value=multiplication_12)
smaller_than_5 = SmallerThan(FirstNumber=absolute_5, SecondNumber=division_2)  # -> SmallerThan, OrEqualTo
smaller_than_6 = SmallerThan(FirstNumber=absolute_6, SecondNumber=division_2)  # -> SmallerThan, OrEqualTo
smaller_than_7 = SmallerThan(FirstNumber=absolute_7, SecondNumber=division_2)  # -> SmallerThan, OrEqualTo
smaller_than_8 = SmallerThan(FirstNumber=absolute_8, SecondNumber=division_2)  # -> SmallerThan, OrEqualTo
panel_85 = Panel(smaller_than_5.SmallerThan)
panel_86 = Panel(smaller_than_6.SmallerThan)
panel_87 = Panel(smaller_than_7.SmallerThan)
panel_88 = Panel(smaller_than_8.SmallerThan)
gate_and_2 = GateAnd(A=smaller_than_5.SmallerThan, B=smaller_than_8.SmallerThan, C=smaller_than_6.SmallerThan, D=smaller_than_7.SmallerThan)
panel_89 = Panel(gate_and_2)

# ----
# Load Bearing Beams Vertical Deflection
# Non-Load Bearing Beams Vertical Deflection
number_slider_10 = Slider(1, range=0..5)
list_item_11 = ListItem(List=beam_displacements_karamba3d_2.Translations_m, Index=number_slider_10, Wrap=True)
list_item_12 = ListItem(List=beam_displacements_karamba3d_3.Translations_m, Index=Slider(1, range=0..5), Wrap=True)
panel_90 = Panel(list_item_11)
panel_91 = Panel(list_item_12)
multiplication_13 = Multiplication(A=number_slider_3, B="1000")
deconstruct_vector_9 = DeconstructVector(Vector=list_item_11)  # -> XComponent, YComponent, ZComponent
deconstruct_vector_10 = DeconstructVector(Vector=list_item_12)  # -> XComponent, YComponent, ZComponent
division_3 = Division(A=multiplication_13, B=Slider(360, range=0..1000))
multiplication_14 = Multiplication(A=number_slider, B="1000")
panel_92 = Panel(deconstruct_vector_9.ZComponent)
panel_93 = Panel(deconstruct_vector_10.ZComponent)
panel_94 = Panel(division_3)
division_4 = Division(A=multiplication_14, B=Slider(360, range=0..1000))
converting_to_m = Panel("-1000")
panel_95 = Panel(division_4)
converting_to_m_2 = Panel("-1000")
multiplication_15 = Multiplication(A=converting_to_m, B=deconstruct_vector_9.ZComponent)
panel_96 = Panel(multiplication_15)
multiplication_16 = Multiplication(A=converting_to_m_2, B=deconstruct_vector_10.ZComponent)
panel_97 = Panel(multiplication_16)
smaller_than_9 = SmallerThan(FirstNumber=multiplication_15, SecondNumber=division_3)  # -> SmallerThan, OrEqualTo
panel_98 = Panel(smaller_than_9.SmallerThan)
smaller_than_10 = SmallerThan(FirstNumber=multiplication_16, SecondNumber=division_4)  # -> SmallerThan, OrEqualTo
panel_99 = Panel(smaller_than_10.SmallerThan)

# ----
# lateral deflections
number_slider_11 = Slider(3, range=0..10)
lateral_1_2 = Slider(1, range=0..1)
panel_100 = Panel("""8
9
10
11""")
beam_displacements_karamba3d_4 = BeamDisplacementsKaramba3D(
    AnalyzedModel=analyze_karamba3d.CalculatedModel,
    BeamIdentifiers=panel_100,
    LoadCase=lateral_1_2,
    MaximumDistanceBetweenResults_m=-1,
    NumberOfResultsPerElement=number_slider_11)  # -> AnalyzedModel, simplify(flatten(Translations_m)), Rotations_rad
_0_2_is_col_8_3_5_is_col_9_6_8_is_col_10 = Panel(beam_displacements_karamba3d_4.Translations_m)  # "0-2 is col 8, 3-5 is col 9, 6-8 is col 10, 9-11 is col 11"
list_item_13 = ListItem(List=_0_2_is_col_8_3_5_is_col_9_6_8_is_col_10, Index=Slider(0, range=0..11), Wrap=True)
list_item_14 = ListItem(List=_0_2_is_col_8_3_5_is_col_9_6_8_is_col_10, Index=Slider(3, range=0..11), Wrap=True)
list_item_15 = ListItem(List=_0_2_is_col_8_3_5_is_col_9_6_8_is_col_10, Index=Slider(6, range=0..11), Wrap=True)
list_item_16 = ListItem(List=_0_2_is_col_8_3_5_is_col_9_6_8_is_col_10, Index=Slider(9, range=0..11), Wrap=True)
panel_101 = Panel(list_item_13)
panel_102 = Panel(list_item_14)
panel_103 = Panel(list_item_15)
panel_104 = Panel(list_item_16)
deconstruct_vector_11 = DeconstructVector(Vector=list_item_13)  # -> XComponent, YComponent, ZComponent
deconstruct_vector_12 = DeconstructVector(Vector=panel_91)  # -> XComponent, YComponent, ZComponent
deconstruct_vector_13 = DeconstructVector(Vector=list_item_14)  # -> XComponent, YComponent, ZComponent
deconstruct_vector_14 = DeconstructVector(Vector=panel_90)  # -> XComponent, YComponent, ZComponent
deconstruct_vector_15 = DeconstructVector(Vector=list_item_15)  # -> XComponent, YComponent, ZComponent
deconstruct_vector_16 = DeconstructVector(Vector=list_item_16)  # -> XComponent, YComponent, ZComponent
number_slider_12 = Slider(1000, range=0..1000)
multiplication_17 = Multiplication(A=deconstruct_vector_11.XComponent, B="-1000")
multiplication_18 = Multiplication(A=deconstruct_vector_13.XComponent, B="-1000")
multiplication_19 = Multiplication(A=deconstruct_vector_15.XComponent, B="-1000")
# non-load bearing beams
multiplication_20 = Multiplication(A=deconstruct_vector_12.XComponent, B=number_slider_12)
multiplication_21 = Multiplication(A=deconstruct_vector_16.XComponent, B="-1000")
# load bearing beams
multiplication_22 = Multiplication(A=deconstruct_vector_14.XComponent, B=number_slider_12)
# columns
panel_105 = Panel(multiplication_17)
panel_106 = Panel(multiplication_18)
panel_107 = Panel(panel_64)
panel_108 = Panel(panel_62)
panel_109 = Panel(multiplication_19)
panel_110 = Panel(multiplication_20)
panel_111 = Panel(panel_84)
# braces
panel_112 = Panel(panel_81)
panel_113 = Panel(multiplication_21)
panel_114 = Panel(multiplication_22)
duplicate_data = DuplicateData(Data=panel_114, Number=2, Order=True)
duplicate_data_2 = DuplicateData(Data=panel_110, Number=2, Order=True)
merge = Merge(
    Data1=panel_112,
    Data2=panel_111,
    Data3=panel_108,
    Data4=panel_107,
    Data5=panel_105,
    Data6=panel_106,
    Data7=panel_109,
    Data8=panel_113,
    Data9=duplicate_data_2,
    Data10=duplicate_data)  # -> flatten(Result)

# ----
# Load Bearing Beams Moments
# Non-Load Bearing Beams moments
# Columns axial
# Braces axial
number_slider_13 = Slider(1, range=0..3)
list_item_17 = ListItem(List=panel_36, Index=Slider(0, range=0..3), Wrap=True)
list_item_18 = ListItem(List=panel_36, Index=Slider(2, range=0..3), Wrap=True)
list_item_19 = ListItem(List=panel_36, Index=number_slider_13, Wrap=True)
list_item_20 = ListItem(List=panel_46, Index=Slider(0, range=0..3), Wrap=True)
list_item_21 = ListItem(List=panel_46, Index=Slider(2, range=0..3), Wrap=True)
list_item_22 = ListItem(List=panel_36, Index=Slider(3, range=0..3), Wrap=True)
list_item_23 = ListItem(List=panel_46, Index=Slider(1, range=0..3), Wrap=True)
list_item_24 = ListItem(List=panel_46, Index=Slider(3, range=0..3), Wrap=True)
number_slider_14 = Slider(1, range=0..1)
# Fitness Function 2
number_slider_15 = Slider(1, range=0..1)
number_slider_16 = Slider(1, range=0..1)
smaller_than_11 = SmallerThan(FirstNumber=list_item_2, SecondNumber=Slider(1, range=0..1))  # -> SmallerThan, OrEqualTo
smaller_than_12 = SmallerThan(FirstNumber=list_item_19, SecondNumber=number_slider_14)  # -> SmallerThan, OrEqualTo
smaller_than_13 = SmallerThan(FirstNumber=list_item_17, SecondNumber=number_slider_14)  # -> SmallerThan, OrEqualTo
smaller_than_14 = SmallerThan(FirstNumber=list_item_22, SecondNumber=number_slider_14)  # -> SmallerThan, OrEqualTo
smaller_than_15 = SmallerThan(FirstNumber=list_item_18, SecondNumber=number_slider_14)  # -> SmallerThan, OrEqualTo
smaller_than_16 = SmallerThan(FirstNumber=list_item, SecondNumber=number_slider_15)  # -> SmallerThan, OrEqualTo
smaller_than_17 = SmallerThan(FirstNumber=list_item_23, SecondNumber=number_slider_16)  # -> SmallerThan, OrEqualTo
smaller_than_18 = SmallerThan(FirstNumber=list_item_20, SecondNumber=number_slider_16)  # -> SmallerThan, OrEqualTo
smaller_than_19 = SmallerThan(FirstNumber=list_item_24, SecondNumber=number_slider_16)  # -> SmallerThan, OrEqualTo
smaller_than_20 = SmallerThan(FirstNumber=list_item_21, SecondNumber=number_slider_16)  # -> SmallerThan, OrEqualTo
panel_115 = Panel(smaller_than_11.SmallerThan)
panel_116 = Panel(smaller_than_16.SmallerThan)
gate_and_3 = GateAnd(
    A=smaller_than_13.SmallerThan,
    B=smaller_than_12.SmallerThan,
    C=smaller_than_15.SmallerThan,
    D=smaller_than_14.SmallerThan)
gate_and_4 = GateAnd(
    A=smaller_than_18.SmallerThan,
    B=smaller_than_17.SmallerThan,
    C=smaller_than_20.SmallerThan,
    D=smaller_than_19.SmallerThan)
panel_117 = Panel(gate_and_3)
panel_118 = Panel(gate_and_4)

# ----
# cross sectional area
# braces
panel_119 = Panel(disassemble_cross_section_karamba3d_4.Area_cm2)
# non-load bearing beams
panel_120 = Panel(disassemble_cross_section_karamba3d.Area_cm2)
# load bearing beams
panel_121 = Panel(disassemble_cross_section_karamba3d_2.Area_cm2)
# columns
panel_122 = Panel(disassemble_cross_section_karamba3d_3.Area_cm2)
duplicate_data_3 = DuplicateData(Data=panel_121, Number=2, Order=True)
duplicate_data_4 = DuplicateData(Data=panel_120, Number=2, Order=True)
duplicate_data_5 = DuplicateData(Data=panel_119, Number=Slider(4, range=0..10), Order=True)
duplicate_data_6 = DuplicateData(Data=panel_122, Number=Slider(4, range=0..10), Order=True)
merge_2 = Merge(Data1=duplicate_data_5, Data2=duplicate_data_6, Data3=duplicate_data_4, Data4=duplicate_data_3)  # -> flatten(Result)

# ----
# Moment z
# Column Moments
# Bracing Moments
# Non-Load Bearing Beam Moments
# Load Bearing Beam Moments
panel_123 = Panel(beam_forces_karamba3d.BendingMomentMy_kNm)
panel_124 = Panel(beam_forces_karamba3d_3.BendingMomentMy_kNm)
flatten_tree = FlattenTree(Tree=panel_123, Path="{0}")
panel_125 = Panel("""1
4""")
flatten_tree_2 = FlattenTree(Tree=panel_124, Path="{0}")
list_item_25 = ListItem(List=flatten_tree_2, Index=panel_125, Wrap=True)
panel_126 = Panel(beam_forces_karamba3d_2.BendingMomentMy_kNm)
list_item_26 = ListItem(List=flatten_tree, Index=panel_125, Wrap=True)
panel_127 = Panel("""1
4
7
10""")
flatten_tree_3 = FlattenTree(Tree=panel_126, Path="{0}")
list_item_27 = ListItem(List=flatten_tree_3, Index=panel_127, Wrap=True)
panel_128 = Panel(flatten_tree_3)
panel_129 = Panel(beam_forces_karamba3d_4.BendingMomentMy_kNm)
flatten_tree_4 = FlattenTree(Tree=panel_129, Path="{0}")
list_item_28 = ListItem(List=flatten_tree_4, Index=panel_127, Wrap=True)
merge_3 = Merge(Data1=list_item_28, Data2=list_item_27, Data3=list_item_25, Data4=list_item_26)  # -> flatten(Result)
absolute_9 = Absolute(Value=merge_3)
panel_130 = Panel(merge_3)

penalty_factor_p = Panel("""1000000
1""")
list_item_29 = ListItem(List=penalty_factor_p, Index=panel_117, Wrap=True)
list_item_30 = ListItem(List=penalty_factor_p, Index=smaller_than_16.SmallerThan, Wrap=True)
list_item_31 = ListItem(List=penalty_factor_p, Index=panel_118, Wrap=True)
list_item_32 = ListItem(List=penalty_factor_p, Index=smaller_than_11.SmallerThan, Wrap=True)
panel_131 = Panel(list_item_29)
list_item_33 = ListItem(List=penalty_factor_p, Index=smaller_than_9.SmallerThan, Wrap=True)
panel_132 = Panel(list_item_30)
panel_133 = Panel(list_item_31)
panel_134 = Panel(list_item_32)
list_item_34 = ListItem(List=penalty_factor_p, Index=smaller_than_10.SmallerThan, Wrap=True)
list_item_35 = ListItem(List=penalty_factor_p, Index=gate_and, Wrap=True)
panel_135 = Panel(list_item_33)
list_item_36 = ListItem(List=penalty_factor_p, Index=gate_and_2, Wrap=True)
panel_136 = Panel(list_item_34)
panel_137 = Panel(list_item_35)
panel_138 = Panel(list_item_36)

# ----
# Training data
lateral_delfection = Panel(merge)
cross_sectional_area = Panel(merge_2)
moment_z = Panel(absolute_9)
absolute_10 = Absolute(Value=lateral_delfection)
bounds = Bounds(Numbers=moment_z)
bounds_2 = Bounds(Numbers=cross_sectional_area)
bounds_3 = Bounds(Numbers=absolute_10)
remap_numbers = RemapNumbers(Value=moment_z, Source=bounds, Target=Domain(0, 1))  # -> Mapped, Clipped
remap_numbers_2 = RemapNumbers(Value=cross_sectional_area, Source=bounds_2, Target=Domain(0, 1))  # -> Mapped, Clipped
remap_numbers_3 = RemapNumbers(Value=absolute_10, Source=bounds_3, Target=Domain(0, 1))  # -> Mapped, Clipped
entwine = Entwine(Branch00=remap_numbers.Mapped, Branch01=remap_numbers_2.Mapped, Branch02=remap_numbers_3.Mapped, FlattenInputs=True)
flip_matrix = FlipMatrix(Data=entwine)
panel_139 = Panel(flip_matrix)

# ----
# Test data
# Training data was taken from an exterior frame model that is structural the same. I am testing one of the Non load bearing beam and changed the loading and cross section.
# 
# New Vert Live Load: from -10 to -20 kPa
# New Wind Load: from 3 to 5 kPa
# 
# Result NN output should be index 8 or 9
image_sampler = ImageSampler(Filter="Colour", Interpolate=False, Umax=1, Umin=0, Vmax=1, Vmin=0, Wrap=1)
# supervised machine learning- neural network
moment_z_from_exterior_model = Panel("73.9")
cross_section_from_exterior_model = Panel("39.6")
lateral_deflection_from_exterior_model = Panel("0.641")
remap_numbers_4 = RemapNumbers(Value=moment_z_from_exterior_model, Source=bounds, Target=Domain(0, 1))  # -> Mapped, Clipped
remap_numbers_5 = RemapNumbers(Value=cross_section_from_exterior_model, Source=bounds_2, Target=Domain(0, 1))  # -> Mapped, Clipped
remap_numbers_6 = RemapNumbers(Value=lateral_deflection_from_exterior_model, Source=bounds_3, Target=Domain(0, 1))  # -> Mapped, Clipped
entwine_2 = Entwine(Branch00=remap_numbers_4.Mapped, Branch01=remap_numbers_5.Mapped, Branch02=remap_numbers_6.Mapped, FlattenInputs=True)
flip_matrix_2 = FlipMatrix(Data=entwine_2)
panel_140 = Panel(flip_matrix_2)

# ----
# 1. Optimize Beam Sizes
multiplication_23 = Multiplication(A=assemble_model_karamba3d.Mass_kg, B=list_item_33)
multiplication_24 = Multiplication(A=multiplication_23, B=list_item_34)
multiplication_25 = Multiplication(A=multiplication_24, B=list_item_30)
multiplication_26 = Multiplication(A=multiplication_25, B=list_item_32)
panel_141 = Panel(multiplication_26)
galapagos = Galapagos(fitness=multiplication_26, gene=[name_or_list_of_index_of_cross_section_f_2, name_or_list_of_index_of_cross_section_f])
galapagos_listener = GalapagosListener(
    Genomes=[name_or_list_of_index_of_cross_section_f, name_or_list_of_index_of_cross_section_f_2],
    Fitness=multiplication_26,
    Reset=Toggle(False))  # -> Fitness, Iterations
panel_142 = Panel(galapagos_listener.Iterations)
panel_143 = Panel(galapagos_listener.Fitness)

# ----
# Member Name: Brace
# Brace
# Brace
# Brace
# Col
# Col
# Col
# Col
# Non-load beam
# Non-load beam
# Load beam
# Load Beam
panel_144 = Panel("2")
panel_145 = Panel("5")
neural_network = NeuralNetwork(
    TestData=panel_140,
    TraingInputs=panel_139,
    Labels=member_index,
    HiddenNeurons=Slider(3, range=0..10),
    Alpha=Slider(2, range=0..10),
    Iterations=Slider(15, range=0..50),
    RandomSeed=5)
panel_146 = Panel(neural_network)

# ----
# 2. Optimize Bracing and Column Sizes
multiplication_27 = Multiplication(A=multiplication_26, B=list_item_35)
multiplication_28 = Multiplication(A=multiplication_27, B=list_item_36)
multiplication_29 = Multiplication(A=multiplication_28, B=list_item_29)
multiplication_30 = Multiplication(A=multiplication_29, B=list_item_31)
galapagos_2 = Galapagos(fitness=multiplication_30, gene=[name_or_list_of_index_of_cross_section_f_3, name_or_list_of_index_of_cross_section_f_4])
panel_147 = Panel(multiplication_30)
galapagos_listener_2 = GalapagosListener(
    Genomes=[name_or_list_of_index_of_cross_section_f_3, name_or_list_of_index_of_cross_section_f_4],
    Fitness=multiplication_30,
    Reset=Toggle(False))  # -> Fitness, Iterations
panel_148 = Panel(galapagos_listener_2.Iterations)
panel_149 = Panel(galapagos_listener_2.Fitness)

# ----
# Key Structural Results
ult_load_bearing = Panel(list_item)
column_ults = Panel(panel_36)
bracing_ults = Panel(panel_46)
bracing_numbering = Panel("""8
9
10
11""")
column_numbering = Panel("""4
5
6
7""")
all_lateral_delfc_x_satisfied = Panel(panel_70)
defl_load_bearing = Panel(panel_96)
defl_non_load_bearing = Panel(panel_97)
defl_limit_load_bear = Panel(panel_94)
defl_limit_non_load_bearing = Panel(panel_95)
all_lateral_delfc_y_satisfied = Panel(panel_89)
panel_151 = Panel(panel_24)
panel_152 = Panel(panel_26)

# ----
# unsupervised machine learning
# unsup data
# Real sorting: Brace
# Brace
# Brace
# Brace
# Col
# Col
# Col
# Col
# Non-load beam
# Non-load beam
# Load beam
# Load Beam
panel_154 = Panel(merge)
moment_z_2 = Panel(absolute_9)
cross_sectional_area_2 = Panel(merge_2)
absolute_11 = Absolute(Value=panel_154)
entwine_3 = Entwine(Branch00=moment_z_2, Branch01=cross_sectional_area_2, Branch02=absolute_11, FlattenInputs=True)
flip_matrix_3 = FlipMatrix(Data=entwine_3)
unsupervised_inputs_moment_area_lateral = Panel(flip_matrix_3)  # "Unsupervised inputs (moment, area, lateral deflection)"

number_slider_17 = Slider(4, range=0..10)
gaussian_mixture = GaussianMixture(TrainingInputs=unsupervised_inputs_moment_area_lateral, Components=number_slider_17, RandomSeed=5)  # -> Result, Likelihood, Probability
k_means_clustering = KMeansClustering(TrainingInputs=unsupervised_inputs_moment_area_lateral, OfClusters=number_slider_17, RandomSeed=5)  # -> Result, Likelihood, Centroids

algo_sorting = Panel(k_means_clustering.Result)
